# Grasshopper definition 1120_general_workflow.gh (Grasshopper 1.0.7)
# plug-ins: Bifocals, BarkBeetle, Weaverbird, KUKA|prc - parametric robot control

# ----
# Preparation
surface = Surface(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)
brep_edges = BrepEdges(Brep=surface)  # -> Naked, Interior, NonManifold
dispatch = Dispatch(List=brep_edges.Naked, DispatchPattern=[True, False])  # -> ListA, ListB
divide_curve = DivideCurve(Curve=dispatch.ListA, Count=Slider(4, range=0..20), Kinks=False)  # -> Points, Tangents, Parameters
divide_curve_2 = DivideCurve(Curve=dispatch.ListB, Count=Slider(3, range=0..10), Kinks=False)  # -> Points, Tangents, Parameters
explode_tree = ExplodeTree(Data=divide_curve.Points)  # -> Branch0, Branch1
explode_tree_2 = ExplodeTree(Data=divide_curve_2.Points)  # -> Branch0, Branch1
reverse_list = ReverseList(List=explode_tree_2.Branch1)
reverse_list_2 = ReverseList(List=explode_tree.Branch1)
geodesic = Geodesic(Surface=surface, Start=explode_tree_2.Branch0, End=reverse_list)
geodesic_2 = Geodesic(Surface=surface, Start=explode_tree.Branch0, End=reverse_list_2)
construct_point = ConstructPoint(XCoordinate=Slider(1, range=0..1), YCoordinate=Slider(0, range=0..1), ZCoordinate=0)
curve_intersection = CurveIntersection(CurvesA=graft(geodesic_2), CurvesB=geodesic, Tolerance=Slider(1, range=0..10))  # -> simplify(IntersectionPoints)
evaluate_surface = EvaluateSurface(Surface=reparameterize(surface), Point=construct_point)  # -> Point, Normal, UDirection, VDirection, Frame

number_slider = Slider(300, range=0..1000)
point = Point(curve_intersection)
surface_2 = Surface(surface)

# ---- group: Flip Matrix
flip_matrix = FlipMatrix(Data=point)
uv_network = UVNetwork(PointsTree=flip_matrix, Surface=surface_2, StripWidth=number_slider, ReferenceOption=0)  # -> UVNetwork, Points, UVCurves, ExtendedSrf

# ----
# Network
panel = Panel("0")
uv_network_2 = UVNetwork(PointsTree=point, Surface=surface_2, StripWidth=number_slider, ReferenceOption=panel)  # -> UVNetwork, Points, UVCurves, ExtendedSrf
brep_strip = BrepStrip(UVNetwork=uv_network_2.UVNetwork, StripExtension=Slider(69, range=0..100))

group = Group(Objects=flatten(uv_network_2.Points))

# ----
# Skeleton Graph
spiral_skeleton_graph = SpiralSkeletonGraph(UVNetwork=uv_network_2.UVNetwork)  # -> SkeletonGraph, SkeletonPoints, MainCurve, BranchCurves, Vectors
snake_skeleton_graph = SnakeSkeletonGraph(UVNetwork=uv_network.UVNetwork)  # -> SkeletonGraph, SkeletonPoints, MainCurve, BranchCurves, Vectors
snake_skeleton_graph_2 = SnakeSkeletonGraph(UVNetwork=uv_network_2.UVNetwork)  # -> SkeletonGraph, SkeletonPoints, MainCurve, BranchCurves, Vectors

number_slider_2 = Slider(30, range=0..100)

# ----
# Pattern
spiral_toolpath_pattern = SpiralToolpathPattern(
    SkeletonGraph=graft([snake_skeleton_graph.SkeletonGraph, snake_skeleton_graph_2.SkeletonGraph]),
    SeamPoint=evaluate_surface.Point,
    PathWidth=number_slider_2)  # -> flatten(ToolpathPattern), Curve
spiral_toolpath_pattern_2 = SpiralToolpathPattern(SkeletonGraph=spiral_skeleton_graph.SkeletonGraph, SeamPoint=evaluate_surface.Point, PathWidth=number_slider_2)  # -> ToolpathPattern, Curve
unpack_toolpath_pattern = UnpackToolpathPattern(ToolpathPattern=spiral_toolpath_pattern_2.ToolpathPattern)  # -> SkeletonGraph, Curve, BundleCurves, Points
stack_toolpath_pattern = StackToolpathPattern(
    TopPattern=spiral_toolpath_pattern_2.ToolpathPattern,
    TopCount="1",
    MiddlePatternS=spiral_toolpath_pattern.ToolpathPattern,
    BottomPattern=spiral_toolpath_pattern_2.ToolpathPattern,
    BottomCount="1")

point_2 = Point(flatten(unpack_toolpath_pattern.Points))
curve = Curve(unpack_toolpath_pattern.BundleCurves)
group_2 = Group(Objects=point_2)

# ----
# Stack Between Surfaces
number_slider_3 = Slider(40, range=0..100)  # disabled
number_slider_4 = Slider(5, range=0..10)  # disabled
boolean_toggle = BooleanToggle(False)  # disabled
surface_3 = Surface(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)  # disabled
reference_point = ReferencePoint(Point(176.542974, -1397.177065, 0))  # disabled
toolpath_stack_between_surfaces = ToolpathStackBetweenSurfaces(
    StackPatterns=stack_toolpath_pattern,
    LayerHeight=number_slider_3,
    TopSurface=surface_3,
    OrientOption=boolean_toggle,
    ReferencePoint=reference_point,
    PlaneRotateAngle=number_slider_4)  # -> ToolpathStack, ToolpathCurve, ToolpathFrames; disabled

# ----
# Stack Vertical (Offset)
number_slider_5 = Slider(20, range=0..100)  # disabled
number_slider_6 = Slider(80, range=0..100)  # disabled
number_slider_7 = Slider(5, range=0..10)  # disabled
boolean_toggle_2 = BooleanToggle(False)  # disabled
reference_point_2 = ReferencePoint(Point(176.542974, -1397.177065, 0))  # disabled
toolpath_stack_vertical = ToolpathStackVertical(
    StackPatterns=stack_toolpath_pattern,
    LayerHeight=number_slider_5,
    TotalHeight=number_slider_6,
    OrientOption=boolean_toggle_2,
    ReferencePoint=reference_point_2,
    PlaneRotateAngle=number_slider_7)  # -> ToolpathStack, ToolpathCurve, ToolpathPlanes; disabled
plane = Plane(toolpath_stack_vertical.ToolpathPlanes)  # disabled
unpack_toolpath_stack = UnpackToolpathStack(ToolpathStack=toolpath_stack_vertical.ToolpathStack)  # -> ToolpathCurve, ToolpathCurves, ToolpathFrames, SurfaceSeries, SpeedFactors; disabled
number_slider_8 = Slider(0, range=0..3)  # disabled
list_item = ListItem(List=unpack_toolpath_stack.ToolpathCurves, Index=number_slider_8, Wrap=True)  # disabled

unpack_toolpath_stack_2 = UnpackToolpathStack(ToolpathStack=toolpath_stack_between_surfaces.ToolpathStack)  # -> ToolpathCurve, ToolpathCurves, ToolpathFrames, SurfaceSeries, SpeedFactors; disabled
explode_tree_3 = ExplodeTree(Data=unpack_toolpath_stack_2.SpeedFactors)  # -> Branch0, Branch1, Branch2, Branch3; disabled

# ----
# Visualization
number_slider_9 = Slider(6, range=0..10)  # disabled
button = Button()  # disabled
panel_2 = Panel("0")  # disabled
fillet_toolpath_from_toolpathstack = FilletToolpathFromToolpathStack(
    ToolpathStack=toolpath_stack_between_surfaces.ToolpathStack,
    Radius=number_slider_9,
    Trigger=button,
    SeamLengthFactor=panel_2)  # -> Curve, ToolpathStack; disabled
toolpath_mesh = ToolpathMesh(ToolpathStack=fillet_toolpath_from_toolpathstack.ToolpathStack, Parameter=1)  # disabled
weaverbird_s_catmull_clark_subdivision = WeaverbirdsCatmullClarkSubdivision(MeshCurves=toolpath_mesh, Level=1, SmoothNakedEdges=1)  # disabled
custom_preview = CustomPreview(
    Geometry=weaverbird_s_catmull_clark_subdivision,
    Material={diffuse=RGB(221, 160, 221), emission=RGB(66, 48, 66), shine=0.5, specular=RGB(255, 255, 255), transparency=0})  # disabled

panel_3 = Panel(explode_tree_3.Branch0)  # disabled

# ----
# Visualization
number_slider_10 = Slider(6, range=0..10)  # disabled
button_2 = Button()  # disabled
panel_4 = Panel("0")  # disabled
fillet_toolpath_from_toolpathstack_2 = FilletToolpathFromToolpathStack(ToolpathStack=toolpath_stack_vertical.ToolpathStack, Radius=number_slider_10, Trigger=button_2, SeamLengthFactor=panel_4)  # -> Curve, ToolpathStack; disabled
toolpath_mesh_2 = ToolpathMesh(ToolpathStack=fillet_toolpath_from_toolpathstack_2.ToolpathStack, Parameter=1)  # disabled
weaverbird_s_catmull_clark_subdivision_2 = WeaverbirdsCatmullClarkSubdivision(MeshCurves=toolpath_mesh_2, Level=1, SmoothNakedEdges=1)  # disabled
custom_preview_2 = CustomPreview(
    Geometry=weaverbird_s_catmull_clark_subdivision_2,
    Material={diffuse=RGB(221, 160, 221), emission=RGB(66, 48, 66), shine=0.5, specular=RGB(255, 255, 255), transparency=0})  # disabled

# ----
# Output
panel_5 = Panel("0.25")  # disabled
to_kuka_movement = ToKukaMovement(ToolpathStack=toolpath_stack_vertical.ToolpathStack, VelMax=panel_5)  # -> ToolpathPlanes, SpeedFactors; disabled
linear_movement_kuka_prc = LINearMovementKUKAPrc(
    TargetAsPlane=to_kuka_movement.ToolpathPlanes,
    Speed=to_kuka_movement.SpeedFactors,
    extaxenabled=False,
    interpolation="C_DIS")  # disabled
