# Grasshopper definition 1_Component_walkthrough.gh (Grasshopper 1.0.8)
# plug-ins: MeshEdit Components, BarkBeetle, KUKA|prc - parametric robot control, Bifocals, Weaverbird

# ----
# Prepare a surface and a point tree as inputs
surface = Surface(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)
brep_edges = BrepEdges(Brep=surface)  # -> Naked, Interior, NonManifold
dispatch = Dispatch(List=brep_edges.Naked, DispatchPattern=[True, False])  # -> ListA, ListB
divide_curve = DivideCurve(Curve=dispatch.ListA, Count=Slider(5, range=0..20), Kinks=False)  # -> Points, Tangents, Parameters
divide_curve_2 = DivideCurve(Curve=dispatch.ListB, Count=Slider(4, range=0..10), Kinks=False)  # -> Points, Tangents, Parameters
explode_tree = ExplodeTree(Data=divide_curve.Points)  # -> Branch0, Branch1
explode_tree_2 = ExplodeTree(Data=divide_curve_2.Points)  # -> Branch0, Branch1
reverse_list = ReverseList(List=explode_tree_2.Branch1)
reverse_list_2 = ReverseList(List=explode_tree.Branch1)
geodesic = Geodesic(Surface=surface, Start=explode_tree_2.Branch0, End=reverse_list)
geodesic_2 = Geodesic(Surface=surface, Start=explode_tree.Branch0, End=reverse_list_2)
curve_intersection = CurveIntersection(CurvesA=graft(geodesic_2), CurvesB=geodesic, Tolerance=Slider(1, range=0..10))  # -> simplify(IntersectionPoints)

# ----
# Input a point tree and a surface
# Reference Option: Defines the geometry to align the network. Defaults to points.
# For alternate geometries like a scanned mesh, set this option to pull points to the new geometry.
number_slider = Slider(200, range=0..1000)
surface_2 = Surface(surface)
point = Point(curve_intersection)
barkbeetle_network = BarkBeetleNetwork(PointsTree=point, BaseSurface=surface_2, StripWidth=number_slider, ReferenceOption=0)  # -> UVNetwork, Points, UVCurves, ExtendedSurface

# ----
# 2-Skeleton
# Spiral shape skeleton
# Snake shape skeleton
# Gets edge skeleton,
# more explained in 2_Roof_Example
# Extracts everything in a skeleton
number_slider_2 = Slider(4, range=0..10)
spiral_skeleton_graph = SpiralSkeletonGraph(UVNetwork=barkbeetle_network.UVNetwork)  # -> SkeletonGraph, SkeletonPoints, MainCurve, BranchCurves, Vectors
snake_skeleton_graph = SnakeSkeletonGraph(UVNetwork=barkbeetle_network.UVNetwork)  # -> SkeletonGraph, SkeletonPoints, MainCurve, BranchCurves, Vectors
edge_skeleton_graph = EdgeSkeletonGraph(UVNetwork=barkbeetle_network.UVNetwork, EdgeOption=number_slider_2)  # -> SkeletonGraph, SkeletonPoints, MainCurve, Vectors
unpack_skeleton_graph = UnpackSkeletonGraph(SkeletonGraph=edge_skeleton_graph.SkeletonGraph)  # -> UVNetwork, SkeletonPoints, MainCurve, BranchCurves, Vectors

# ----
# More explained in 2_Roof_Example
stack_on_top = StackOnTop()  # -> NewToolpathStack, ToolpathCurve, ToolpathPlanes, MappedToolpathPattern

# ----
# Or input a point list with its sequence to construct a tree
integer = Integer([9, 12, 11, 19, 4, 2, 8, 17, 15, 5, 14, 7, 1, 13, 18, 16, 10, 0, 6, 3])
panel = Panel(integer)
point_2 = Point([Point(147.9999839, 3754.320815, 918.106494), Point(1302.225693, 3317.880772, 526.1340579), Point(147.9999999, 5009.91694, 691.1409188), Point(2338.756796, 4640.382189, 82.75167451), Point(-1006.225691, 3317.880771, 526.1340588), Point(-2112.468565, 4295.870238, 180.1023505)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])
organize_point_tree_from_list = OrganizePointTreeFromList(Points=point_2, Sequence=panel, PointsPerBranch=Slider(4, range=0..10))

# ----
# 1-Network
# Brep Strip works with either only UV Network
# or given curves and reference surface.
# Reference Option: Defines the geometry to align the network. Defaults to points.
# For alternate geometries like a scanned mesh, set this option to pull points to the new geometry.
# 0: points; 1: surface; 2: mesh
mesh = Mesh(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)
brep_strip = BrepStrip(UVNetwork=barkbeetle_network.UVNetwork, StripExtension=Slider(69, range=0..100))

barkbeetle_network_2 = BarkBeetleNetwork(
    PointsTree=organize_point_tree_from_list,
    Mesh=mesh,
    StripWidth=Slider(200, range=0..1000),
    ReferenceOption=Slider(2, range=0..10))  # -> UVNetwork, Points, UVCurves, ExtendedSurface

brep_strip_2 = BrepStrip(
    StripExtension=Slider(69, range=0..100),
    Curves=barkbeetle_network_2.UVCurves,
    Surface=barkbeetle_network_2.ExtendedSurface,
    StripWidth=Slider(200, range=0..1000))

# ----
# 6-Display & Analysis: Curvature and Twisting
# A little movement to avoid overlap
explode_tree_3 = ExplodeTree(Data=brep_strip_2)  # -> Branch0, Branch1
move = Move(Geometry=explode_tree_3.Branch0, Motion=Vector(0, 0, 10))  # -> Geometry, Transform

# ----
# 7_Utils: Unroll
# Problem: the curve label may not be
# on the strips if if some are curved
# (solvable)
number_slider_3 = Slider(20, range=0..100)
unroll_intersect_surface_strip = UnrollIntersectSurfaceStrip(
    Surfaces=flatten(brep_strip),
    CenterCurves=flatten(barkbeetle_network.UVCurves),
    Tolerance=0.1,
    Distance=number_slider_3,
    HoleRadius=number_slider_3,
    FontSize=number_slider_3)  # -> StripsBoundaries, Points, Holes, Labels, OriginalLabels; disabled

# ----
# For curvature, only surfaces are needed.
# Can also select which curvature to analyze (Type),
# and the output unit.
surface_curvature = SurfaceCurvature(Surfaces=flatten([explode_tree_3.Branch1, move.Geometry]), Density=1, Type=0, OutputUnit=0)  # -> Meshes, LegendColors, LegendTags
legend = Legend(Colour=surface_curvature.LegendColors, Tags=surface_curvature.LegendTags, LegendType=1)

# ----
# For twisting, both surfaces and the center curves are needed
surface_twist_angle_per_length = SurfaceTwistAnglePerLength(
    Surfaces=flatten([move.Geometry, explode_tree_3.Branch1]),
    Curves=flatten(barkbeetle_network_2.UVCurves),
    Density=1,
    OutputUnit=0)  # -> Meshes, LegendColors, LegendTags
legend_2 = Legend(Colour=surface_twist_angle_per_length.LegendColors, Tags=surface_twist_angle_per_length.LegendTags, LegendType=1)

# ----
# 3-Pattern
# Note: These two patterns may not work
# when the skeleton is very simple /
# with some strip and path width.
# Why this happens requires further debugging.
# Extracts everything in a pattern
number_slider_4 = Slider(5, range=0..10)
number_slider_5 = Slider(28, range=0..100)

# ----
# Seam point: where the seam point of
# the toolpath is located.
# Also indicate the point of print start.
# The toolpath around this area may be a bit messy,
# but not sure how this influence printing results.
# Use this slider to check print sequence
point_3 = Point(Point(656.4206051, -131.0000008, 924.6649411))

spiral_toolpath_pattern = SpiralToolpathPattern(SkeletonGraph=spiral_skeleton_graph.SkeletonGraph, SeamPoint=point_3, PathWidth=Slider(60, range=0..100))  # -> ToolpathPattern, PatternCurve

snake_infill_pattern = SnakeInfillPattern(SkeletonGraph=spiral_skeleton_graph.SkeletonGraph, SeamPoint=point_3, PathWidth=number_slider_5, Spacing=number_slider_4)  # -> ToolpathPattern, PatternCurve
zigzag_infill_pattern = ZigZagInfillPattern(SkeletonGraph=spiral_skeleton_graph.SkeletonGraph, SeamPoint=point_3, PathWidth=number_slider_5, Spacing=number_slider_4)  # -> ToolpathPattern, PatternCurve
unpack_toolpath_pattern = UnpackToolpathPattern(ToolpathPattern=zigzag_infill_pattern.ToolpathPattern)  # -> SkeletonGraph, Curve, BundleCurves, Points

shatter = Shatter(Curve=reparameterize(spiral_toolpath_pattern.PatternCurve), Parameters=Slider(0.126, range=0..1))
list_item = ListItem(List=shatter, Index=0, Wrap=True)

# ----
# Avoid obstacles /  shear blocks
# Location of the obstacles.
# Here just pick some points on the skeleton main curve
# Shape of the obstacle,
# can be any closed curve
xy_plane = XYPlane(Origin=Point(0, 0, 0))
divide_curve_3 = DivideCurve(Curve=spiral_skeleton_graph.MainCurve, Count="20", Kinks=False)  # -> Points, Tangents, Parameters
rectangle = Rectangle(Plane=xy_plane, XSize=Domain(-40, 40), YSize=Domain(-20, 20), Radius=0)  # -> Rectangle, Length
pattern_avoid_obstacles = PatternAvoidObstacles(
    ToolpathPattern=snake_infill_pattern.ToolpathPattern,
    ObstacleLocationPoints=divide_curve_3.Points,
    ObstacleCurve=rectangle.Rectangle,
    ReferencePlane=xy_plane)  # -> OutputToolpathPattern, Curve, ObstacleBoundaries, TrimCurves, IntersectionPoints

explode = Explode(Curve=pattern_avoid_obstacles.Curve, Recursive=True)  # -> Segments, Vertices

# ----
# Organize the patterns before stacking.
# For now, this is a MUST
# (even with one single middle pattern)
panel_2 = Panel("1")
organize_toolpath_pattern_s = OrganizeToolpathPatternS(TopCount=0, MiddlePatternS=spiral_toolpath_pattern.ToolpathPattern, BottomCount=0)
organize_toolpath_pattern_s_2 = OrganizeToolpathPatternS(
    TopCount=0,
    MiddlePatternS=snake_infill_pattern.ToolpathPattern,
    BottomPattern=pattern_avoid_obstacles.OutputToolpathPattern,
    BottomCount=panel_2)

# ----
# 4-Stack
number_slider_6 = Slider(20, range=0..100)
number_slider_7 = Slider(40, range=0..100)
toolpath_stack_vertical = ToolpathStackVertical(
    OrganizedStackPatterns=organize_toolpath_pattern_s_2,
    LayerHeight=number_slider_6,
    TotalHeight=number_slider_7,
    OrientOption=False,
    PlaneRotateAngle=0)  # -> ToolpathStack, ToolpathCurve, ToolpathPlanes

# ----
# Reference Geometry: The result planes will re-orient if a
# Reference Geometry is provided (e.g., robot model).
# However, it now only allows curve (not line),
# surface, brep, and mesh inputs.
# Orient Option: default False, which means
# the normal direction of the planes are
# same as the normal direction of the surface.
# Plane Rotate Angle: The planes can rotate
# towaords the Reference Geometry if a value is given
curve = Curve(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)
toolpath_stack_offset = ToolpathStackOffset(
    OrganizedStackPatterns=organize_toolpath_pattern_s_2,
    LayerHeight=number_slider_6,
    TotalHeight=number_slider_7,
    ReferenceGeometry=curve,
    OrientOption=False,
    PlaneRotateAngle=0)  # -> ToolpathStack, ToolpathCurve, ToolpathPlanes

# ----
# More explained in 3_Slab_Example
toolpath_stack_between_surfaces = ToolpathStackBetweenSurfaces(OrganizedStackPatterns=organize_toolpath_pattern_s_2, OrientOption=False, PlaneRotateAngle=0)  # -> ToolpathStack, ToolpathCurve, ToolpathPlanes

# ----
# 6-Display & Analysis: Overhang
# This one is extremely slow (may take minutes)
# when there are a lot of turns in the toolpath.
# May use a simple toolpath just for analyzing.
# Process with care.
# Results are in radius.
toolpath_stack_offset_2 = ToolpathStackOffset(
    OrganizedStackPatterns=organize_toolpath_pattern_s,
    LayerHeight=number_slider_6,
    TotalHeight=number_slider_7,
    ReferenceGeometry=curve,
    OrientOption=False,
    PlaneRotateAngle=0)  # -> ToolpathStack, ToolpathCurve, ToolpathPlanes
evaluate_overhang = EvaluateOverhang(ToolpathStack=toolpath_stack_offset_2.ToolpathStack, DisplayThickness=Slider(10, range=0..10))  # -> LegendColors, LegendTags, Curves
legend_3 = Legend(Colour=evaluate_overhang.LegendColors, Tags=evaluate_overhang.LegendTags, LegendType=1)

# ----
# Extracts everything in a stack
unpack_toolpath_stack = UnpackToolpathStack(ToolpathStack=toolpath_stack_offset.ToolpathStack)  # -> ToolpathCurve, ToolpathCurves, ToolpathFrames, SurfaceSeries, SpeedFactors

# ----
# Click the button to trigger.
# Takes some time to run
number_slider_8 = Slider(1, range=0..10)
fillet_toolpath_stack = FilletToolpathStack(ToolpathStack=toolpath_stack_offset.ToolpathStack, Radius=number_slider_8, Trigger=Button(), SeamLengthFactor=10)  # -> Curve, ToolpathStack

# ----
# 5-Output
# Then operate as in Kuka
# Note: the output speed unit is the same as
# the max speed and min speed we input
panel_3 = Panel("5.5")
to_kuka_movement = ToKukaMovement(ToolpathStack=toolpath_stack_offset.ToolpathStack, MinSpeed="2.5", MaxSpeed=panel_3, Rounding=2)  # -> ToolpathPlanes, RobotSpeed
linear_movement_kuka_prc = LINearMovementKUKAPrc(
    TargetAsPlane=to_kuka_movement.ToolpathPlanes,
    Speed=to_kuka_movement.RobotSpeed,
    extaxenabled=False,
    interpolation="C_DIS")

# ----
# Problems:
# 1. The meshing process and weaver bird makes the mesh smaller than expected
# 2. The mesh may crush when the toolpath is complex
# 3. It is generating straight pipes to reduce calculation,
# but long paths may be turned straight
# 6-Display & Analysis: Mesh Display
# Use this slider to animate the printing process
number_slider_9 = Slider(0.555, range=0..1)
toolpath_mesh = ToolpathMesh(ToolpathStack=fillet_toolpath_stack.ToolpathStack, Parameter=number_slider_9)
mesh_weldvertices = MeshWeldVertices(Mesh=toolpath_mesh, Tolerance=0.01)  # -> RuntimeMessage, Mesh
weaverbird_s_catmull_clark_subdivision = WeaverbirdsCatmullClarkSubdivision(MeshCurves=mesh_weldvertices.Mesh, Level=1, SmoothNakedEdges=1)
custom_preview = CustomPreview(Geometry=weaverbird_s_catmull_clark_subdivision, Material=ColourSwatch(SwatchColor=RGB(156, 156, 156)))  # disabled
