# Grasshopper definition 2_Roof_Example.gh (Grasshopper 1.0.7)
# plug-ins: BarkBeetle, Bifocals, KUKA|prc - parametric robot control, Pufferfish, Human

# ----
# Prepare a surface and a point tree as inputs
surface = Surface(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)
brep_edges = BrepEdges(Brep=surface)  # -> Naked, Interior, NonManifold
# Edge Beam: Surrounding
number_slider = Slider(8, range=0..20)
dispatch = Dispatch(List=brep_edges.Naked, DispatchPattern=[True, False])  # -> ListA, ListB
divide_curve = DivideCurve(Curve=dispatch.ListA, Count=number_slider, Kinks=False)  # -> Points, Tangents, Parameters
divide_curve_2 = DivideCurve(Curve=dispatch.ListB, Count=Slider(4, range=0..10), Kinks=False)  # -> Points, Tangents, Parameters
explode_tree = ExplodeTree(Data=divide_curve.Points)  # -> Branch0, Branch1
explode_tree_2 = ExplodeTree(Data=divide_curve_2.Points)  # -> Branch0, Branch1
reverse_list = ReverseList(List=explode_tree_2.Branch1)
reverse_list_2 = ReverseList(List=explode_tree.Branch1)
geodesic = Geodesic(Surface=surface, Start=explode_tree_2.Branch0, End=reverse_list)
geodesic_2 = Geodesic(Surface=surface, Start=explode_tree.Branch0, End=reverse_list_2)
curve_intersection = CurveIntersection(CurvesA=graft(geodesic_2), CurvesB=geodesic, Tolerance=Slider(1, range=0..10))  # -> simplify(IntersectionPoints)

# ----
# Prepare a surface and a point tree as inputs
surface_2 = Surface(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)
brep_edges_2 = BrepEdges(Brep=surface_2)  # -> Naked, Interior, NonManifold
# Edge Beam: On Sides
number_slider_2 = Slider(8, range=0..20)
dispatch_2 = Dispatch(List=brep_edges_2.Naked, DispatchPattern=[True, False])  # -> ListA, ListB
divide_curve_3 = DivideCurve(Curve=dispatch_2.ListA, Count=number_slider_2, Kinks=False)  # -> Points, Tangents, Parameters
divide_curve_4 = DivideCurve(Curve=dispatch_2.ListB, Count=Slider(4, range=0..10), Kinks=False)  # -> Points, Tangents, Parameters
explode_tree_3 = ExplodeTree(Data=divide_curve_3.Points)  # -> Branch0, Branch1
explode_tree_4 = ExplodeTree(Data=divide_curve_4.Points)  # -> Branch0, Branch1
reverse_list_3 = ReverseList(List=explode_tree_4.Branch1)
reverse_list_4 = ReverseList(List=explode_tree_3.Branch1)
geodesic_3 = Geodesic(Surface=surface_2, Start=explode_tree_4.Branch0, End=reverse_list_3)
geodesic_4 = Geodesic(Surface=surface_2, Start=explode_tree_3.Branch0, End=reverse_list_4)
curve_intersection_2 = CurveIntersection(CurvesA=graft(geodesic_4), CurvesB=geodesic_3, Tolerance=Slider(1, range=0..10))  # -> simplify(IntersectionPoints)

# ----
# Input a point tree and a surface
# Reference Option: Defines the geometry to align the network. Defaults to points.
# For alternate geometries like a scanned mesh, set this option to pull points to the new geometry.
number_slider_3 = Slider(200, range=0..1000)
surface_3 = Surface(surface)
point = Point(curve_intersection)
barkbeetle_network = BarkBeetleNetwork(PointsTree=point, BaseSurface=surface_3, StripWidth=number_slider_3, ReferenceOption=0)  # -> UVNetwork, Points, UVCurves, ExtendedSurface

# ----
# 1-Network
number_slider_4 = Slider(69, range=0..100)
brep_strip = BrepStrip(UVNetwork=barkbeetle_network.UVNetwork, StripExtension=number_slider_4)

# ----
# Input a point tree and a surface
# Reference Option: Defines the geometry to align the network. Defaults to points.
# For alternate geometries like a scanned mesh, set this option to pull points to the new geometry.
number_slider_5 = Slider(200, range=0..1000)
surface_4 = Surface(surface_2)
point_2 = Point(curve_intersection_2)
barkbeetle_network_2 = BarkBeetleNetwork(PointsTree=point_2, BaseSurface=surface_4, StripWidth=number_slider_5, ReferenceOption=0)  # -> UVNetwork, Points, UVCurves, ExtendedSurface

# ----
# 1-Network
number_slider_6 = Slider(69, range=0..100)
brep_strip_2 = BrepStrip(UVNetwork=barkbeetle_network_2.UVNetwork, StripExtension=number_slider_6)

edges = BrepEdges(Brep=brep_strip)  # -> Naked, Interior, NonManifold; disabled
previewlw = CustomPreviewLineweights(
    Geometry=edges.Naked,
    Shader={diffuse=RGB(255, 105, 180), emission=RGB(76, 32, 54), shine=0.5, specular=RGB(255, 255, 255), transparency=0},
    Absolute=False)  # disabled

# ----
# 2-Skeleton
# Spiral shape skeleton
# Snake shape skeleton
spiral_skeleton_graph = SpiralSkeletonGraph(UVNetwork=barkbeetle_network.UVNetwork)  # -> SkeletonGraph, SkeletonPoints, MainCurve, BranchCurves, Vectors
snake_skeleton_graph = SnakeSkeletonGraph(UVNetwork=barkbeetle_network.UVNetwork)  # -> SkeletonGraph, SkeletonPoints, MainCurve, BranchCurves, Vectors

# ----
# 2-Skeleton
# Spiral shape skeleton
# Snake shape skeleton
spiral_skeleton_graph_2 = SpiralSkeletonGraph(UVNetwork=barkbeetle_network_2.UVNetwork)  # -> SkeletonGraph, SkeletonPoints, MainCurve, BranchCurves, Vectors
snake_skeleton_graph_2 = SnakeSkeletonGraph(UVNetwork=barkbeetle_network_2.UVNetwork)  # -> SkeletonGraph, SkeletonPoints, MainCurve, BranchCurves, Vectors

explode = Explode(Curve=spiral_skeleton_graph.MainCurve, Recursive=True)  # -> Segments, Vertices

# ----
# 4-Stack
number_slider_7 = Slider(30, range=0..100)

# ----
# 4-Stack
# All three stacks together generates
# a roof with edge beams
number_slider_8 = Slider(40, range=0..100)

# ----
# Edge Beam: Surrounding
number_slider_9 = Slider(0, range=0..10)
edge_skeleton_graph = EdgeSkeletonGraph(UVNetwork=barkbeetle_network.UVNetwork, EdgeOption=number_slider_9)  # -> SkeletonGraph, SkeletonPoints, MainCurve, Vectors
midpt = CurveMiddle(Curve=edge_skeleton_graph.MainCurve)

# ----
# 3-Pattern
path_width = Slider(28, range=0..100)

# ----
# changing patterns in different layers
point_3 = Point(midpt)
spiral_toolpath_pattern = SpiralToolpathPattern(SkeletonGraph=spiral_skeleton_graph.SkeletonGraph, SeamPoint=point_3, PathWidth=path_width)  # -> ToolpathPattern, PatternCurve
spiral_toolpath_pattern_2 = SpiralToolpathPattern(SkeletonGraph=snake_skeleton_graph.SkeletonGraph, SeamPoint=point_3, PathWidth=path_width)  # -> ToolpathPattern, PatternCurve

spiral_toolpath_pattern_3 = SpiralToolpathPattern(SkeletonGraph=edge_skeleton_graph.SkeletonGraph, SeamPoint=midpt, PathWidth=path_width)  # -> ToolpathPattern, PatternCurve

snake_infill_pattern = SnakeInfillPattern(
    SkeletonGraph=spiral_skeleton_graph.SkeletonGraph,
    SeamPoint=point_3,
    PathWidth=path_width,
    Spacing=Slider(50, range=0..100))  # -> ToolpathPattern, PatternCurve

# ----
# Avoid obstacles /  shear blocks
# Location of the obstacles.
# Here just pick some points on the skeleton main curve
# Shape of the obstacle,
# can be any closed curve
xy_plane = XYPlane(Origin=Point(0, 0, 0))
midpt_2 = CurveMiddle(Curve=explode.Segments)
rectangle = Rectangle(Plane=xy_plane, XSize=Domain(-50, 50), YSize=Domain(-20, 20), Radius=0)  # -> Rectangle, Length
pattern_avoid_obstacles = PatternAvoidObstacles(
    ToolpathPattern=snake_infill_pattern.ToolpathPattern,
    ObstacleLocationPoints=midpt_2,
    ObstacleCurve=rectangle.Rectangle,
    ReferencePlane=xy_plane)  # -> OutputToolpathPattern, Curve, ObstacleBoundaries, TrimCurves, IntersectionPoints

crv = Curve(pattern_avoid_obstacles.ObstacleBoundaries)
boundary = BoundarySurfaces(Edges=crv)
crv_2 = Curve(pattern_avoid_obstacles.Curve)

# ----
# Organize the patterns before stacking.
# For now, this is a MUST
# (even with one single middle pattern)
panel = Panel("2")
organize_toolpath_pattern_s = OrganizeToolpathPatternS(
    TopPattern=spiral_toolpath_pattern_3.ToolpathPattern,
    TopCount=panel,
    MiddlePatternS=[spiral_toolpath_pattern.ToolpathPattern, spiral_toolpath_pattern_2.ToolpathPattern],
    BottomPattern=pattern_avoid_obstacles.OutputToolpathPattern,
    BottomCount="1")

offsrf = OffsetSurface(Surface=boundary, Distance=Slider(20, range=0..100), BothSides=0, CreateSolid=True)  # -> flatten(Offset)
group = Group(Objects=offsrf)

# ----
# Reference Geometry: The result planes will re-orient if a
# Reference Geometry is provided (e.g., robot model).
# However, it now only allows curve (not line),
# surface, brep, and mesh inputs.
# Orient Option: default False, which means
# the normal direction of the planes are
# same as the normal direction of the surface.
# Plane Rotate Angle: The planes can rotate
# towaords the Reference Geometry if a value is given
curve = Curve(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)
toolpath_stack_offset = ToolpathStackOffset(
    OrganizedStackPatterns=organize_toolpath_pattern_s,
    LayerHeight=number_slider_7,
    TotalHeight=Slider(200, range=0..1000),
    ReferenceGeometry=curve,
    OrientOption=False,
    PlaneRotateAngle=0)  # -> ToolpathStack, ToolpathCurve, ToolpathPlanes

number_slider_10 = Slider(0.8302, range=0..1)
to_kuka = ToKukaMovement(ToolpathStack=toolpath_stack_offset.ToolpathStack, MinSpeed=0, MaxSpeed=1, Rounding=2)  # -> ToolpathPlanes, RobotSpeed
range = Range(Domain=Domain(0, 1), Steps=Slider(31, range=0..100))
crv_3 = Curve(<curve referenced from the Rhino model>)
number_slider_11 = Slider(20, range=0..100)
pt = Point(Point(53.60824881, -30.94192026, 0))
parampipemsh = ParameterPipeMesh(
    Curve=crv_3,
    Radius=Slider(28, range=0..100),
    ParametersU=range,
    ParametersV=[0, 0.25, 0.5, 0.75, 1],
    Weighted=False,
    Lengths=False,
    Angle=0,
    Rotation=0,
    EndType=0,
    Triangulate=False)
mesh = Mesh(<mesh referenced from the Rhino model>)
orient_pln = OrientPlaneKUKAPrc(Plane=to_kuka.ToolpathPlanes, OrientPoint=pt)
lng = ListLength(List=to_kuka.ToolpathPlanes)
quantec_kr210_r3300k_ultra_robot = QuantecKR210R3300KUltraRobot(infiniterot=False)
mjoin = MeshJoin(Meshes=[parampipemsh, mesh])
multiplication = Multiplication(A=number_slider_10, B=lng)
lin_move = LINearMovementKUKAPrc(TargetAsPlane=orient_pln, extaxenabled=False, interpolation="C_DIS")
geo = Geometry(mjoin)  # disabled
kl1500_3_linear_axis_kuka_prc = KL15003LinearAxisKUKAPrc(
    KUKAPrcRobotInput=quantec_kr210_r3300k_ultra_robot,
    PositiveLength=4000,
    NegativeLength=-500,
    PositiveDirection=Vector(1, 0, 0),
    RobotBase=PlaneXY(0, 0, 507))
item = ListItem(List=lin_move, Index=multiplication, Wrap=True)
custom_tool = CustomToolForKUKAPrc(
    CustomToolGeometry=geo,
    isExternal=False,
    toolid=11,
    toolvala=0,
    toolvalb=-90,
    toolvalc=0,
    toolvalx=379.91,
    toolvaly=-2.19,
    toolvalz=520.1,
    valuesset=True)
axis_move = AXISMovementKUKAPrc(
    Axis1=Slider(27, range=0..180),
    Axis2=Slider(-57, range=-120..60),
    Axis3=Slider(124, range=-25..155),
    Axis4=Slider(80, range=-350..350),
    Axis5=Slider(-44, range=-120..120),
    Axis6=Slider(25, range=-350..350),
    extaxenabled=False,
    interpolation="C_PTP")
kuka_prc_core = KUKAPrcCORE(
    SimulationSlider=Slider(0.5, range=0..1),
    KUKAPrcCommands=item,
    Tool=custom_tool,
    Robot=kl1500_3_linear_axis_kuka_prc,
    PRC_BaseExpose=False,
    PRC_SaveNameExpose=False,
    PRCsettings="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")  # -> RobotGeometry, AnalysisOutput
panel_2 = Panel(axis_move)

# ----
# 3-Pattern
path_width_2 = Slider(28, range=0..100)

# ----
# changing patterns in different layers
end_points = EndPoints(Curve=spiral_skeleton_graph_2.MainCurve)  # -> Start, End
point_4 = Point(end_points.End)
spiral_toolpath_pattern_4 = SpiralToolpathPattern(SkeletonGraph=spiral_skeleton_graph_2.SkeletonGraph, SeamPoint=point_4, PathWidth=path_width_2)  # -> ToolpathPattern, PatternCurve
spiral_toolpath_pattern_5 = SpiralToolpathPattern(SkeletonGraph=snake_skeleton_graph_2.SkeletonGraph, SeamPoint=point_4, PathWidth=path_width_2)  # -> ToolpathPattern, PatternCurve

# ----
# Edge Beam: Separated
number_slider_12 = Slider(3, range=0..10)
edge_skeleton_graph_2 = EdgeSkeletonGraph(UVNetwork=barkbeetle_network_2.UVNetwork, EdgeOption=number_slider_12)  # -> SkeletonGraph, SkeletonPoints, MainCurve, Vectors
edge_skeleton_graph_3 = EdgeSkeletonGraph(UVNetwork=barkbeetle_network_2.UVNetwork, EdgeOption=Slider(1, range=0..10))  # -> SkeletonGraph, SkeletonPoints, MainCurve, Vectors
end_points_2 = EndPoints(Curve=edge_skeleton_graph_2.MainCurve)  # -> Start, End
end_points_3 = EndPoints(Curve=edge_skeleton_graph_3.MainCurve)  # -> Start, End
spiral_toolpath_pattern_6 = SpiralToolpathPattern(SkeletonGraph=edge_skeleton_graph_3.SkeletonGraph, SeamPoint=end_points_3.End, PathWidth=path_width_2)  # -> ToolpathPattern, PatternCurve
spiral_toolpath_pattern_7 = SpiralToolpathPattern(SkeletonGraph=edge_skeleton_graph_2.SkeletonGraph, SeamPoint=end_points_2.End, PathWidth=path_width_2)  # -> ToolpathPattern, PatternCurve

snake_infill_pattern_2 = SnakeInfillPattern(SkeletonGraph=spiral_skeleton_graph_2.SkeletonGraph, SeamPoint=point_4, PathWidth=path_width_2, Spacing=0)  # -> ToolpathPattern, PatternCurve

# ----
# Avoid obstacles /  shear blocks
# Location of the obstacles.
# Here just pick some points on the skeleton main curve
# Shape of the obstacle,
# can be any closed curve
xy_plane_2 = XYPlane(Origin=Point(0, 0, 0))
divide_curve_5 = DivideCurve(Curve=spiral_skeleton_graph_2.MainCurve, Count="20", Kinks=False)  # -> Points, Tangents, Parameters
rectangle_2 = Rectangle(Plane=xy_plane_2, XSize=Domain(-40, 40), YSize=Domain(-20, 20), Radius=0)  # -> Rectangle, Length
pattern_avoid_obstacles_2 = PatternAvoidObstacles(
    ToolpathPattern=snake_infill_pattern_2.ToolpathPattern,
    ObstacleLocationPoints=divide_curve_5.Points,
    ObstacleCurve=rectangle_2.Rectangle,
    ReferencePlane=xy_plane_2)  # -> OutputToolpathPattern, Curve, ObstacleBoundaries, TrimCurves, IntersectionPoints

# ----
# Organize the patterns before stacking.
# For now, this is a MUST
# (even with one single middle pattern)
panel_3 = Panel("1")
organize_toolpath_pattern_s_2 = OrganizeToolpathPatternS(
    TopCount=0,
    MiddlePatternS=[spiral_toolpath_pattern_4.ToolpathPattern, spiral_toolpath_pattern_5.ToolpathPattern],
    BottomPattern=pattern_avoid_obstacles_2.OutputToolpathPattern,
    BottomCount=panel_3)

curve_2 = Curve(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)
number_slider_13 = Slider(80, range=0..100)
toolpath_stack_offset_2 = ToolpathStackOffset(
    OrganizedStackPatterns=organize_toolpath_pattern_s_2,
    LayerHeight=number_slider_8,
    TotalHeight=Slider(120, range=0..1000),
    ReferenceGeometry=curve_2,
    OrientOption=False,
    PlaneRotateAngle=0)  # -> ToolpathStack, ToolpathCurve, ToolpathPlanes
stack_on_top = StackOnTop(
    ToolpathStack=toolpath_stack_offset_2.ToolpathStack,
    ToolpathPattern=spiral_toolpath_pattern_7.ToolpathPattern,
    LayerHeight=number_slider_8,
    TotalHeight=number_slider_13)  # -> NewToolpathStack, ToolpathCurve, ToolpathPlanes, MappedToolpathPattern
stack_on_top_2 = StackOnTop(
    ToolpathStack=toolpath_stack_offset_2.ToolpathStack,
    ToolpathPattern=spiral_toolpath_pattern_6.ToolpathPattern,
    LayerHeight=number_slider_8,
    TotalHeight=number_slider_13)  # -> NewToolpathStack, ToolpathCurve, ToolpathPlanes, MappedToolpathPattern

# ----
# Visualization
# Visualization
colour_swatch = ColourSwatch(SwatchColor=RGB(204, 204, 204))
toolpath_mesh = ToolpathMesh(ToolpathStack=toolpath_stack_offset.ToolpathStack, Parameter=number_slider_10)  # disabled
colour_swatch_2 = ColourSwatch(SwatchColor=RGB(0, 0, 0))
toolpath_mesh_2 = ToolpathMesh(
    ToolpathStack=[toolpath_stack_offset_2.ToolpathStack, stack_on_top_2.NewToolpathStack, stack_on_top.NewToolpathStack],
    Parameter=1)
colour_swatch_3 = ColourSwatch(SwatchColor=RGB(0, 0, 0))
material = CreateMaterial(Diffuse=colour_swatch, Specular=colour_swatch_2, Emission=colour_swatch_2, Transparency=0, Shine=0)
material_2 = CreateMaterial(
    Diffuse=ColourSwatch(SwatchColor=RGB(204, 204, 204)),
    Specular=colour_swatch_3,
    Emission=colour_swatch_3,
    Transparency=0,
    Shine=0)
custom_preview = CustomPreview(Geometry=toolpath_mesh_2, Material=material_2)
custom_preview_2 = CustomPreview(Geometry=toolpath_mesh, Material=material)  # disabled
