# Grasshopper definition 4_multilayer_short_strip_setup2.gh (Grasshopper 1.0.7)
# plug-ins: BarkBeetle, Kangaroo2 Components, Pufferfish

base_surface = Surface(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)
number_slider = Slider(100, range=0..100)
crv = Curve(Tree({0}: [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], {1}: [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]))
crv_2 = Curve(Tree({0}: [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], {1}: [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]))
ext = ExtendCurve(Curve=crv, Type=0, Start=number_slider, End=number_slider)
bang = ExplodeTree(Data=ext)  # -> Branch0, Branch1
curve_intersect = CurveIntersection(CurvesA=graft(bang.Branch0), CurvesB=bang.Branch1, Tolerance=0.01)  # -> simplify(IntersectionPoints)
crv_cp = CurveClosestPoint(Point=curve_intersect, Curve=graft(bang.Branch0))  # -> Point, Parameter, Distance
flip = FlipMatrix(Data=curve_intersect)

seam = Slider(0.02, range=0..0.1)
thickness = Slider(40, range=0..100)
layercount = Slider(1, range=0..10)

shift = ShiftList(List=crv_cp.Parameter, Shift=1, Wrap=False)
shift_2 = ShiftList(List=crv_cp.Parameter, Shift=-1, Wrap=False)
subtraction = Subtraction(A=shift, B=shift_2)
subtraction_2 = Subtraction(A="0.5", B=seam)
addition = Addition(A="0.5", B=seam)
multiplication = Multiplication(A=subtraction, B=subtraction_2)
multiplication_2 = Multiplication(A=subtraction, B=addition)
addition_2 = Addition(A=shift_2, B=multiplication_2)
addition_3 = Addition(A=shift_2, B=multiplication)
dispatch = Dispatch(List=addition_3, DispatchPattern=[True, False])  # -> ListA, ListB
dispatch_2 = Dispatch(List=addition_2, DispatchPattern=[True, False])  # -> ListA, ListB
cull_i = CullIndex(List=dispatch_2.ListA, Indices="0", Wrap=True)
cull_i_2 = CullIndex(List=dispatch.ListA, Indices="0", Wrap=True)
cull_i_3 = CullIndex(List=dispatch_2.ListB, Indices="-1", Wrap=True)
cull_i_4 = CullIndex(List=dispatch.ListB, Indices="-1", Wrap=True)
shatter = Shatter(Curve=graft(bang.Branch0), Parameters=[cull_i_4, cull_i_3])
shatter_2 = Shatter(Curve=graft(bang.Branch0), Parameters=[cull_i_2, cull_i])
dispatch_3 = Dispatch(List=shatter_2, DispatchPattern=[True, False])  # -> simplify(ListA), ListB
dispatch_4 = Dispatch(List=shatter, DispatchPattern=[True, False])  # -> simplify(ListA), ListB
crv_3 = Curve(flatten(dispatch_4.ListA))
crv_4 = Curve(flatten(dispatch_3.ListA))

crv_cp_2 = CurveClosestPoint(Point=flip, Curve=graft(bang.Branch1))  # -> Point, Parameter, Distance
srf = Surface(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)

shift_3 = ShiftList(List=crv_cp_2.Parameter, Shift="1", Wrap=False)
shift_4 = ShiftList(List=crv_cp_2.Parameter, Shift="-1", Wrap=False)
subtraction_3 = Subtraction(A=shift_3, B=shift_4)
subtraction_4 = Subtraction(A="0.5", B=seam)
addition_4 = Addition(A="0.5", B=seam)
multiplication_3 = Multiplication(A=subtraction_3, B=subtraction_4)
multiplication_4 = Multiplication(A=subtraction_3, B=addition_4)
addition_5 = Addition(A=shift_4, B=multiplication_3)
addition_6 = Addition(A=shift_4, B=multiplication_4)
dispatch_5 = Dispatch(List=addition_5, DispatchPattern=[True, False])  # -> ListA, ListB
dispatch_6 = Dispatch(List=addition_6, DispatchPattern=[True, False])  # -> ListA, ListB
cull_i_5 = CullIndex(List=dispatch_6.ListB, Indices="1", Wrap=True)
cull_i_6 = CullIndex(List=dispatch_5.ListB, Indices="1", Wrap=True)
cull_i_7 = CullIndex(List=dispatch_5.ListA, Indices="-2", Wrap=True)
cull_i_8 = CullIndex(List=dispatch_6.ListA, Indices="-2", Wrap=True)
shatter_3 = Shatter(Curve=graft(bang.Branch1), Parameters=[cull_i_6, cull_i_5])
shatter_4 = Shatter(Curve=graft(bang.Branch1), Parameters=[cull_i_7, cull_i_8])
dispatch_7 = Dispatch(List=shatter_4, DispatchPattern=[True, False])  # -> simplify(ListA), ListB
dispatch_8 = Dispatch(List=shatter_3, DispatchPattern=[True, False])  # -> simplify(ListA), ListB
crv_5 = Curve(flatten(dispatch_8.ListA))
crv_6 = Curve(flatten(dispatch_7.ListA))

shatter_5 = Shatter(Curve=graft(bang.Branch0), Parameters=crv_cp.Parameter)
panel = Panel("""0
-1""")
panel_2 = Panel("""0.25
0.75""")
cull_i_9 = CullIndex(List=shatter_5, Indices=panel, Wrap=True)
eval = EvaluateCurve(Curve=reparameterize(graft(cull_i_9)), Parameter=panel_2)  # -> Point, Tangent, Angle
number_slider_2 = Slider(1, range=0..10)
merge = Merge(Data1=flatten(eval.Point), Data2=flatten(curve_intersect))
crv_cp_3 = CurveClosestPoint(Point=merge, Curve=graft(crv_3))  # -> Point, Parameter, Distance
crv_cp_4 = CurveClosestPoint(Point=merge, Curve=graft(crv_4))  # -> Point, Parameter, Distance
smaller = SmallerThan(FirstNumber=crv_cp_3.Distance, SecondNumber=number_slider_2)  # -> SmallerThan, OrEqualTo
smaller_2 = SmallerThan(FirstNumber=crv_cp_4.Distance, SecondNumber=number_slider_2)  # -> SmallerThan, OrEqualTo
dispatch_9 = Dispatch(List=merge, DispatchPattern=smaller.SmallerThan)  # -> ListA, ListB
dispatch_10 = Dispatch(List=merge, DispatchPattern=smaller_2.SmallerThan)  # -> ListA, ListB
pt = Point(simplify(dispatch_9.ListA))
pt_2 = Point(simplify(dispatch_10.ListA))

srf_2 = Surface(srf)

shatter_6 = Shatter(Curve=graft(bang.Branch1), Parameters=crv_cp_2.Parameter)
panel_3 = Panel("""0
-1""")
panel_4 = Panel("""0.25
0.75""")
cull_i_10 = CullIndex(List=shatter_6, Indices=panel_3, Wrap=True)
eval_2 = EvaluateCurve(Curve=reparameterize(graft(cull_i_10)), Parameter=panel_4)  # -> Point, Tangent, Angle
number_slider_3 = Slider(1, range=0..10)
merge_2 = Merge(Data1=flatten(eval_2.Point), Data2=flatten(curve_intersect))
crv_cp_5 = CurveClosestPoint(Point=merge_2, Curve=graft(crv_5))  # -> Point, Parameter, Distance
crv_cp_6 = CurveClosestPoint(Point=merge_2, Curve=graft(crv_6))  # -> Point, Parameter, Distance
smaller_3 = SmallerThan(FirstNumber=crv_cp_5.Distance, SecondNumber=number_slider_3)  # -> SmallerThan, OrEqualTo
smaller_4 = SmallerThan(FirstNumber=crv_cp_6.Distance, SecondNumber=number_slider_3)  # -> SmallerThan, OrEqualTo
dispatch_11 = Dispatch(List=merge_2, DispatchPattern=smaller_3.SmallerThan)  # -> ListA, ListB
dispatch_12 = Dispatch(List=merge_2, DispatchPattern=smaller_4.SmallerThan)  # -> ListA, ListB
pt_3 = Point(simplify(dispatch_12.ListA))
pt_4 = Point(simplify(dispatch_11.ListA))

crv_7 = Curve(Tree({0}: [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], {1}: [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]))
number_slider_4 = Slider(100, range=0..100)
number_slider_5 = Slider(0, range=0..100)
srf_3 = Surface(srf)
brep_strip = BrepStrip(StripExtension=number_slider_5, Curves=crv_3, RefSurface=srf_2, StripWidth=number_slider_4)
number_slider_6 = Slider(0, range=0..100)
brep_strip_2 = BrepStrip(StripExtension=number_slider_5, Curves=crv_4, RefSurface=srf_2, StripWidth=number_slider_4)
number_slider_7 = Slider(100, range=0..100)
merge_3 = Merge(Data1=merge, Data2=merge_2)  # -> flatten(Result)

number_slider_8 = Slider(2, range=0..10)
neg = Negative(Value=thickness)
division = Division(A=thickness, B="4")
neg_2 = Negative(Value=division)
multiplication_5 = Multiplication(A=neg_2, B="2")
pt_5 = ConstructPoint(XCoordinate="0.5", YCoordinate="0.5", ZCoordinate=0)

duppt = RemoveDuplicatePts(Points=merge_3, Tolerance=0.01)
brep_strip_3 = BrepStrip(StripExtension=number_slider_6, Curves=crv_5, RefSurface=srf_3, StripWidth=number_slider_7)
brep_strip_4 = BrepStrip(StripExtension=number_slider_6, Curves=crv_6, RefSurface=srf_3, StripWidth=number_slider_7)
index = ItemIndex(List=duppt, Item=duppt)
tag = TextTag3D(
    Location=duppt,
    Text=index,
    Size=Slider(20, range=0..100),
    Colour=ColourSwatch(SwatchColor=RGB(128, 14, 14)),
    Justification=7)

series = Series(Start=0, Step=neg, Count=layercount)
neg_3 = Negative(Value=series)
offset = OffsetSurface(Surface=flatten(brep_strip_2), Distance=graft(neg_3), Retrim=True)
iso = IsoCurve(Surface=reparameterize(simplify(offset)), UVPoint=pt_5)  # -> UIsocurve, VIsocurve
crv_8 = Curve(simplify(iso.UIsocurve))

neg_4 = Negative(Value=thickness)
division_2 = Division(A=thickness, B="4")
neg_5 = Negative(Value=division_2)
multiplication_6 = Multiplication(A=neg_5, B="3")
pt_6 = ConstructPoint(XCoordinate="0.5", YCoordinate="0.5", ZCoordinate=0)

series_2 = Series(Start=multiplication_5, Step=neg, Count=layercount)
neg_6 = Negative(Value=series_2)
offset_2 = OffsetSurface(Surface=brep_strip, Distance=graft(neg_6), Retrim=True)
iso_2 = IsoCurve(Surface=reparameterize(simplify(offset_2)), UVPoint=pt_5)  # -> UIsocurve, VIsocurve
crv_9 = Curve(iso_2.UIsocurve)

cp = ClosestPoint(Point=pt, Cloud=duppt)  # -> ClosestPoint, CPIndex, Distance
cp_2 = ClosestPoint(Point=pt_2, Cloud=duppt)  # -> ClosestPoint, CPIndex, Distance
cp_3 = ClosestPoint(Point=pt_4, Cloud=duppt)  # -> ClosestPoint, CPIndex, Distance
cp_4 = ClosestPoint(Point=pt_3, Cloud=duppt)  # -> ClosestPoint, CPIndex, Distance
duplicate_tree = DuplicateTree(InputTree=pt_2, Count=layercount)
duplicate_tree_2 = DuplicateTree(InputTree=cp_2.CPIndex, Count=layercount)
duplicate_tree_3 = DuplicateTree(InputTree=cp_3.CPIndex, Count=layercount)
duplicate_tree_4 = DuplicateTree(InputTree=cp.CPIndex, Count=layercount)
duplicate_tree_5 = DuplicateTree(InputTree=pt, Count=layercount)
duplicate_tree_6 = DuplicateTree(InputTree=pt_3, Count=layercount)
duplicate_tree_7 = DuplicateTree(InputTree=pt_4, Count=layercount)
duplicate_tree_8 = DuplicateTree(InputTree=cp_4.CPIndex, Count=layercount)

series_3 = Series(Start=neg_5, Step=neg_4, Count=layercount)
neg_7 = Negative(Value=series_3)
offset_3 = OffsetSurface(Surface=flatten(brep_strip_4), Distance=graft(neg_7), Retrim=True)
iso_3 = IsoCurve(Surface=reparameterize(simplify(offset_3)), UVPoint=pt_6)  # -> UIsocurve, VIsocurve
crv_10 = Curve(simplify(iso_3.UIsocurve))

series_4 = Series(Start=multiplication_6, Step=neg_4, Count=layercount)
neg_8 = Negative(Value=series_4)
offset_4 = OffsetSurface(Surface=brep_strip_3, Distance=graft(neg_8), Retrim=True)
iso_4 = IsoCurve(Surface=reparameterize(simplify(offset_4)), UVPoint=pt_6)  # -> UIsocurve, VIsocurve
crv_11 = Curve(iso_4.UIsocurve)

offsrf = OffsetSurface(Surface=offset, Distance=division, BothSides=0, CreateSolid=True)
offsrf_2 = OffsetSurface(Surface=offset_2, Distance=division, BothSides=0, CreateSolid=True)
offsrf_3 = OffsetSurface(Surface=offset_3, Distance=division_2, BothSides=0, CreateSolid=True)
offsrf_4 = OffsetSurface(Surface=offset_4, Distance=division_2, BothSides=0, CreateSolid=True)

number_slider_9 = Slider(10, range=0..10)
number_slider_10 = Slider(10, range=0..10)
graft = GraftTree(Tree=simplify(offset_2), IncludeEmptyLists=True, IncludeNullItems=True)
graft_2 = GraftTree(Tree=simplify(offset), IncludeEmptyLists=True, IncludeNullItems=True)
number_slider_11 = Slider(10, range=0..10)
unroll_srf_strip_with_points = UnrollSurfaceStripWithPoints(
    Surfaces=graft,
    Curves=crv_9,
    Points=duplicate_tree_5,
    Indexes=duplicate_tree_4,
    Tolerance=0.1,
    Distance=number_slider_9,
    HoleRadius=number_slider_9,
    FontSize=number_slider_9)  # -> Strips, Points, Holes, Labels, OriginalLabels; disabled
number_slider_12 = Slider(10, range=0..10)
unroll_srf_strip_with_points_2 = UnrollSurfaceStripWithPoints(
    Surfaces=graft_2,
    Curves=crv_8,
    Points=duplicate_tree,
    Indexes=duplicate_tree_2,
    Tolerance=0.1,
    Distance=number_slider_10,
    HoleRadius=number_slider_10,
    FontSize=number_slider_10)  # -> Strips, Points, Holes, Labels, OriginalLabels
graft_3 = GraftTree(Tree=simplify(offset_3), IncludeEmptyLists=True, IncludeNullItems=True)
graft_4 = GraftTree(Tree=simplify(offset_4), IncludeEmptyLists=True, IncludeNullItems=True)
unroll_srf_strip_with_points_3 = UnrollSurfaceStripWithPoints(
    Surfaces=graft_3,
    Curves=crv_10,
    Points=duplicate_tree_6,
    Indexes=duplicate_tree_8,
    Tolerance=0.1,
    Distance=number_slider_11,
    HoleRadius=number_slider_11,
    FontSize=number_slider_11)  # -> Strips, Points, Holes, Labels, OriginalLabels; disabled
unroll_srf_strip_with_points_4 = UnrollSurfaceStripWithPoints(
    Surfaces=graft_4,
    Curves=crv_11,
    Points=duplicate_tree_7,
    Indexes=duplicate_tree_3,
    Tolerance=0.1,
    Distance=number_slider_12,
    HoleRadius=number_slider_12,
    FontSize=Slider(20, range=0..100))  # -> Strips, Points, Holes, Labels, OriginalLabels
