# Grasshopper definition 0308_test wall.gh (Grasshopper 1.0.8)
# plug-ins: BarkBeetle, Bifocals

crv = Curve(<curve referenced from the Rhino model>)
disc = Discontinuity(Curve=crv, Level=1)  # -> Points, Parameters
pt = Point(<point referenced from the Rhino model>)
srf = Surface(<surface referenced from the Rhino model>)
merge = Merge(Data1=flatten(disc.Points), Data2=pt)
pt_2 = Point(<point referenced from the Rhino model>)
alongcrv = SortAlongCurve(Points=merge, Curve=crv)  # -> Points, Indices
network = BarkBeetleNetwork(
    MainPoints=alongcrv.Points,
    BranchPoints=pt_2,
    BranchPointsIndex="3",
    BaseSurface=srf,
    StripWidth=Slider(15, range=0..100),
    ReferenceOption=0)  # -> UVNetwork, Points, UVCurves, ExtendedSurface
linear_skeleton = LinearSkeletonGraph(LinearNetwork=network.UVNetwork)  # -> SkeletonGraph, SkeletonPoints, MainCurve, Vectors
number_slider = Slider(1.5, range=0..10)
end = EndPoints(Curve=crv)  # -> Start, End
pt_3 = Point(end.Start)
simple_pattern = SimplePattern(SkeletonGraph=linear_skeleton.SkeletonGraph, SeamPoint=pt_3, PathWidth=Slider(1, range=0..10))  # -> ToolpathPattern, PatternCurve
number_slider_2 = Slider(2, range=0..10)
spiral_pattern = SpiralToolpathPattern(SkeletonGraph=linear_skeleton.SkeletonGraph, SeamPoint=pt_3, PathWidth=Slider(2, range=0..10))  # -> ToolpathPattern, PatternCurve
toggle = BooleanToggle(True)
snake_pattern = SnakeInfillPattern(
    SkeletonGraph=linear_skeleton.SkeletonGraph,
    SeamPoint=pt_3,
    PathWidth=number_slider,
    Spacing=Slider(4, range=0..10),
    MidCurve=number_slider_2)  # -> ToolpathPattern, PatternCurve
zigzag_pattern = ZigZagInfillPattern(
    SkeletonGraph=linear_skeleton.SkeletonGraph,
    SeamPoint=pt_3,
    PathWidth=number_slider,
    Spacing=0,
    MidCurveCount=number_slider_2)  # -> ToolpathPattern, PatternCurve
unpack_pattern = UnpackToolpathPattern(ToolpathPattern=spiral_pattern.ToolpathPattern)  # -> SkeletonGraph, Curve, BundleCurves, Points
unpack_pattern_2 = UnpackToolpathPattern(ToolpathPattern=snake_pattern.ToolpathPattern)  # -> SkeletonGraph, Curve, BundleCurves, Points
organize_pattern_s = OrganizeToolpathPatternS(TopCount=0, MiddlePatternS=snake_pattern.ToolpathPattern, BottomCount=0)
number_slider_3 = Slider(2, range=0..10)
srf_2 = Surface(<surface referenced from the Rhino model>)
between_surface_stack_project = ToolpathStackBetweenSurfacesProject(
    OrganizedStackPatterns=organize_pattern_s,
    LayerHeight=number_slider_3,
    TopSurface=srf_2,
    OrientOption=False,
    PlaneRotateAngle=0)  # -> ToolpathStack, ToolpathCurve, ToolpathPlanes
between_surface_stack_project_2 = ToolpathStackBetweenSurfacesProject(
    OrganizedStackPatterns=organize_pattern_s,
    LayerHeight=number_slider_3,
    TopSurface=srf_2,
    OrientOption=False,
    PlaneRotateAngle=0)  # -> ToolpathStack, ToolpathCurve, ToolpathPlanes
