# Grasshopper definition 1007.gh (Grasshopper 1.0.7)
# plug-ins: BarkBeetle, Pufferfish

geodesics_in_u = Curve([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])
srf = Surface(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)
geodesics_in_v = Curve([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])
crv = Curve(<curve referenced from the Rhino model>)
number_slider = Slider(82, range=0..100)
crv_2 = Curve(<curve referenced from the Rhino model>)
ccx = CurveCurve(CurveA=graft(geodesics_in_v), CurveB=geodesics_in_u)  # -> simplify(Points), ParamsA, ParamsB
pt = ConstructPoint(XCoordinate=Slider(0.38, range=0..1), YCoordinate=Slider(0.16, range=0..1), ZCoordinate=0)
number_slider_2 = Slider(8, range=0..100)
number_slider_3 = Slider(8, range=0..100)
division = Division(A=Slider(76, range=0..100), B="2")
evalsrf = EvaluateSurface(Surface=reparameterize(srf), Point=pt)  # -> Point, Normal, UDirection, VDirection, Frame
end = EndPoints(Curve=crv)  # -> Start, End
end_2 = EndPoints(Curve=crv_2)  # -> Start, End
trim = TrimTree(Tree=ccx.Points, Depth=1)
fillet = Fillet(Curve=crv_2, Radius=number_slider)
number_slider_4 = Slider(23, range=0..100)
division_2 = Division(A=number_slider, B="2")
flip = FlipMatrix(Data=trim)
spiral_skeleton = SpiralSkeleton(Surface=srf, PointsTree=flip, StripWidth=Slider(100, range=0..100))  # -> RefinedGeometry, SkeletonPoints
dom = ConstructDomain(DomainStart=expr("-x", division), DomainEnd=division)
dom_2 = ConstructDomain(DomainStart=expr("-x", number_slider_2), DomainEnd=number_slider_2)
yz = YZPlane(Origin=end.Start)
dom_3 = ConstructDomain(DomainStart=expr("-x", division_2), DomainEnd=division_2)
dom_4 = ConstructDomain(DomainStart=expr("-x", number_slider_3), DomainEnd=number_slider_3)
yz_2 = YZPlane(Origin=end_2.Start)
unpack_geo = UnpackGeometryPackage(GeometryPackage=spiral_skeleton.RefinedGeometry)  # -> OrganizedPointTree, ExtendedSurface, SkeletonPoints, SkeletonCurve, UVCurves, UVVectors
toolpath_base = ToolpathBase(RefinedGeometry=spiral_skeleton.RefinedGeometry, SeamPoint=evalsrf.Point, PathWidth=number_slider_4)  # -> ToolpathBaseCurve, ToolpathBaseCurves, Pts
rectangle = Rectangle(Plane=yz, XSize=dom, YSize=dom_2, Radius=0)  # -> Rectangle, Length
rectangle_2 = Rectangle(Plane=yz_2, XSize=dom_3, YSize=dom_4, Radius=0)  # -> Rectangle, Length
division_3 = Division(A=number_slider_4, B="2")
pt_2 = Point(toolpath_base.Pts)
item = ListItem(List=unpack_geo.UVVectors, Index=0, Wrap=True)
item_2 = ListItem(List=unpack_geo.UVVectors, Index="1", Wrap=True)
crv_3 = Curve(toolpath_base.ToolpathBaseCurve)
srf_2 = Surface(unpack_geo.ExtendedSurface)
crv_4 = Curve(unpack_geo.SkeletonCurve)
pt_3 = Point(unpack_geo.OrganizedPointTree)
fillet_2 = Fillet(Curve=rectangle_2.Rectangle, Radius=Slider(5, range=0..10))
swp1 = Sweep1(Rail=fillet, Sections=fillet_2, Miter=1)
trim_2 = TrimTree(Tree=item_2, Depth=1)
number_slider_5 = Slider(10, range=0..10)
trim_3 = TrimTree(Tree=item, Depth=1)
fillet_3 = Fillet(Curve=rectangle.Rectangle, Radius=Slider(5, range=0..10))
fillet_4 = FilletDistance(Curve=crv_3, Distance=Slider(57, range=0..100))
disc = Discontinuity(Curve=crv, Level=1)  # -> Points, Parameters
panel = Panel("""0
-1""")
disc_2 = Discontinuity(Curve=crv_3, Level=1)  # -> Points, Parameters
panel_2 = Panel("""0
-1""")
number_slider_6 = Slider(0.0001, range=0..0.0001)
cull_i = CullIndex(List=disc.Parameters, Indices=panel, Wrap=True)
amp = Amplitude(Vector=trim_2, Amplitude=Slider(100, range=0..100))
amp_2 = Amplitude(Vector=trim_3, Amplitude=Slider(100, range=0..100))
cull_i_2 = CullIndex(List=disc.Points, Indices=panel, Wrap=True)
cull_i_3 = CullIndex(List=disc_2.Points, Indices=panel_2, Wrap=True)
cull_i_4 = CullIndex(List=disc_2.Parameters, Indices=panel_2, Wrap=True)
vdis = VectorDisplay(Anchor=pt_3, Vector=amp_2)
vdis_2 = VectorDisplay(Anchor=pt_3, Vector=amp)
subtraction = Subtraction(A=cull_i, B=number_slider_6)
addition = Addition(A=cull_i, B=number_slider_6)
subtraction_2 = Subtraction(A=cull_i_4, B=division_3)
addition_2 = Addition(A=cull_i_4, B=division_3)
eval = EvaluateCurve(Curve=crv, Parameter=subtraction)  # -> Point, Tangent, Angle
eval_2 = EvaluateCurve(Curve=crv, Parameter=addition)  # -> Point, Tangent, Angle
eval_3 = EvaluateCurve(Curve=crv_3, Parameter=subtraction_2)  # -> Point, Tangent, Angle
eval_4 = EvaluateCurve(Curve=crv_3, Parameter=addition_2)  # -> Point, Tangent, Angle
amp_3 = Amplitude(Vector=eval_2.Tangent, Amplitude=division)
amp_4 = Amplitude(Vector=eval.Tangent, Amplitude=expr("-x", division))
merge = Merge(Data1=graft(eval_4.Point), Data2=graft(cull_i_3), Data3=graft(eval_3.Point))
move = Move(Geometry=eval_2.Point, Motion=amp_3)  # -> Geometry, Transform
move_2 = Move(Geometry=eval.Point, Motion=amp_4)  # -> Geometry, Transform
nurbs = NurbsCurve(Vertices=merge, Degree="2", Periodic=False)  # -> flatten(Curve), Length, Domain
crv_cp = CurveClosestPoint(Point=move.Geometry, Curve=crv)  # -> Point, Parameter, Distance
graft = GraftTree(Tree=cull_i_2, IncludeEmptyLists=True, IncludeNullItems=True)
crv_cp_2 = CurveClosestPoint(Point=move_2.Geometry, Curve=crv)  # -> Point, Parameter, Distance
shift = ShiftList(List=nurbs.Curve, Shift=1, Wrap=False)
shift_2 = ShiftList(List=nurbs.Curve, Shift="-1", Wrap=False)
graft_2 = GraftTree(Tree=crv_cp_2.Point, IncludeEmptyLists=True, IncludeNullItems=True)
graft_3 = GraftTree(Tree=crv_cp.Point, IncludeEmptyLists=True, IncludeNullItems=True)
end_3 = EndPoints(Curve=shift)  # -> Start, End
end_4 = EndPoints(Curve=shift_2)  # -> Start, End
merge_2 = Merge(Data1=graft_3, Data2=graft, Data3=graft_2)
shatter = Shatter(Curve=crv, Parameters=[crv_cp.Parameter, crv_cp_2.Parameter])
pt_4 = Point(end_3.Start)
pt_5 = Point(end_4.End)
nurbs_2 = NurbsCurve(Vertices=merge_2, Degree="2", Periodic=False)  # -> flatten(Curve), Length, Domain
dispatch = Dispatch(List=shatter, DispatchPattern=[True, False])  # -> ListA, ListB
join = JoinCurves(Curves=flatten([nurbs_2.Curve, dispatch.ListA]), Preserve=False)
disc_3 = Discontinuity(Curve=join, Level=1)  # -> Points, Parameters
pframes = PerpFrames(Curve=join, Count=Slider(50, range=0..100), Align=True)  # -> Frames, Parameters
pframe = PerpFrame(Curve=join)
swp1_2 = Sweep1(Rail=join, Sections=fillet_3, Miter=1)
orient = Orient(Geometry=fillet_3, Source=yz, Target=pframes.Frames)  # -> Geometry, Transform
rotate = Rotate(Geometry=orient.Geometry, Angle=1.570796327, Plane=pframes.Frames)  # -> Geometry, Transform
paramloftmsh = ParameterLoftMesh(
    Sections=rotate.Geometry,
    ParametersU=[0, 0.1, 0.2, 0.3, 0.4, 0.5, 0.6, 0.7, 0.8, 0.9, 1],
    ParametersV=[0, 0.25, 0.5, 0.75, 1],
    Weighted=False,
    Lengths=False,
    Angle=0,
    Closed=False,
    Triangulate=False)
loft = Loft(Curves=rotate.Geometry, Options={Adjust=False, Closed=False, LoftEnds=0, LoftSimp=0, LoftType=0, Rebuild=10, Refit=0.01})
