# Grasshopper definition 1011.gh (Grasshopper 1.0.7)
# plug-ins: BarkBeetle, Weaverbird

geodesics_in_u = Curve([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])
srf = Surface(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)
geodesics_in_v = Curve([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])
ccx = CurveCurve(CurveA=graft(geodesics_in_v), CurveB=geodesics_in_u)  # -> simplify(Points), ParamsA, ParamsB
pt = ConstructPoint(XCoordinate=Slider(0.38, range=0..1), YCoordinate=Slider(0.16, range=0..1), ZCoordinate=0)
evalsrf = EvaluateSurface(Surface=reparameterize(srf), Point=pt)  # -> Point, Normal, UDirection, VDirection, Frame
trim = TrimTree(Tree=ccx.Points, Depth=1)
number_slider = Slider(43, range=0..100)
flip = FlipMatrix(Data=trim)
spiral_skeleton = SpiralSkeleton(Surface=srf, PointsTree=flip, StripWidth=Slider(100, range=0..100))  # -> RefinedGeometry, SkeletonPoints
unpack_geo = UnpackGeometryPackage(GeometryPackage=spiral_skeleton.RefinedGeometry)  # -> OrganizedPointTree, ExtendedSurface, SkeletonPoints, SkeletonCurve, UVCurves, UVVectors
toolpath_base = ToolpathBase(RefinedGeometry=spiral_skeleton.RefinedGeometry, SeamPoint=evalsrf.Point, PathWidth=number_slider)  # -> ToolpathBaseCurve, ToolpathBaseCurves, Pts
division = Division(A=number_slider, B="4")
pt_2 = Point(toolpath_base.Pts)
pt_3 = Point(unpack_geo.OrganizedPointTree)
crv = Curve(toolpath_base.ToolpathBaseCurve)
item = ListItem(List=unpack_geo.UVVectors, Index=0, Wrap=True)
item_2 = ListItem(List=unpack_geo.UVVectors, Index="1", Wrap=True)
srf_2 = Surface(unpack_geo.ExtendedSurface)
crv_2 = Curve(unpack_geo.SkeletonCurve)

# ----
# radius should be small!!!
button = Button()
fillet = FilletToolpathBaseOnSurface(Curve=crv, Radius=division, Surface=srf_2, Trigger=button)

trim_2 = TrimTree(Tree=item_2, Depth=1)
trim_3 = TrimTree(Tree=item, Depth=1)
amp = Amplitude(Vector=trim_2, Amplitude=Slider(100, range=0..100))
amp_2 = Amplitude(Vector=trim_3, Amplitude=Slider(100, range=0..100))
vdis = VectorDisplay(Anchor=pt_3, Vector=amp)
crv_3 = Curve(fillet)
vdis_2 = VectorDisplay(Anchor=pt_3, Vector=amp_2)
flip_2 = FlipCurve(Curve=crv_3)  # -> Curve, Flag
explode = Explode(Curve=flip_2.Curve, Recursive=True)  # -> Segments, Vertices
midpt = CurveMiddle(Curve=explode.Segments)
weave = Weave(Pattern=[0, 1], Stream0=explode.Vertices, Stream1=midpt, NullGaps=False)
srf_cp = SurfaceClosestPoint(Point=weave, Surface=srf_2)  # -> Point, UVPoint, Distance
evalsrf_2 = EvaluateSurface(Surface=srf_2, Point=srf_cp.UVPoint)  # -> Point, Normal, UDirection, VDirection, Frame
amp_3 = Amplitude(Vector=evalsrf_2.Normal, Amplitude=Slider(12, range=0..100))
move = Move(Geometry=weave, Motion=amp_3)  # -> Geometry, Transform
ln = Line(StartPoint=weave, EndPoint=move.Geometry)
split = SplitList(List=ln, Index=Slider(10000, range=0..10000))  # -> ListA, ListB
c_script = CSharpScript(lines=split.ListA)  # -> out, A; inputs lines: list of Line, thickness: Double
# ---------- c_script: C# ----------
    // 1. 创建 Mesh 对象
    Mesh mesh = new Mesh();

    // 2. 遍历所有线段，提取起点和终点，并存入顶点列表
    List<Point3d> startPoints = new List<Point3d>();
    List<Point3d> endPoints = new List<Point3d>();

    foreach (var line in lines)
    {
      startPoints.Add(line.From);  // 线段起点
      endPoints.Add(line.To);      // 线段终点
    }

    // 3. 将起点和终点分别添加到 Mesh 的顶点列表
    foreach (var pt in startPoints)
      mesh.Vertices.Add(pt);

    foreach (var pt in endPoints)
      mesh.Vertices.Add(pt);

    int count = startPoints.Count;

    // 4. 连接顶点，生成初始四边形面
    for (int i = 0; i < count - 1; i++)
    {
      int next = (i + 1) % count;
      mesh.Faces.AddFace(i, next, next + count, i + count);
    }

    // 5. 计算法线
    mesh.Normals.ComputeNormals();  // 计算每个顶点的法线

    // 6. 创建移动后的顶点列表
    List<Point3d> movedVertices = new List<Point3d>();

    for (int i = 0; i < mesh.Vertices.Count; i++)
    {
      // 获取顶点和对应的法向量
      Point3d vertex = mesh.Vertices[i];
      Vector3d normal = mesh.Normals[i];

      // 沿法线方向移动顶点
      Point3d movedVertex = vertex + normal * thickness;
      movedVertices.Add(movedVertex);
    }

    // 7. 清空原始 Mesh 的顶点并添加移动后的顶点
    mesh.Vertices.Clear();
    foreach (var pt in movedVertices)
      mesh.Vertices.Add(pt);

    // 8. 重新计算法线并优化 Mesh
    mesh.Normals.ComputeNormals();
    mesh.Compact();

    A = mesh;
# ---------- end c_script ----------
toggle = BooleanToggle(True)
alignvert = AlignVertices(Mesh=c_script.A, Tolerance=0.01)  # -> Result, Count
m_offset_extrude = MeshOffsetExtrude(M=alignvert.Result, B=toggle, E=toggle, C0=toggle, C1=toggle, D=number_slider)  # -> out, A; inputs M: Mesh, V: list of Vector3d, D: list
# ---------- m_offset_extrude: VB ----------
    Component.Params.Input(0).Name = "Mesh"
    Component.Params.Input(0).Description = "Open or closed mesh"
    Component.Params.Input(1).Name = "Both Sides"
    Component.Params.Input(1).Description = "If true the mesh is offset in both directions along the vertex normals"
    Component.Params.Input(2).Name = "Edges"
    Component.Params.Input(2).Description = "If true the mesh will contain faces on the edges between the two offset mesh faces"
    Component.Params.Input(3).Name = "Closed Bottom"
    Component.Params.Input(3).Description = "If true the mesh will be closed on the origin face"
    Component.Params.Input(4).Name = "Closed Top"
    Component.Params.Input(4).Description = "If true the mesh will be closed on the offset face"
    Component.Params.Input(5).Name = "Vector [Vertex]"
    Component.Params.Input(5).Description = "An optional vector that sets the direction of extrusion, if empty, the new mesh will be offset along the vertex normals"
    Component.Params.Input(6).Name = "Distance [Vertex, Rh Units]"
    Component.Params.Input(6).Description = "A single number or list of numbers corresponding to each vertex of a mesh which sets the Rhino unit based distance that the new geometry is offset from each mesh face"

    Component.Params.Output(1).Name = "Mesh"
    Component.Params.Output(1).Description = "If successful, a valid mesh"

    If m IsNot Nothing Then

      Dim mf As Rhino.Geometry.Collections.MeshFaceList = Nothing
      Dim mv As Rhino.Geometry.Collections.MeshVertexList = Nothing
      Dim mtv As Rhino.Geometry.Collections.MeshTopologyVertexList = Nothing
      Dim mte As Rhino.Geometry.Collections.MeshTopologyEdgeList = Nothing
      Dim mn As Rhino.Geometry.Collections.MeshVertexNormalList = Nothing
      Dim mc As Rhino.Geometry.Collections.MeshVertexColorList = Nothing

      mf = m.Faces
      mv = m.Vertices
      mtv = m.TopologyVertices
      mte = m.TopologyEdges
      mn = m.Normals
      mc = m.VertexColors

      Dim clrB As Boolean = False
      If mc.count() > 0 Then clrB = True

      Dim i,cv,cf,u(1),hd As Integer
      Dim blnV As Boolean
      Dim vec As vector3d
      Dim ova, ovb As New list(Of point3d)
      Dim vf As New list(Of Vector3f)
      Dim ofc As New list(Of MeshFace)
      If b Then hd = 2 Else hd = 1
      
      cv = mv.count()
      cf = mf.count()

      If (D.count() - 1) < cv Then D = matchDbl(D, cv)

      If v.count() > 0 Then
        blnV = True
        If (V.count() - 1) < cv Then V = matchVec(V, cv)
      End If

      'Define Base Vertices
      For i = 0 To cv - 1 Step 1
        If blnV Then vec = V(i) Else vec = mn(i)
        vec.Unitize()
        vec *= (D(i) / hd)

        ovb.add(New point3d(mv(i)) + vec)
        If Not b Then vec *= 0
        vec.Reverse()
        ova.add(New point3d(mv(i)) + vec)
      Next

      If (c0 Or (((Not c0) And (Not e)) And c1)) Then ofc = mf.ToList()

      If ((e or c0) And c1) Then
        For i = 0 To cf - 1 Step 1
          If mf(i).isquad() Then
            ofc.add(New meshface(mf(i).A + cv, mf(i).B + cv, mf(i).C + cv, mf(i).D + cv))
          Else
            ofc.add(New meshface(mf(i).A + cv, mf(i).B + cv, mf(i).C + cv))
          End If
        Next
      End If

      If e Then
        For i = 0 To mte.count() - 1 Step 1

          u(0) = mtv.MeshVertexIndices(mte.GetTopologyVertices(i).I)(0)
          u(1) = mtv.MeshVertexIndices(mte.GetTopologyVertices(i).J)(0)

          If uBound(mte.GetConnectedFaces(i)) < 1 Then
            ofc.add(New meshface(u(0), u(1), u(1) + cv, u(0) + cv))
          End If
        Next
      End If

      Dim mo As New mesh

      If (c0 Or e) Then
        mo.Vertices.AddVertices(ova.toarray())
        If clrB Then mo.VertexColors.AppendColors(mc.ToArray())
      End If
      If (c1 Or e) Then
        mo.Vertices.AddVertices(ovb.toarray())
        If clrB Then mo.VertexColors.AppendColors(mc.ToArray())
      End If

      mo.Faces.AddFaces(ofc)

      A = mo
    End If
# ---------- m_offset_extrude: VB additional code ----------
  Private Function matchDbl(ByVal a As list(Of Double), ByVal t As Integer)
    Dim i,k As Integer
    k = a.count()
    For i = 0 To ((t + 1) - k) - 1 Step 1
      a.add(a.item(k - 1))
    Next
    Return a
  End Function

  Private Function matchVec(ByVal a As list(Of vector3d), ByVal t As Integer)
    Dim i,k As Integer
    k = a.count()
    For i = 0 To ((t + 1) - k) - 1 Step 1
      a.add(a.item(k - 1))
    Next
    Return a
  End Function
# ---------- end m_offset_extrude ----------
wbcatmullclark = WeaverbirdsCatmullClarkSubdivision(MeshCurves=m_offset_extrude.A, Level=1, SmoothNakedEdges=1)
unim = UnifyMesh(Mesh=wbcatmullclark)  # -> Result, Count
preview = CustomPreview(
    Geometry=unim.Result,
    Material={diffuse=RGB(221, 160, 221), emission=RGB(66, 48, 66), shine=0.5, specular=RGB(255, 255, 255), transparency=0})
