# Grasshopper definition 1027(2).gh (Grasshopper 1.0.7)
# plug-ins: BarkBeetle, Bifocals, Weaverbird, KUKA|prc - parametric robot control, Pufferfish

surface = Surface(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)
# Can deal with UV Surfaces (UV structured points)
# Orthogonal Strips
brep_edges = BrepEdges(Brep=surface)  # -> Naked, Interior, NonManifold
dispatch = Dispatch(List=brep_edges.Naked, DispatchPattern=[True, False])  # -> ListA, ListB
divide_curve = DivideCurve(Curve=dispatch.ListA, Count=Slider(12, range=0..20), Kinks=False)  # -> Points, Tangents, Parameters
divide_curve_2 = DivideCurve(Curve=dispatch.ListB, Count=Slider(6, range=0..10), Kinks=False)  # -> Points, Tangents, Parameters
explode_tree = ExplodeTree(Data=divide_curve.Points)  # -> Branch0, Branch1
explode_tree_2 = ExplodeTree(Data=divide_curve_2.Points)  # -> Branch0, Branch1
reverse_list = ReverseList(List=explode_tree_2.Branch1)
reverse_list_2 = ReverseList(List=explode_tree.Branch1)
geodesic = Geodesic(Surface=surface, Start=explode_tree_2.Branch0, End=reverse_list)
geodesic_2 = Geodesic(Surface=surface, Start=explode_tree.Branch0, End=reverse_list_2)
construct_point = ConstructPoint(XCoordinate=Slider(1, range=0..1), YCoordinate=Slider(0, range=0..1), ZCoordinate=0)
curve_intersection = CurveIntersection(CurvesA=graft(geodesic_2), CurvesB=geodesic, Tolerance=Slider(1, range=0..10))  # -> simplify(IntersectionPoints)
evaluate_surface = EvaluateSurface(Surface=reparameterize(surface), Point=construct_point)  # -> Point, Normal, UDirection, VDirection, Frame

surface_2 = Surface(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)
brep_edges_2 = BrepEdges(Brep=surface_2)  # -> Naked, Interior, NonManifold
# Orthogonal Strips: unequal distance
number_slider = Slider(12, range=0..20)
dispatch_2 = Dispatch(List=brep_edges_2.Naked, DispatchPattern=[True, False])  # -> ListA, ListB
range = Range(Domain=Domain(0, 1), Steps=expr("x-1", number_slider))
list_item = ListItem(List=dispatch_2.ListB, Index=0, Wrap=True)  # -> Item, Item1
list_item_2 = ListItem(List=dispatch_2.ListA, Index=0, Wrap=True)  # -> Item, Item1
range_2 = Range(Domain=Domain(0, 1), Steps=expr("x-1", Slider(6, range=0..10)))
flip_curve = FlipCurve(Curve=list_item.Item1)  # -> Curve, Flag
flip_curve_2 = FlipCurve(Curve=list_item_2.Item1)  # -> Curve, Flag
graph_mapper = GraphMapper(
    range_2,
    x0=0,
    x1=1,
    y0=0,
    y1=1,
    container_name="Bezier",
    cpx=[0, 0.134739548, 0.4871794879, 1],
    cpy=[1, 0.4782661796, 0.4275362492, 0])
graph_mapper_2 = GraphMapper(
    range,
    x0=0,
    x1=1,
    y0=0,
    y1=1,
    container_name="Bezier",
    cpx=[0, 0.1355626136, 0.5465503931, 1],
    cpy=[0, 0.5468449593, 0.6515547037, 1])
merge = Merge(Data1=list_item.Item, Data2=flip_curve.Curve)
merge_2 = Merge(Data1=list_item_2.Item, Data2=flip_curve_2.Curve)
evaluate_curve = EvaluateCurve(Curve=reparameterize(graft(merge)), Parameter=graph_mapper)  # -> Point, Tangent, Angle
evaluate_curve_2 = EvaluateCurve(Curve=reparameterize(graft(merge_2)), Parameter=graph_mapper_2)  # -> Point, Tangent, Angle
explode_tree_3 = ExplodeTree(Data=evaluate_curve.Point)  # -> Branch0, Branch1
explode_tree_4 = ExplodeTree(Data=evaluate_curve_2.Point)  # -> Branch0, Branch1
geodesic_3 = Geodesic(Surface=surface_2, Start=explode_tree_3.Branch0, End=explode_tree_3.Branch1)
geodesic_4 = Geodesic(Surface=surface_2, Start=explode_tree_4.Branch0, End=explode_tree_4.Branch1)
construct_point_2 = ConstructPoint(XCoordinate=Slider(1, range=0..1), YCoordinate=Slider(0, range=0..1), ZCoordinate=0)
curve_intersection_2 = CurveIntersection(CurvesA=graft(geodesic_4), CurvesB=geodesic_3, Tolerance=Slider(1, range=0..10))  # -> simplify(IntersectionPoints)
evaluate_surface_2 = EvaluateSurface(Surface=reparameterize(surface_2), Point=construct_point_2)  # -> Point, Normal, UDirection, VDirection, Frame

# ----
# General Workflow
geodesics_in_v = Curve([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])
geodesics_in_u = Curve([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])
surface_3 = Surface(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)
# Stack Between
surface_4 = Surface(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)
# Ring Surface: Need to deal with edges?
surface_5 = Surface(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)
# Simple Surface: Need to have a more simple skeleton and workflow
surface_6 = Surface(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)
curve_curve = CurveCurve(CurveA=graft(geodesics_in_v), CurveB=geodesics_in_u)  # -> simplify(Points), ParamsA, ParamsB
divide_surface = DivideSurface(Surface=surface_5, UCount=Slider(3, range=0..10), VCount=Slider(16, range=0..100))  # -> Points, Normals, Parameters
divide_surface_2 = DivideSurface(Surface=surface_4, UCount=Slider(1, range=0..10), VCount=Slider(1, range=0..100))  # -> Points, Normals, Parameters
divide_surface_3 = DivideSurface(Surface=surface_6, UCount=Slider(1, range=0..10), VCount=Slider(1, range=0..100))  # -> Points, Normals, Parameters
trim_tree = TrimTree(Tree=curve_curve.Points, Depth=1)
spiral_skeleton = SpiralSkeleton(Surface=surface_5, PointsTree=divide_surface.Points, StripWidth=Slider(130, range=0..1000))  # -> SkeletonPackage, SkeletonPoints, SkeletonCurve
point = Point(Point(806.5582752, 2973.649366, 647.5978403))
spiral_skeleton_2 = SpiralSkeleton(Surface=surface_4, PointsTree=divide_surface_2.Points, StripWidth=Slider(500, range=0..1000))  # -> SkeletonPackage, SkeletonPoints, SkeletonCurve
point_2 = Point(Point(-1149.768658, 12321.49512, 0))
spiral_skeleton_3 = SpiralSkeleton(Surface=surface_6, PointsTree=divide_surface_3.Points, StripWidth=Slider(1450, range=0..10000))  # -> SkeletonPackage, SkeletonPoints, SkeletonCurve
point_3 = Point(Point(6092.833414, 13135.06375, 681.3975927))
spiral_skeleton_4 = SpiralSkeleton(Surface=surface_3, PointsTree=trim_tree, StripWidth=Slider(100, range=0..100))  # -> SkeletonPackage, SkeletonPoints, SkeletonCurve

unpack_skeleton_package = UnpackSkeletonPackage(SkeletonPackage=spiral_skeleton_4.SkeletonPackage)  # -> OrganizedPointTree, ExtendedSurface, SkeletonPoints, SkeletonCurve, UVCurves, UVVectors
list_item_3 = ListItem(List=unpack_skeleton_package.UVVectors, Index=0, Wrap=True)
list_item_4 = ListItem(List=unpack_skeleton_package.UVVectors, Index="1", Wrap=True)
number_slider_2 = Slider(100, range=0..100)
point_4 = Point(unpack_skeleton_package.OrganizedPointTree)
trim_tree_2 = TrimTree(Tree=list_item_3, Depth=1)
trim_tree_3 = TrimTree(Tree=list_item_4, Depth=1)
amplitude = Amplitude(Vector=trim_tree_2, Amplitude=number_slider_2)
amplitude_2 = Amplitude(Vector=trim_tree_3, Amplitude=number_slider_2)
vector_display = VectorDisplay(Anchor=point_4, Vector=amplitude_2)
vector_display_2 = VectorDisplay(Anchor=point_4, Vector=amplitude)

brep_strip = BrepStrip(SkeletonPackage=spiral_skeleton_4.SkeletonPackage, StripExtension=Slider(48, range=0..100))

brep_strip_2 = BrepStrip(SkeletonPackage=spiral_skeleton.SkeletonPackage, StripExtension=Slider(66, range=0..100))
spiral_toolpath_base = SpiralToolpathBase(SkeletonPackage=spiral_skeleton.SkeletonPackage, SeamPoint=point, PathWidth=Slider(30, range=0..100))  # -> ToolpathBase, ToolpathBaseCurve
unpack_skeleton_package_2 = UnpackSkeletonPackage(SkeletonPackage=spiral_skeleton_2.SkeletonPackage)  # -> OrganizedPointTree, ExtendedSurface, SkeletonPoints, SkeletonCurve, UVCurves, UVVectors
spiral_toolpath_base_2 = SpiralToolpathBase(SkeletonPackage=spiral_skeleton_2.SkeletonPackage, SeamPoint=point_3, PathWidth=Slider(80, range=0..1000))  # -> ToolpathBase, ToolpathBaseCurve
unpack_skeleton_package_3 = UnpackSkeletonPackage(SkeletonPackage=spiral_skeleton_3.SkeletonPackage)  # -> OrganizedPointTree, ExtendedSurface, SkeletonPoints, SkeletonCurve, UVCurves, UVVectors
spiral_toolpath_base_3 = SpiralToolpathBase(SkeletonPackage=spiral_skeleton_3.SkeletonPackage, SeamPoint=point_2, PathWidth=Slider(80, range=0..1000))  # -> ToolpathBase, ToolpathBaseCurve
surface_7 = Surface(unpack_skeleton_package_2.ExtendedSurface)
surface_8 = Surface(unpack_skeleton_package_3.ExtendedSurface)
point_5 = Point(Point(-1465.515275, 12416.5344, 0))
point_6 = Point(Point(-1465.515275, 12416.5344, 0))
point_7 = Point(Point(345.9742903, 1494.663101, 0))
surface_9 = Surface(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)
toolpathstackvertical = ToolpathStackVertical(
    ToolpathBase=spiral_toolpath_base.ToolpathBase,
    LayerHeight=Slider(30, range=0..100),
    TotalHeight=Slider(90, range=0..1000),
    OrientOption=Toggle(True),
    ReferencePoint=point_7,
    PlaneRotateAngle=0)  # -> ToolpathStack, ToolpathCurve, ToolpathFrames
toolpathstackvertical_2 = ToolpathStackVertical(
    ToolpathBase=spiral_toolpath_base_2.ToolpathBase,
    LayerHeight=Slider(30, range=0..100),
    TotalHeight=Slider(90, range=0..1000),
    OrientOption=Toggle(True),
    ReferencePoint=point_5,
    PlaneRotateAngle=0)  # -> ToolpathStack, ToolpathCurve, ToolpathFrames
toolpathstackvertical_3 = ToolpathStackVertical(
    ToolpathBase=spiral_toolpath_base_3.ToolpathBase,
    LayerHeight=Slider(30, range=0..100),
    TotalHeight=Slider(90, range=0..1000),
    OrientOption=Toggle(True),
    ReferencePoint=point_6,
    PlaneRotateAngle=0)  # -> ToolpathStack, ToolpathCurve, ToolpathFrames
point_8 = Point(curve_intersection)
surface_10 = Surface(surface)
toolpath_stack_between_surfaces = ToolpathStackBetweenSurfaces(
    ToolpathBase=spiral_toolpath_base_2.ToolpathBase,
    LayerHeight=Slider(100, range=0..100),
    TopSurface=surface_9,
    OrientOption=Toggle(True),
    ReferencePoint=Point(0, 0, 0),
    PlaneRotateAngle=0)  # -> ToolpathStack, ToolpathCurve, ToolpathFrames
construct_point_3 = ConstructPoint(XCoordinate=Slider(1, range=0..1), YCoordinate=Slider(0, range=0..1), ZCoordinate=0)
spiral_skeleton_5 = SpiralSkeleton(Surface=surface_10, PointsTree=point_8, StripWidth=Slider(143, range=0..1000))  # -> SkeletonPackage, SkeletonPoints, SkeletonCurve
number_slider_3 = Slider(30, range=0..100)
evaluate_surface_3 = EvaluateSurface(Surface=reparameterize(surface_3), Point=construct_point_3)  # -> Point, Normal, UDirection, VDirection, Frame
unpack_toolpath_stack = UnpackToolpathStack(ToolpathStack=toolpath_stack_between_surfaces.ToolpathStack)  # -> ToolpathBase, ToolpathCurve, ToolpathCurves, ToolpathFrames, SurfaceSeries
point_9 = Point(evaluate_surface.Point)
point_10 = Point(curve_intersection_2)
surface_11 = Surface(surface_2)
spiral_toolpath_base_4 = SpiralToolpathBase(SkeletonPackage=spiral_skeleton_4.SkeletonPackage, SeamPoint=evaluate_surface_3.Point, PathWidth=number_slider_3)  # -> ToolpathBase, ToolpathBaseCurve
spiral_toolpath_base_5 = SpiralToolpathBase(SkeletonPackage=spiral_skeleton_5.SkeletonPackage, SeamPoint=point_9, PathWidth=Slider(30, range=0..100))  # -> ToolpathBase, ToolpathBaseCurve
brep_strip_3 = BrepStrip(SkeletonPackage=spiral_skeleton_5.SkeletonPackage, StripExtension=Slider(89, range=0..100))
unpack_toolpath_base = UnpackToolpathBase(OrganizedPointTree=spiral_toolpath_base_4.ToolpathBase)  # -> SkeletonPackage, ToolpathBaseCurve, UnconnectedCurves, ToolpathPoints
spiral_skeleton_6 = SpiralSkeleton(Surface=surface_11, PointsTree=point_10, StripWidth=Slider(143, range=0..1000))  # -> SkeletonPackage, SkeletonPoints, SkeletonCurve
point_11 = Point(evaluate_surface_2.Point)
curve = Curve(unpack_toolpath_base.ToolpathBaseCurve)
point_12 = Point(Point(345.9742903, 1494.663101, 0))
spiral_toolpath_base_6 = SpiralToolpathBase(SkeletonPackage=spiral_skeleton_6.SkeletonPackage, SeamPoint=point_11, PathWidth=Slider(30, range=0..100))  # -> ToolpathBase, ToolpathBaseCurve
brep_strip_4 = BrepStrip(SkeletonPackage=spiral_skeleton_6.SkeletonPackage, StripExtension=Slider(89, range=0..100))
toolpathstackvertical_4 = ToolpathStackVertical(
    ToolpathBase=spiral_toolpath_base_5.ToolpathBase,
    LayerHeight=Slider(30, range=0..100),
    TotalHeight=Slider(90, range=0..1000),
    OrientOption=Toggle(True),
    ReferencePoint=point_12,
    PlaneRotateAngle=0)  # -> ToolpathStack, ToolpathCurve, ToolpathFrames
pi = Pi(Factor=Slider(0.34, range=0..1))
xy_plane = XYPlane(Origin=Point(0, 0, 0))
point_13 = Point(Point(345.9742903, 1494.663101, 0))
point_14 = Point(Point(345.9742903, 1494.663101, 0))
rotate = Rotate(Geometry=xy_plane, Angle=pi, Plane=PlaneXY(0, 0, 0))  # -> Geometry, Transform
toolpathstackvertical_5 = ToolpathStackVertical(
    ToolpathBase=spiral_toolpath_base_6.ToolpathBase,
    LayerHeight=Slider(30, range=0..100),
    TotalHeight=Slider(90, range=0..1000),
    OrientOption=Toggle(True),
    ReferencePoint=point_14,
    PlaneRotateAngle=0)  # -> ToolpathStack, ToolpathCurve, ToolpathFrames
toolpathstackvertical_6 = ToolpathStackVertical(
    ToolpathBase=spiral_toolpath_base_4.ToolpathBase,
    LayerHeight=Slider(33, range=0..100),
    TotalHeight=Slider(102, range=0..1000),
    OrientOption=Toggle(False),
    ReferencePlane=rotate.Geometry,
    PlaneRotateAngle=0)  # -> ToolpathStack, ToolpathCurve, ToolpathFrames

# ----
# radius should be small!!!
number = Number(number_slider_3)
division = Division(A=number, B="4")
fillet_toolpath_from_toolpathstack = FilletToolpathFromToolpathStack(ToolpathStack=toolpathstackvertical_6.ToolpathStack, Radius=division, Trigger=Button(), SeamLengthFactor=10)  # -> Curve, ToolpathStack
curve_2 = Curve(fillet_toolpath_from_toolpathstack.Curve)
number_slider_4 = Slider(0.18339, range=0..1)
toolpath_mesh = ToolpathMesh(ToolpathStack=fillet_toolpath_from_toolpathstack.ToolpathStack, Parameter=number_slider_4)
weaverbird_s_loop_subdivision = WeaverbirdsLoopSubdivision(MeshCurves=toolpath_mesh, Level=1, SmoothNakedEdges=1)
custom_preview = CustomPreview(
    Geometry=weaverbird_s_loop_subdivision,
    Material={diffuse=RGB(221, 160, 221), emission=RGB(66, 48, 66), shine=0.5, specular=RGB(255, 255, 255), transparency=0})

unpack_toolpath_stack_2 = UnpackToolpathStack(ToolpathStack=toolpathstackvertical_6.ToolpathStack)  # -> ToolpathBase, ToolpathCurve, ToolpathCurves, ToolpathFrames, SurfaceSeries

surface_12 = Surface(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)
# Non-UV points:
# Need to find an effective way to get the Skeleton
# (connecting all points without intersection, maybe there are some
# existing algorithm that may help, but out of scope for now)
brep_edges_3 = BrepEdges(Brep=surface_12)  # -> Naked, Interior, NonManifold
number_slider_5 = Slider(2, range=0..10)
dispatch_3 = Dispatch(List=brep_edges_3.Naked, DispatchPattern=[True, False])  # -> ListA, ListB
divide_curve_3 = DivideCurve(Curve=reverse(dispatch_3.ListB), Count=number_slider_5, Kinks=False)  # -> Points, Tangents, Parameters
divide_curve_4 = DivideCurve(Curve=dispatch_3.ListA, Count=Slider(7, range=0..20), Kinks=False)  # -> Points, Tangents, Parameters
divide_curve_5 = DivideCurve(Curve=dispatch_3.ListB, Count=number_slider_5, Kinks=False)  # -> Points, Tangents, Parameters
cull_index = CullIndex(List=divide_curve_4.Points, Indices=[-1, 0], Wrap=True)
merge_3 = Merge(Data1=simplify(divide_curve_3.Points), Data2=simplify(cull_index))
merge_4 = Merge(Data1=simplify(cull_index), Data2=simplify(divide_curve_5.Points))
cull_index_2 = CullIndex(List=merge_3, Indices="0", Wrap=True)
cull_index_3 = CullIndex(List=merge_4, Indices="-1", Wrap=True)
explode_tree_5 = ExplodeTree(Data=cull_index_2)  # -> Branch0, Branch1
explode_tree_6 = ExplodeTree(Data=cull_index_3)  # -> Branch0, Branch1
reverse_list_3 = ReverseList(List=explode_tree_5.Branch0)
reverse_list_4 = ReverseList(List=explode_tree_6.Branch0)
geodesic_5 = Geodesic(Surface=surface_12, Start=reverse_list_3, End=explode_tree_5.Branch1)
geodesic_6 = Geodesic(Surface=surface_12, Start=reverse_list_4, End=explode_tree_6.Branch1)
curve_intersection_3 = CurveIntersection(CurvesA=graft(geodesic_6), CurvesB=geodesic_5, Tolerance=Slider(1, range=0..10))  # -> simplify(IntersectionPoints)

surface_13 = Surface(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)
brep_edges_4 = BrepEdges(Brep=surface_13)  # -> Naked, Interior, NonManifold
number_slider_6 = Slider(2, range=0..10)
dispatch_4 = Dispatch(List=brep_edges_4.Naked, DispatchPattern=[True, False])  # -> ListA, ListB
divide_curve_6 = DivideCurve(Curve=reverse(dispatch_4.ListB), Count=number_slider_6, Kinks=False)  # -> Points, Tangents, Parameters
divide_curve_7 = DivideCurve(Curve=dispatch_4.ListA, Count=Slider(4, range=0..20), Kinks=False)  # -> Points, Tangents, Parameters
divide_curve_8 = DivideCurve(Curve=dispatch_4.ListB, Count=number_slider_6, Kinks=False)  # -> Points, Tangents, Parameters
cull_index_4 = CullIndex(List=divide_curve_7.Points, Indices=[-1, 0], Wrap=True)
merge_5 = Merge(Data1=simplify(divide_curve_6.Points), Data2=simplify(cull_index_4))
merge_6 = Merge(Data1=simplify(cull_index_4), Data2=simplify(divide_curve_8.Points))
cull_index_5 = CullIndex(List=merge_5, Indices="0", Wrap=True)
cull_index_6 = CullIndex(List=merge_6, Indices="-1", Wrap=True)
explode_tree_7 = ExplodeTree(Data=cull_index_5)  # -> Branch0, Branch1
explode_tree_8 = ExplodeTree(Data=cull_index_6)  # -> Branch0, Branch1
reverse_list_5 = ReverseList(List=explode_tree_8.Branch0)
reverse_list_6 = ReverseList(List=explode_tree_7.Branch0)
jitter = Jitter(List=reverse_list_5, Jitter=1, Seed=Slider(2, range=0..10))  # -> Values, Indices
jitter_2 = Jitter(List=reverse_list_6, Jitter=1, Seed=Slider(2, range=0..10))  # -> Values, Indices
jitter_3 = Jitter(List=explode_tree_8.Branch1, Jitter=1, Seed=Slider(0, range=0..10))  # -> Values, Indices
jitter_4 = Jitter(List=explode_tree_7.Branch1, Jitter=1, Seed=Slider(7, range=0..10))  # -> Values, Indices
geodesic_7 = Geodesic(Surface=surface_13, Start=jitter.Values, End=jitter_3.Values)
geodesic_8 = Geodesic(Surface=surface_13, Start=jitter_2.Values, End=jitter_4.Values)
multiple_curves = MultipleCurves(Curves=[geodesic_7, geodesic_8])  # -> Points, IndexA, IndexB, ParamA, ParamB

to_kuka_movement = ToKukaMovement(ToolpathStack=toolpathstackvertical_6.ToolpathStack, VelMax="0.25")  # -> ToolpathFrames, SpeedFactors
quantec_kr210_r3300k_ultra_robot = QuantecKR210R3300KUltraRobot(infiniterot=False)
flip_plane = FlipPlane(Plane=to_kuka_movement.ToolpathFrames, FlipX=False, FlipY=False, FlipZ=True)  # -> Flipped, ResultBoolean
kl1500_3_linear_axis_kuka_prc = KL15003LinearAxisKUKAPrc(
    KUKAPrcRobotInput=quantec_kr210_r3300k_ultra_robot,
    PositiveLength=4000,
    NegativeLength=-500,
    PositiveDirection=Vector(1, 0, 0),
    RobotBase=PlaneXY(0, 0, 507))
linear_movement_kuka_prc = LINearMovementKUKAPrc(TargetAsPlane=flip_plane.Flipped, Speed=to_kuka_movement.SpeedFactors, extaxenabled=False, interpolation="C_DIS")
kuka_prc_core = KUKAPrcCORE(
    SimulationSlider=number_slider_4,
    KUKAPrcCommands=linear_movement_kuka_prc,
    Robot=kl1500_3_linear_axis_kuka_prc,
    PRC_BaseExpose=False,
    PRC_SaveNameExpose=False,
    PRCsettings="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")  # -> RobotGeometry, AnalysisOutput

surface_14 = Surface(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)
# Non-orthogonal Strips
brep_edges_5 = BrepEdges(Brep=surface_14)  # -> Naked, Interior, NonManifold
dispatch_5 = Dispatch(List=brep_edges_5.Naked, DispatchPattern=[True, False])  # -> ListA, ListB
range_3 = Range(Domain=Domain(0, 1), Steps=expr("x-1", Slider(12, range=0..20)))
range_4 = Range(Domain=Domain(0, 1), Steps=expr("x-1", Slider(5, range=0..10)))
graph_mapper_3 = GraphMapper(
    range_3,
    x0=0,
    x1=1,
    y0=0,
    y1=1,
    container_name="Bezier",
    cpx=[0, 0.2702096999, 0.4993940592, 1],
    cpy=[0, 0.4460856318, 0.8310263753, 1])
graph_mapper_4 = GraphMapper(
    range_4,
    x0=0,
    x1=1,
    y0=0,
    y1=1,
    container_name="Bezier",
    cpx=[0, 0.2774043381, 0.4957600832, 1],
    cpy=[0, 0.4297087193, 0.7768236399, 1])
evaluate_curve_3 = EvaluateCurve(Curve=reparameterize(graft(dispatch_5.ListA)), Parameter=graph_mapper_3)  # -> Point, Tangent, Angle
explode_tree_9 = ExplodeTree(Data=evaluate_curve_3.Point)  # -> Branch0, Branch1
reverse_list_7 = ReverseList(List=explode_tree_9.Branch1)
geodesic_9 = Geodesic(Surface=surface_14, Start=explode_tree_9.Branch0, End=reverse_list_7)
construct_point_4 = ConstructPoint(XCoordinate=Slider(1, range=0..1), YCoordinate=Slider(0, range=0..1), ZCoordinate=0)
evaluate_surface_4 = EvaluateSurface(Surface=reparameterize(surface_14), Point=construct_point_4)  # -> Point, Normal, UDirection, VDirection, Frame

evaluate_curve_4 = EvaluateCurve(Curve=reparameterize(graft(dispatch_5.ListB)), Parameter=graph_mapper_4)  # -> Point, Tangent, Angle

explode_tree_10 = ExplodeTree(Data=evaluate_curve_4.Point)  # -> Branch0, Branch1
reverse_list_8 = ReverseList(List=explode_tree_10.Branch1)
geodesic_10 = Geodesic(Surface=surface_14, Start=explode_tree_10.Branch0, End=reverse_list_8)
curve_intersection_4 = CurveIntersection(CurvesA=graft(geodesic_9), CurvesB=geodesic_10, Tolerance=Slider(1, range=0..10))  # -> simplify(IntersectionPoints)

point_15 = Point(curve_intersection_4)
surface_15 = Surface(surface_14)
spiral_skeleton_7 = SpiralSkeleton(Surface=surface_15, PointsTree=point_15, StripWidth=Slider(143, range=0..1000))  # -> SkeletonPackage, SkeletonPoints, SkeletonCurve
point_16 = Point(evaluate_surface_4.Point)
spiral_toolpath_base_7 = SpiralToolpathBase(SkeletonPackage=spiral_skeleton_7.SkeletonPackage, SeamPoint=point_16, PathWidth=Slider(30, range=0..100))  # -> ToolpathBase, ToolpathBaseCurve
brep_strip_5 = BrepStrip(SkeletonPackage=spiral_skeleton_7.SkeletonPackage, StripExtension=Slider(89, range=0..100))
toolpathstackvertical_7 = ToolpathStackVertical(
    ToolpathBase=spiral_toolpath_base_7.ToolpathBase,
    LayerHeight=Slider(30, range=0..100),
    TotalHeight=Slider(90, range=0..1000),
    OrientOption=Toggle(True),
    ReferencePoint=point_13,
    PlaneRotateAngle=0)  # -> ToolpathStack, ToolpathCurve, ToolpathFrames
