# Grasshopper definition 1027.gh (Grasshopper 1.0.7)
# plug-ins: Weaverbird, BarkBeetle, Bifocals, RhinoCodePluginGH, KUKA|prc - parametric robot control, Pufferfish

surface = Surface(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)
brep_edges = BrepEdges(Brep=surface)  # -> Naked, Interior, NonManifold
number_slider = Slider(2, range=0..10)
dispatch = Dispatch(List=brep_edges.Naked, DispatchPattern=[True, False])  # -> ListA, ListB
divide_curve = DivideCurve(Curve=dispatch.ListB, Count=number_slider, Kinks=False)  # -> Points, Tangents, Parameters
divide_curve_2 = DivideCurve(Curve=reverse(dispatch.ListB), Count=number_slider, Kinks=False)  # -> Points, Tangents, Parameters
divide_curve_3 = DivideCurve(Curve=dispatch.ListA, Count=Slider(7, range=0..20), Kinks=False)  # -> Points, Tangents, Parameters
cull_index = CullIndex(List=divide_curve_3.Points, Indices=[-1, 0], Wrap=True)
merge = Merge(Data1=simplify(cull_index), Data2=simplify(divide_curve.Points))
merge_2 = Merge(Data1=simplify(divide_curve_2.Points), Data2=simplify(cull_index))

geodesics_in_v = Curve([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])
geodesics_in_u = Curve([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])
curve_curve = CurveCurve(CurveA=graft(geodesics_in_v), CurveB=geodesics_in_u)  # -> simplify(Points), ParamsA, ParamsB
surface_2 = Surface(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)
number_slider_2 = Slider(100, range=0..100)
trim_tree = TrimTree(Tree=curve_curve.Points, Depth=1)
spiral_skeleton = SpiralSkeleton(Surface=surface_2, PointsTree=trim_tree, StripWidth=number_slider_2)  # -> SkeletonPackage, SkeletonPoints, SkeletonCurve
unpack_skeleton_package = UnpackSkeletonPackage(SkeletonPackage=spiral_skeleton.SkeletonPackage)  # -> OrganizedPointTree, ExtendedSurface, SkeletonPoints, SkeletonCurve, UVCurves, UVVectors
list_item = ListItem(List=unpack_skeleton_package.UVVectors, Index=0, Wrap=True)
list_item_2 = ListItem(List=unpack_skeleton_package.UVVectors, Index="1", Wrap=True)
number_slider_3 = Slider(100, range=0..100)
point = Point(unpack_skeleton_package.OrganizedPointTree)
trim_tree_2 = TrimTree(Tree=list_item, Depth=1)
trim_tree_3 = TrimTree(Tree=list_item_2, Depth=1)
amplitude = Amplitude(Vector=trim_tree_2, Amplitude=number_slider_3)
amplitude_2 = Amplitude(Vector=trim_tree_3, Amplitude=number_slider_3)
vector_display = VectorDisplay(Anchor=point, Vector=amplitude_2)
vector_display_2 = VectorDisplay(Anchor=point, Vector=amplitude)

surface_3 = Surface(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)
brep_edges_2 = BrepEdges(Brep=surface_3)  # -> Naked, Interior, NonManifold
dispatch_2 = Dispatch(List=brep_edges_2.Naked, DispatchPattern=[True, False])  # -> ListA, ListB
divide_curve_4 = DivideCurve(Curve=dispatch_2.ListA, Count=Slider(12, range=0..20), Kinks=False)  # -> Points, Tangents, Parameters
divide_curve_5 = DivideCurve(Curve=dispatch_2.ListB, Count=Slider(6, range=0..10), Kinks=False)  # -> Points, Tangents, Parameters
explode_tree = ExplodeTree(Data=divide_curve_4.Points)  # -> Branch0, Branch1
explode_tree_2 = ExplodeTree(Data=divide_curve_5.Points)  # -> Branch0, Branch1
reverse_list = ReverseList(List=explode_tree_2.Branch1)
reverse_list_2 = ReverseList(List=explode_tree.Branch1)
number_slider_4 = Slider(1, range=0..10)
geodesic = Geodesic(Surface=surface_3, Start=explode_tree_2.Branch0, End=reverse_list)
geodesic_2 = Geodesic(Surface=surface_3, Start=explode_tree.Branch0, End=reverse_list_2)
c_script = CSharpScript(curvesA=graft(geodesic_2), curvesB=geodesic, tolerance=number_slider_4)  # -> out, simplify(A); inputs curvesA: list of Curve, curvesB: list of Curve, tolerance: Double
# ---------- c_script: C# ----------
// Grasshopper Script Instance
#region Usings
using System;
using System.Linq;
using System.Collections;
using System.Collections.Generic;
using System.Drawing;

using Rhino;
using Rhino.Geometry;

using Grasshopper;
using Grasshopper.Kernel;
using Grasshopper.Kernel.Data;
using Grasshopper.Kernel.Types;
#endregion

public class Script_Instance : GH_ScriptInstance
{
    #region Notes
    /* 
      Members:
        RhinoDoc RhinoDocument
        GH_Document GrasshopperDocument
        IGH_Component Component
        int Iteration

      Methods (Virtual & overridable):
        Print(string text)
        Print(string format, params object[] args)
        Reflect(object obj)
        Reflect(object obj, string method_name)
    */
    #endregion

    private void RunScript(
	List<Curve> curvesA,
	List<Curve> curvesB,
	double tolerance,
	ref object A)
    {
            // 存储所有的交点
        List<Point3d> intersectionPoints = new List<Point3d>();

        // 遍历每一对曲线并计算它们的交点
        foreach (Curve curveA in curvesA)
        {
            foreach (Curve curveB in curvesB)
            {
                // 计算交点，存储到交点事件列表中
                var intersections = Rhino.Geometry.Intersect.Intersection.CurveCurve(curveA, curveB, tolerance, tolerance);

                // 如果存在交点，遍历交点事件并提取交点位置
                if (intersections != null)
                {
                    for (int i = 0; i < intersections.Count; i++)
                    {
                        var intersection = intersections[i];
                        intersectionPoints.Add(intersection.PointA);
                    }
                }
            }
        }

        // 输出所有找到的交点
        A = intersectionPoints;
    }
}
# ---------- end c_script ----------

cull_index_2 = CullIndex(List=merge, Indices="-1", Wrap=True)
cull_index_3 = CullIndex(List=merge_2, Indices="0", Wrap=True)
explode_tree_3 = ExplodeTree(Data=cull_index_2)  # -> Branch0, Branch1
explode_tree_4 = ExplodeTree(Data=cull_index_3)  # -> Branch0, Branch1
reverse_list_3 = ReverseList(List=explode_tree_3.Branch0)
reverse_list_4 = ReverseList(List=explode_tree_4.Branch0)
geodesic_3 = Geodesic(Surface=surface, Start=reverse_list_3, End=explode_tree_3.Branch1)
geodesic_4 = Geodesic(Surface=surface, Start=reverse_list_4, End=explode_tree_4.Branch1)

number_slider_5 = Slider(75, range=0..100)
brep_strip = BrepStrip(
    StripExtension=number_slider_5,
    Curves=unpack_skeleton_package.UVCurves,
    Surface=unpack_skeleton_package.ExtendedSurface,
    StripWidth=number_slider_2)
brep_strip_2 = BrepStrip(SkeletonPackage=spiral_skeleton.SkeletonPackage, StripExtension=number_slider_5)

c_script_2 = CSharpScript(curvesA=graft(geodesic_3), curvesB=geodesic_4, tolerance=Slider(1, range=0..10))  # -> out, simplify(A); inputs curvesA: list of Curve, curvesB: list of Curve, tolerance: Double; same code as c_script
point_2 = Point()
curve_intersection = CurveIntersection(CurvesA=graft(geodesic_2), CurvesB=geodesic, Tolerance=number_slider_4)  # -> simplify(IntersectionPoints)
point_3 = Point(curve_intersection)
surface_4 = Surface(surface_3)

construct_point = ConstructPoint(XCoordinate=Slider(1, range=0..1), YCoordinate=Slider(0, range=0..1), ZCoordinate=0)
number_slider_6 = Slider(30, range=0..100)
evaluate_surface = EvaluateSurface(Surface=reparameterize(surface_2), Point=construct_point)  # -> Point, Normal, UDirection, VDirection, Frame
spiral_toolpath_base = SpiralToolpathBase(SkeletonPackage=spiral_skeleton.SkeletonPackage, SeamPoint=evaluate_surface.Point, PathWidth=number_slider_6)  # -> ToolpathBase, ToolpathBaseCurve
unpack_toolpath_base = UnpackToolpathBase(OrganizedPointTree=spiral_toolpath_base.ToolpathBase)  # -> SkeletonPackage, ToolpathBaseCurve, UnconnectedCurves, ToolpathPoints
curve = Curve(unpack_toolpath_base.ToolpathBaseCurve)

number_slider_7 = Slider(143, range=0..1000)
construct_point_2 = ConstructPoint(XCoordinate=Slider(1, range=0..1), YCoordinate=Slider(0, range=0..1), ZCoordinate=0)
evaluate_surface_2 = EvaluateSurface(Surface=reparameterize(surface_4), Point=construct_point_2)  # -> Point, Normal, UDirection, VDirection, Frame
spiral_skeleton_2 = SpiralSkeleton(Surface=surface_4, PointsTree=point_3, StripWidth=number_slider_7)  # -> SkeletonPackage, SkeletonPoints, SkeletonCurve
spiral_toolpath_base_2 = SpiralToolpathBase(
    SkeletonPackage=spiral_skeleton_2.SkeletonPackage,
    SeamPoint=evaluate_surface_2.Point,
    PathWidth=Slider(30, range=0..100))  # -> ToolpathBase, ToolpathBaseCurve
brep_strip_3 = BrepStrip(SkeletonPackage=spiral_skeleton_2.SkeletonPackage, StripExtension=number_slider_7)

pi = Pi(Factor=Slider(0.34, range=0..1))
xy_plane = XYPlane(Origin=Point(0, 0, 0))
number_slider_8 = Slider(33, range=0..100)
rotate = Rotate(Geometry=xy_plane, Angle=pi, Plane=PlaneXY(0, 0, 0))  # -> Geometry, Transform
toolpathstackvertical = ToolpathStackVertical(
    ToolpathBase=spiral_toolpath_base_2.ToolpathBase,
    LayerHeight=number_slider_8,
    TotalHeight=Slider(68, range=0..1000),
    OrientOption=Toggle(False),
    ReferencePlane=rotate.Geometry)  # -> ToolpathStack, ToolpathCurve, ToolpathFrames
unpack_toolpath_stack = UnpackToolpathStack(ToolpathStack=toolpathstackvertical.ToolpathStack)  # -> ToolpathBase, ToolpathCurve, ToolpathCurves, ToolpathFrames, SurfaceSeries, SpeedFactors

number_slider_9 = Slider(0.34, range=0..1)  # disabled
pi_2 = Pi(Factor=number_slider_9)  # disabled
xy_plane_2 = XYPlane(Origin=Point(0, 0, 0))  # disabled
number_slider_10 = Slider(33, range=0..100)  # disabled
number_slider_11 = Slider(102, range=0..1000)  # disabled
boolean_toggle = BooleanToggle(False)  # disabled
rotate_2 = Rotate(Geometry=xy_plane_2, Angle=pi_2, Plane=PlaneXY(0, 0, 0))  # -> Geometry, Transform; disabled
toolpathstackvertical_2 = ToolpathStackVertical(
    ToolpathBase=spiral_toolpath_base.ToolpathBase,
    LayerHeight=number_slider_10,
    TotalHeight=number_slider_11,
    OrientOption=boolean_toggle,
    ReferencePlane=rotate_2.Geometry)  # -> ToolpathStack, ToolpathCurve, ToolpathFrames; disabled
unpack_toolpath_stack_2 = UnpackToolpathStack(ToolpathStack=toolpathstackvertical_2.ToolpathStack)  # -> ToolpathBase, ToolpathCurve, ToolpathCurves, ToolpathFrames, SurfaceSeries, SpeedFactors; disabled

curve_2 = Curve(spiral_toolpath_base_2.ToolpathBaseCurve)
offset_surface = OffsetSurface(Surface=surface_4, Distance=number_slider_8, Retrim=True)
explode = Explode(Curve=curve_2, Recursive=True)  # -> Segments, Vertices
point_4 = Point(explode.Vertices)

# ----
# radius should be small!!!
number = Number(number_slider_6)  # disabled
panel = Panel("4")  # disabled
division = Division(A=number, B=panel)  # disabled
button = Button()  # disabled
fillet_toolpath_from_toolpathstack = FilletToolpathFromToolpathStack(ToolpathStack=toolpathstackvertical_2.ToolpathStack, Radius=division, Trigger=button, SeamLengthFactor=10)  # -> Curve, ToolpathStack; disabled
curve_3 = Curve(fillet_toolpath_from_toolpathstack.Curve)  # disabled

plane = Plane(flatten(unpack_toolpath_stack.ToolpathFrames))
unpack_toolpath_stack_3 = UnpackToolpathStack(ToolpathStack=fillet_toolpath_from_toolpathstack.ToolpathStack)  # -> ToolpathBase, ToolpathCurve, ToolpathCurves, ToolpathFrames, SurfaceSeries, SpeedFactors; disabled
flip_plane = FlipPlane(Plane=plane, FlipX=False, FlipY=False, FlipZ=True)  # -> Flipped, ResultBoolean
list_length = ListLength(List=flip_plane.Flipped)
number_slider_12 = Slider(1, range=0..1)  # disabled
duplicate_data = DuplicateData(Data=Slider(0.47, range=0..1), Number=list_length, Order=True)
lin_move = LINearMovementKUKAPrc(TargetAsPlane=flip_plane.Flipped, Speed=flatten(Slider(0.55, range=0..1)), extaxenabled=False, interpolation="C_DIS")
lin_move_2 = LINearMovementKUKAPrc(TargetAsPlane=flip_plane.Flipped, Speed=duplicate_data, extaxenabled=False, interpolation="C_VEL")
toolpath_mesh = ToolpathMesh(ToolpathStack=fillet_toolpath_from_toolpathstack.ToolpathStack, Parameter=number_slider_12)  # disabled
weaverbird_s_catmull_clark_subdivision = WeaverbirdsCatmullClarkSubdivision(MeshCurves=toolpath_mesh, Level=1, SmoothNakedEdges=1)  # disabled
panel_2 = Panel(lin_move_2)
custom_preview = CustomPreview(
    Geometry=weaverbird_s_catmull_clark_subdivision,
    Material={diffuse=RGB(221, 160, 221), emission=RGB(66, 48, 66), shine=0.5, specular=RGB(255, 255, 255), transparency=0})  # disabled
panel_3 = Panel(lin_move)
