# Grasshopper definition 1103.gh (Grasshopper 1.0.7)
# plug-ins: Bifocals, BarkBeetle, Weaverbird

surface = Surface(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)
# Orthogonal Strips
brep_edges = BrepEdges(Brep=surface)  # -> Naked, Interior, NonManifold
# Can deal with UV Surfaces (UV structured points)
number_slider = Slider(10, range=0..20)
dispatch = Dispatch(List=brep_edges.Naked, DispatchPattern=[True, False])  # -> ListA, ListB
divide_curve = DivideCurve(Curve=dispatch.ListA, Count=number_slider, Kinks=False)  # -> Points, Tangents, Parameters
divide_curve_2 = DivideCurve(Curve=dispatch.ListB, Count=Slider(5, range=0..10), Kinks=False)  # -> Points, Tangents, Parameters
explode_tree = ExplodeTree(Data=divide_curve.Points)  # -> Branch0, Branch1
explode_tree_2 = ExplodeTree(Data=divide_curve_2.Points)  # -> Branch0, Branch1
reverse_list = ReverseList(List=explode_tree_2.Branch1)
reverse_list_2 = ReverseList(List=explode_tree.Branch1)
geodesic = Geodesic(Surface=surface, Start=explode_tree_2.Branch0, End=reverse_list)
geodesic_2 = Geodesic(Surface=surface, Start=explode_tree.Branch0, End=reverse_list_2)
construct_point = ConstructPoint(XCoordinate=Slider(1, range=0..1), YCoordinate=Slider(0, range=0..1), ZCoordinate=0)
curve_intersection = CurveIntersection(CurvesA=graft(geodesic_2), CurvesB=geodesic, Tolerance=Slider(1, range=0..10))  # -> simplify(IntersectionPoints)
evaluate_surface = EvaluateSurface(Surface=reparameterize(surface), Point=construct_point)  # -> Point, Normal, UDirection, VDirection, Frame

number_slider_2 = Slider(134, range=0..1000)
surface_2 = Surface(surface)
point = Point(curve_intersection)
flip_matrix = FlipMatrix(Data=point)
uv_network_on_surface = UVNetworkOnSurface(Surface=surface_2, PointsTree=point, StripWidth=number_slider_2)  # -> UVNetwork, Points, UVCurves, ExtendedSrf
uv_network_on_surface_2 = UVNetworkOnSurface(Surface=surface_2, PointsTree=flip_matrix, StripWidth=number_slider_2)  # -> UVNetwork, Points, UVCurves, ExtendedSrf
number_slider_3 = Slider(28, range=0..100)
snake_skeleton_graph = SnakeSkeletonGraph(UVNetwork=uv_network_on_surface.UVNetwork)  # -> SkeletonGraph, SkeletonPoints, MainCurve, BranchCurves, Vectors
spiral_skeleton_graph = SpiralSkeletonGraph(UVNetwork=uv_network_on_surface.UVNetwork)  # -> SkeletonGraph, SkeletonPoints, MainCurve, BranchCurves, Vectors
snake_skeleton_graph_2 = SnakeSkeletonGraph(UVNetwork=uv_network_on_surface_2.UVNetwork)  # -> SkeletonGraph, SkeletonPoints, MainCurve, BranchCurves, Vectors
brep_strip = BrepStrip(UVNetwork=uv_network_on_surface.UVNetwork, StripExtension=Slider(69, range=0..100), StripWidth=number_slider_2)
spiral_toolpath_pattern = SpiralToolpathPattern(SkeletonGraph=spiral_skeleton_graph.SkeletonGraph, SeamPoint=Point(0, 0, 0), PathWidth=number_slider_3)  # -> ToolpathPattern, Curve
spiral_toolpath_pattern_2 = SpiralToolpathPattern(
    SkeletonGraph=graft([snake_skeleton_graph_2.SkeletonGraph, snake_skeleton_graph.SkeletonGraph]),
    SeamPoint=Point(0, 0, 0),
    PathWidth=number_slider_3)  # -> flatten(ToolpathPattern), Curve
stack_toolpath_pattern = StackToolpathPattern(MainPattern=spiral_toolpath_pattern_2.ToolpathPattern, BottomCount=0, TopCount=0)
toolpath_stack_vertical = ToolpathStackVertical(
    StackPatterns=stack_toolpath_pattern,
    LayerHeight=Slider(20, range=0..100),
    TotalHeight=Slider(40, range=0..100),
    OrientOption=Toggle(False),
    ReferencePoint=Point(0, 0, 0),
    PlaneRotateAngle=0)  # -> ToolpathStack, ToolpathCurve, ToolpathFrames
fillet_toolpath_from_toolpathstack = FilletToolpathFromToolpathStack(
    ToolpathStack=toolpath_stack_vertical.ToolpathStack,
    Radius=Slider(6, range=0..10),
    Trigger=Button(),
    SeamLengthFactor="0")  # -> Curve, ToolpathStack
unpack_toolpath_stack = UnpackToolpathStack(ToolpathStack=fillet_toolpath_from_toolpathstack.ToolpathStack)  # -> ToolpathCurve, ToolpathCurves, ToolpathFrames, SurfaceSeries, SpeedFactors
toolpath_mesh = ToolpathMesh(ToolpathStack=fillet_toolpath_from_toolpathstack.ToolpathStack, Parameter=1)
weaverbird_s_catmull_clark_subdivision = WeaverbirdsCatmullClarkSubdivision(MeshCurves=toolpath_mesh, Level=1, SmoothNakedEdges=1)
point_2 = Point(unpack_toolpath_stack.ToolpathFrames)
custom_preview = CustomPreview(
    Geometry=weaverbird_s_catmull_clark_subdivision,
    Material={diffuse=RGB(221, 160, 221), emission=RGB(66, 48, 66), shine=0.5, specular=RGB(255, 255, 255), transparency=0})
