# Grasshopper definition 1106_examples.gh (Grasshopper 1.0.7)
# plug-ins: BarkBeetle

surface = Surface(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)
bounding_box = BoundingBox(Content=surface, Plane=PlaneXY(0, 0, 0))  # -> Box, Box_2

surface_2 = Surface(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)
# Can deal with UV Surfaces (UV structured points)
# Orthogonal Strips
brep_edges = BrepEdges(Brep=surface_2)  # -> Naked, Interior, NonManifold
dispatch = Dispatch(List=brep_edges.Naked, DispatchPattern=[True, False])  # -> ListA, ListB
divide_curve = DivideCurve(Curve=dispatch.ListA, Count=Slider(12, range=0..20), Kinks=False)  # -> Points, Tangents, Parameters
divide_curve_2 = DivideCurve(Curve=dispatch.ListB, Count=Slider(6, range=0..10), Kinks=False)  # -> Points, Tangents, Parameters
explode_tree = ExplodeTree(Data=divide_curve.Points)  # -> Branch0, Branch1
explode_tree_2 = ExplodeTree(Data=divide_curve_2.Points)  # -> Branch0, Branch1
reverse_list = ReverseList(List=explode_tree_2.Branch1)
reverse_list_2 = ReverseList(List=explode_tree.Branch1)
geodesic = Geodesic(Surface=surface_2, Start=explode_tree_2.Branch0, End=reverse_list)
geodesic_2 = Geodesic(Surface=surface_2, Start=explode_tree.Branch0, End=reverse_list_2)
curve_intersection = CurveIntersection(CurvesA=graft(geodesic_2), CurvesB=geodesic, Tolerance=Slider(1, range=0..10))  # -> simplify(IntersectionPoints)

# ----
# Ring Surface: Need to deal with edges?
surface_3 = Surface(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)

surface_4 = Surface(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)
brep_edges_2 = BrepEdges(Brep=surface_4)  # -> Naked, Interior, NonManifold
# Orthogonal Strips: unequal distance
number_slider = Slider(12, range=0..20)
dispatch_2 = Dispatch(List=brep_edges_2.Naked, DispatchPattern=[True, False])  # -> ListA, ListB
range = Range(Domain=Domain(0, 1), Steps=expr("x-1", number_slider))
list_item = ListItem(List=dispatch_2.ListB, Index=0, Wrap=True)  # -> Item, Item1
list_item_2 = ListItem(List=dispatch_2.ListA, Index=0, Wrap=True)  # -> Item, Item1
range_2 = Range(Domain=Domain(0, 1), Steps=expr("x-1", Slider(6, range=0..10)))
flip_curve = FlipCurve(Curve=list_item.Item1)  # -> Curve, Flag
flip_curve_2 = FlipCurve(Curve=list_item_2.Item1)  # -> Curve, Flag
graph_mapper = GraphMapper(
    range_2,
    x0=0,
    x1=1,
    y0=0,
    y1=1,
    container_name="Bezier",
    cpx=[0, 0.134739548, 0.4871794879, 1],
    cpy=[1, 0.4782661796, 0.4275362492, 0])
graph_mapper_2 = GraphMapper(
    range,
    x0=0,
    x1=1,
    y0=0,
    y1=1,
    container_name="Bezier",
    cpx=[0, 0.1355626136, 0.5465503931, 1],
    cpy=[0, 0.5468449593, 0.6515547037, 1])
merge = Merge(Data1=list_item.Item, Data2=flip_curve.Curve)
merge_2 = Merge(Data1=list_item_2.Item, Data2=flip_curve_2.Curve)
evaluate_curve = EvaluateCurve(Curve=reparameterize(graft(merge)), Parameter=graph_mapper)  # -> Point, Tangent, Angle
evaluate_curve_2 = EvaluateCurve(Curve=reparameterize(graft(merge_2)), Parameter=graph_mapper_2)  # -> Point, Tangent, Angle
explode_tree_3 = ExplodeTree(Data=evaluate_curve.Point)  # -> Branch0, Branch1
explode_tree_4 = ExplodeTree(Data=evaluate_curve_2.Point)  # -> Branch0, Branch1
geodesic_3 = Geodesic(Surface=surface_4, Start=explode_tree_3.Branch0, End=explode_tree_3.Branch1)
geodesic_4 = Geodesic(Surface=surface_4, Start=explode_tree_4.Branch0, End=explode_tree_4.Branch1)
curve_intersection_2 = CurveIntersection(CurvesA=graft(geodesic_4), CurvesB=geodesic_3, Tolerance=Slider(1, range=0..10))  # -> simplify(IntersectionPoints)

# ----
# Simple Surface: Need to have a more simple skeleton and workflow
volume = Volume(Geometry=bounding_box.Box)  # -> Volume, Centroid
number_slider_2 = Slider(130, range=0..1000)
divide_surface = DivideSurface(Surface=surface_3, UCount=Slider(3, range=0..10), VCount=Slider(16, range=0..100))  # -> Points, Normals, Parameters
scale = Scale(Geometry=surface, Center=volume.Centroid, Factor=0.5)  # -> Geometry, Transform
divide_surface_2 = DivideSurface(Surface=scale.Geometry, UCount=Slider(1, range=0..10), VCount=Slider(1, range=0..100))  # -> Points, Normals, Parameters

uv_network_on_surface = UVNetworkOnSurface(Surface=surface_3, PointsTree=divide_surface.Points, StripWidth=Slider(143, range=0..1000))  # -> UVNetwork, Points, UVCurves, ExtendedSrf
snake_skeleton_graph = SnakeSkeletonGraph(UVNetwork=uv_network_on_surface.UVNetwork)  # -> SkeletonGraph, SkeletonPoints, MainCurve, BranchCurves, Vectors
spiral_toolpath_pattern = SpiralToolpathPattern(SkeletonGraph=snake_skeleton_graph.SkeletonGraph, SeamPoint=Point(0, 0, 0), PathWidth=Slider(30, range=0..100))  # -> ToolpathPattern, Curve
stack_toolpath_pattern = StackToolpathPattern(MainPattern=spiral_toolpath_pattern.ToolpathPattern, BottomCount=0, TopCount=0)
toolpath_stack_vertical = ToolpathStackVertical(
    StackPatterns=stack_toolpath_pattern,
    LayerHeight=Slider(30, range=0..100),
    TotalHeight=Slider(90, range=0..1000),
    OrientOption=True,
    ReferencePoint=Point(0, 0, 0),
    PlaneRotateAngle=0)  # -> ToolpathStack, ToolpathCurve, ToolpathPlanes

uv_network_on_surface_2 = UVNetworkOnSurface(Surface=scale.Geometry, PointsTree=divide_surface_2.Points, StripWidth=Slider(725, range=0..10000))  # -> UVNetwork, Points, UVCurves, ExtendedSrf
snake_skeleton_graph_2 = SnakeSkeletonGraph(UVNetwork=uv_network_on_surface_2.UVNetwork)  # -> SkeletonGraph, SkeletonPoints, MainCurve, BranchCurves, Vectors
spiral_toolpath_pattern_2 = SpiralToolpathPattern(SkeletonGraph=snake_skeleton_graph_2.SkeletonGraph, SeamPoint=Point(0, 0, 0), PathWidth=Slider(30, range=0..100))  # -> ToolpathPattern, Curve
stack_toolpath_pattern_2 = StackToolpathPattern(MainPattern=spiral_toolpath_pattern_2.ToolpathPattern, BottomCount=0, TopCount=0)
toolpath_stack_vertical_2 = ToolpathStackVertical(
    StackPatterns=stack_toolpath_pattern_2,
    LayerHeight=Slider(30, range=0..100),
    TotalHeight=Slider(90, range=0..1000),
    OrientOption=True,
    ReferencePoint=Point(0, 0, 0),
    PlaneRotateAngle=0)  # -> ToolpathStack, ToolpathCurve, ToolpathPlanes

point = Point(curve_intersection)
surface_5 = Surface(surface_2)

uv_network_on_surface_3 = UVNetworkOnSurface(Surface=surface_5, PointsTree=point, StripWidth=Slider(143, range=0..1000))  # -> UVNetwork, Points, UVCurves, ExtendedSrf
snake_skeleton_graph_3 = SnakeSkeletonGraph(UVNetwork=uv_network_on_surface_3.UVNetwork)  # -> SkeletonGraph, SkeletonPoints, MainCurve, BranchCurves, Vectors
spiral_toolpath_pattern_3 = SpiralToolpathPattern(SkeletonGraph=snake_skeleton_graph_3.SkeletonGraph, SeamPoint=Point(0, 0, 0), PathWidth=Slider(30, range=0..100))  # -> ToolpathPattern, Curve
stack_toolpath_pattern_3 = StackToolpathPattern(MainPattern=spiral_toolpath_pattern_3.ToolpathPattern, BottomCount=0, TopCount=0)
toolpath_stack_vertical_3 = ToolpathStackVertical(
    StackPatterns=stack_toolpath_pattern_3,
    LayerHeight=Slider(30, range=0..100),
    TotalHeight=Slider(90, range=0..1000),
    OrientOption=True,
    ReferencePoint=Point(0, 0, 0),
    PlaneRotateAngle=0)  # -> ToolpathStack, ToolpathCurve, ToolpathPlanes

point_2 = Point(curve_intersection_2)
surface_6 = Surface(surface_4)

uv_network_on_surface_4 = UVNetworkOnSurface(Surface=surface_6, PointsTree=point_2, StripWidth=Slider(143, range=0..1000))  # -> UVNetwork, Points, UVCurves, ExtendedSrf
snake_skeleton_graph_4 = SnakeSkeletonGraph(UVNetwork=uv_network_on_surface_4.UVNetwork)  # -> SkeletonGraph, SkeletonPoints, MainCurve, BranchCurves, Vectors
spiral_toolpath_pattern_4 = SpiralToolpathPattern(SkeletonGraph=snake_skeleton_graph_4.SkeletonGraph, SeamPoint=Point(0, 0, 0), PathWidth=Slider(30, range=0..100))  # -> ToolpathPattern, Curve
stack_toolpath_pattern_4 = StackToolpathPattern(MainPattern=spiral_toolpath_pattern_4.ToolpathPattern, BottomCount=0, TopCount=0)
toolpath_stack_vertical_4 = ToolpathStackVertical(
    StackPatterns=stack_toolpath_pattern_4,
    LayerHeight=Slider(30, range=0..100),
    TotalHeight=Slider(90, range=0..1000),
    OrientOption=True,
    ReferencePoint=Point(0, 0, 0),
    PlaneRotateAngle=0)  # -> ToolpathStack, ToolpathCurve, ToolpathPlanes

surface_7 = Surface(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)
# Non-UV points:
# Need to find an effective way to get the Skeleton
# (connecting all points without intersection, maybe there are some
# existing algorithm that may help, but out of scope for now)
brep_edges_3 = BrepEdges(Brep=surface_7)  # -> Naked, Interior, NonManifold
number_slider_3 = Slider(2, range=0..10)
dispatch_3 = Dispatch(List=brep_edges_3.Naked, DispatchPattern=[True, False])  # -> ListA, ListB
divide_curve_3 = DivideCurve(Curve=reverse(dispatch_3.ListB), Count=number_slider_3, Kinks=False)  # -> Points, Tangents, Parameters
divide_curve_4 = DivideCurve(Curve=dispatch_3.ListA, Count=Slider(7, range=0..20), Kinks=False)  # -> Points, Tangents, Parameters
divide_curve_5 = DivideCurve(Curve=dispatch_3.ListB, Count=number_slider_3, Kinks=False)  # -> Points, Tangents, Parameters
cull_index = CullIndex(List=divide_curve_4.Points, Indices=[-1, 0], Wrap=True)
merge_3 = Merge(Data1=simplify(divide_curve_3.Points), Data2=simplify(cull_index))
merge_4 = Merge(Data1=simplify(cull_index), Data2=simplify(divide_curve_5.Points))
cull_index_2 = CullIndex(List=merge_3, Indices="0", Wrap=True)
cull_index_3 = CullIndex(List=merge_4, Indices="-1", Wrap=True)
explode_tree_5 = ExplodeTree(Data=cull_index_2)  # -> Branch0, Branch1
explode_tree_6 = ExplodeTree(Data=cull_index_3)  # -> Branch0, Branch1
reverse_list_3 = ReverseList(List=explode_tree_5.Branch0)
reverse_list_4 = ReverseList(List=explode_tree_6.Branch0)
geodesic_5 = Geodesic(Surface=surface_7, Start=reverse_list_3, End=explode_tree_5.Branch1)
geodesic_6 = Geodesic(Surface=surface_7, Start=reverse_list_4, End=explode_tree_6.Branch1)
curve_intersection_3 = CurveIntersection(CurvesA=graft(geodesic_6), CurvesB=geodesic_5, Tolerance=Slider(1, range=0..10))  # -> simplify(IntersectionPoints)

surface_8 = Surface(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)
brep_edges_4 = BrepEdges(Brep=surface_8)  # -> Naked, Interior, NonManifold
number_slider_4 = Slider(2, range=0..10)
dispatch_4 = Dispatch(List=brep_edges_4.Naked, DispatchPattern=[True, False])  # -> ListA, ListB
divide_curve_6 = DivideCurve(Curve=reverse(dispatch_4.ListB), Count=number_slider_4, Kinks=False)  # -> Points, Tangents, Parameters
divide_curve_7 = DivideCurve(Curve=dispatch_4.ListA, Count=Slider(4, range=0..20), Kinks=False)  # -> Points, Tangents, Parameters
divide_curve_8 = DivideCurve(Curve=dispatch_4.ListB, Count=number_slider_4, Kinks=False)  # -> Points, Tangents, Parameters
cull_index_4 = CullIndex(List=divide_curve_7.Points, Indices=[-1, 0], Wrap=True)
merge_5 = Merge(Data1=simplify(divide_curve_6.Points), Data2=simplify(cull_index_4))
merge_6 = Merge(Data1=simplify(cull_index_4), Data2=simplify(divide_curve_8.Points))
cull_index_5 = CullIndex(List=merge_5, Indices="0", Wrap=True)
cull_index_6 = CullIndex(List=merge_6, Indices="-1", Wrap=True)
explode_tree_7 = ExplodeTree(Data=cull_index_5)  # -> Branch0, Branch1
explode_tree_8 = ExplodeTree(Data=cull_index_6)  # -> Branch0, Branch1
reverse_list_5 = ReverseList(List=explode_tree_8.Branch0)
reverse_list_6 = ReverseList(List=explode_tree_7.Branch0)
jitter = Jitter(List=reverse_list_5, Jitter=1, Seed=Slider(2, range=0..10))  # -> Values, Indices
jitter_2 = Jitter(List=reverse_list_6, Jitter=1, Seed=Slider(2, range=0..10))  # -> Values, Indices
jitter_3 = Jitter(List=explode_tree_8.Branch1, Jitter=1, Seed=Slider(0, range=0..10))  # -> Values, Indices
jitter_4 = Jitter(List=explode_tree_7.Branch1, Jitter=1, Seed=Slider(7, range=0..10))  # -> Values, Indices
geodesic_7 = Geodesic(Surface=surface_8, Start=jitter.Values, End=jitter_3.Values)
geodesic_8 = Geodesic(Surface=surface_8, Start=jitter_2.Values, End=jitter_4.Values)
multiple_curves = MultipleCurves(Curves=[geodesic_7, geodesic_8])  # -> Points, IndexA, IndexB, ParamA, ParamB

surface_9 = Surface(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)
# Non-orthogonal Strips
brep_edges_5 = BrepEdges(Brep=surface_9)  # -> Naked, Interior, NonManifold
dispatch_5 = Dispatch(List=brep_edges_5.Naked, DispatchPattern=[True, False])  # -> ListA, ListB
range_3 = Range(Domain=Domain(0, 1), Steps=expr("x-1", Slider(12, range=0..20)))
range_4 = Range(Domain=Domain(0, 1), Steps=expr("x-1", Slider(5, range=0..10)))
graph_mapper_3 = GraphMapper(
    range_3,
    x0=0,
    x1=1,
    y0=0,
    y1=1,
    container_name="Bezier",
    cpx=[0, 0.2702096999, 0.4993940592, 1],
    cpy=[0, 0.4460856318, 0.8310263753, 1])
graph_mapper_4 = GraphMapper(
    range_4,
    x0=0,
    x1=1,
    y0=0,
    y1=1,
    container_name="Bezier",
    cpx=[0, 0.2774043381, 0.4957600832, 1],
    cpy=[0, 0.4297087193, 0.7768236399, 1])
evaluate_curve_3 = EvaluateCurve(Curve=reparameterize(graft(dispatch_5.ListA)), Parameter=graph_mapper_3)  # -> Point, Tangent, Angle
explode_tree_9 = ExplodeTree(Data=evaluate_curve_3.Point)  # -> Branch0, Branch1
reverse_list_7 = ReverseList(List=explode_tree_9.Branch1)
geodesic_9 = Geodesic(Surface=surface_9, Start=explode_tree_9.Branch0, End=reverse_list_7)

evaluate_curve_4 = EvaluateCurve(Curve=reparameterize(graft(dispatch_5.ListB)), Parameter=graph_mapper_4)  # -> Point, Tangent, Angle

explode_tree_10 = ExplodeTree(Data=evaluate_curve_4.Point)  # -> Branch0, Branch1
reverse_list_8 = ReverseList(List=explode_tree_10.Branch1)
geodesic_10 = Geodesic(Surface=surface_9, Start=explode_tree_10.Branch0, End=reverse_list_8)
curve_intersection_4 = CurveIntersection(CurvesA=graft(geodesic_9), CurvesB=geodesic_10, Tolerance=Slider(1, range=0..10))  # -> simplify(IntersectionPoints)

point_3 = Point(curve_intersection_4)
surface_10 = Surface(surface_9)

uv_network_on_surface_5 = UVNetworkOnSurface(Surface=surface_10, PointsTree=point_3, StripWidth=Slider(143, range=0..1000))  # -> UVNetwork, Points, UVCurves, ExtendedSrf
snake_skeleton_graph_5 = SnakeSkeletonGraph(UVNetwork=uv_network_on_surface_5.UVNetwork)  # -> SkeletonGraph, SkeletonPoints, MainCurve, BranchCurves, Vectors
spiral_toolpath_pattern_5 = SpiralToolpathPattern(SkeletonGraph=snake_skeleton_graph_5.SkeletonGraph, SeamPoint=Point(0, 0, 0), PathWidth=Slider(30, range=0..100))  # -> ToolpathPattern, Curve
stack_toolpath_pattern_5 = StackToolpathPattern(MainPattern=spiral_toolpath_pattern_5.ToolpathPattern, BottomCount=0, TopCount=0)
toolpath_stack_vertical_5 = ToolpathStackVertical(
    StackPatterns=stack_toolpath_pattern_5,
    LayerHeight=Slider(30, range=0..100),
    TotalHeight=Slider(90, range=0..1000),
    OrientOption=True,
    ReferencePoint=Point(0, 0, 0),
    PlaneRotateAngle=0)  # -> ToolpathStack, ToolpathCurve, ToolpathPlanes
