# Grasshopper definition 1116 unroll.gh (Grasshopper 1.0.8)
# plug-ins: RhinoCodePluginGH

number_slider = Slider(123, range=0..1000)
crv = Curve(Tree({0}: [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], {1}: [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]))
ext = ExtendCurve(Curve=crv, Type=0, Start=number_slider, End=number_slider)
bang = ExplodeTree(Data=ext)  # -> Branch0, Branch1
crv_2 = Curve([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])
number_slider_2 = Slider(106, range=0..1000)
number_slider_3 = Slider(106, range=0..1000)
crv_3 = Curve(ext)
c_script = CSharpScript(
    curves=flatten(crv_3),
    tolerance=Slider(0.01, range=0..0.01),
    width=Slider(100, range=0..1000),
    distance=Slider(100, range=0..100),
    hole_radius=Slider(20, range=0..100),
    font_size=Slider(40, range=0..100))  # -> out, rectangles, points, holes, indicesOnCurve, indicesOnPlane; inputs curves: list of Curve, tolerance: Double, width: Double, distance: Double, hole_radius: Double, font_size: Double
# ---------- c_script: C# ----------
// Grasshopper Script Instance
#region Usings
using System;
using System.Linq;
using System.Collections;
using System.Collections.Generic;
using System.Drawing;

using Rhino;
using Rhino.Geometry;

using Grasshopper;
using Grasshopper.Kernel;
using Grasshopper.Kernel.Data;
using Grasshopper.Kernel.Types;
#endregion

public class Script_Instance : GH_ScriptInstance
{
    #region Notes
    /* 
      Members:
        RhinoDoc RhinoDocument
        GH_Document GrasshopperDocument
        IGH_Component Component
        int Iteration

      Methods (Virtual & overridable):
        Print(string text)
        Print(string format, params object[] args)
        Reflect(object obj)
        Reflect(object obj, string method_name)
    */
    #endregion

    private void RunScript(
	List<Curve> curves,
	double tolerance,
	double width,
	double distance,
	double hole_radius,
	double font_size,
	ref object rectangles,
	ref object points,
	ref object holes,
	ref object indicesOnCurve,
	ref object indicesOnPlane)
    {
        // 初始化结果
        var rectanglesList = new List<Polyline>();
        var pointsList = new DataTree<Point3d>();
        var holesList = new DataTree<Circle>();
        var indicesTextOnCurve = new List<Curve>(); // 空间曲线上的文字
        var indicesTextOnPlane = new List<Curve>(); // 平面上的文字

        // 初始化全局交点序号
        int intersectionIndex = 0;

        // 初始化 Y 轴偏移
        double yOffset = -width / 2;

        // 第一轮循环：绘制矩形和标注曲线名称
        for (int i = 0; i < curves.Count; i++)
        {
            Curve curve = curves[i];
            double length = curve.GetLength();

            // 标号 -- 空间曲线上的标注
            TextEntity textEntityCurve = new TextEntity
            {
                Plane = new Plane(curve.PointAtStart, new Vector3d(0, 0, 1)),
                PlainText = "Crv_" + i.ToString(),
                TextHeight = font_size,
                Justification = TextJustification.Middle
            };

            Curve[] textCurvesOnCurve = textEntityCurve.Explode();
            foreach (Curve crv in textCurvesOnCurve)
            {
                indicesTextOnCurve.Add(crv);
            }

            // 创建拉直的矩形长条
            Line baseLine = new Line(new Point3d(0, yOffset, 0), new Point3d(length, yOffset, 0));
            Polyline rect = CreateRectangle(baseLine, width);
            rectanglesList.Add(rect);

            // 标号 -- 平面上的标注
            TextEntity textEntityPlane = new TextEntity
            {
                Plane = new Plane(new Point3d(-distance, yOffset, 0), new Vector3d(0, 0, 1)),
                PlainText = "Crv_" + i.ToString(),
                TextHeight = font_size,
                Justification = TextJustification.Right
            };

            Curve[] textCurvesOnPlane = textEntityPlane.Explode();
            foreach (Curve crv in textCurvesOnPlane)
            {
                indicesTextOnPlane.Add(crv);
            }

            yOffset -= distance + width; // 更新下一个矩形的间隔
        }

        // 第二轮循环：计算交点并绘制点和标注
        for (int i = 0; i < curves.Count; i++)
        {
            Curve curveA = curves[i];
            double lengthA = curveA.GetLength();

            GH_Path pathA = new GH_Path(i);

            for (int j = i + 1; j < curves.Count; j++) // 避免重复计算
            {
                Curve curveB = curves[j];
                double lengthB = curveB.GetLength();

                GH_Path pathB = new GH_Path(j);

                // 求交点
                var intersections = Rhino.Geometry.Intersect.Intersection.CurveCurve(curveA, curveB, tolerance, tolerance);

                if (intersections != null)
                {
                    foreach (var intersection in intersections)
                    {
                        Point3d pt = intersection.PointA;

                        // 获取在曲线 A 上的参数和长度
                        double paramA = intersection.ParameterA;
                        Interval domainA = new Interval(curveA.Domain.Min, paramA);
                        double lengthAOnCurve = curveA.GetLength(domainA);

                        // 获取在曲线 B 上的参数和长度
                        double paramB = intersection.ParameterB;
                        Interval domainB = new Interval(curveB.Domain.Min, paramB);
                        double lengthBOnCurve = curveB.GetLength(domainB);

                        // 在矩形长条上生成点
                        Point3d pointA = new Point3d(lengthAOnCurve, -width / 2 - i * (distance + width), 0);
                        Circle circleA = new Circle(pointA, hole_radius);
                        pointsList.Add(pointA, pathA);
                        holesList.Add(circleA, pathA);

                        Point3d pointB = new Point3d(lengthBOnCurve, -width / 2 - j * (distance + width), 0);
                        Circle circleB = new Circle(pointB, hole_radius);
                        pointsList.Add(pointB, pathB);
                        holesList.Add(circleB, pathB);

                        // 标注点序号
                        TextEntity textEntityA = new TextEntity
                        {
                            Plane = new Plane(pointA + new Vector3d(hole_radius, 0, 0), new Vector3d(0, 0, 1)),
                            PlainText = intersectionIndex.ToString(),
                            TextHeight = font_size,
                            Justification = TextJustification.Left
                        };

                        Curve[] textCurvesA = textEntityA.Explode();
                        foreach (Curve crv in textCurvesA)
                        {
                            indicesTextOnPlane.Add(crv);
                        }

                        TextEntity textEntityB = new TextEntity
                        {
                            Plane = new Plane(pointB + new Vector3d(hole_radius, 0, 0), new Vector3d(0, 0, 1)),
                            PlainText = intersectionIndex.ToString(),
                            TextHeight = font_size,
                            Justification = TextJustification.Left
                        };

                        Curve[] textCurvesB = textEntityB.Explode();
                        foreach (Curve crv in textCurvesB)
                        {
                            indicesTextOnPlane.Add(crv);
                        }

                        TextEntity textEntityCurve = new TextEntity
                        {
                            Plane = new Plane(pt, new Vector3d(0, 0, 1)),
                            PlainText = intersectionIndex.ToString(),
                            TextHeight = font_size,
                            Justification = TextJustification.Left
                        };

                        Curve[] textCurvesOnCurve = textEntityCurve.Explode();
                        foreach (Curve crv in textCurvesOnCurve)
                        {
                            indicesTextOnCurve.Add(crv);
                        }

                        // 更新全局交点序号
                        intersectionIndex++;
                    }
                }
            }
        }

        // 输出结果
        rectangles = rectanglesList;
        points = pointsList;
        holes = holesList;
        indicesOnCurve = indicesTextOnCurve;
        indicesOnPlane = indicesTextOnPlane;

    }

    // 用于生成矩形长条的辅助函数
    private Polyline CreateRectangle(Line baseLine, double width)
    {
        double halfWidth = width / 2.0;

        // 矩形的四个顶点
        Point3d pt1 = baseLine.From + new Vector3d(0, -halfWidth, 0);
        Point3d pt2 = baseLine.To + new Vector3d(0, -halfWidth, 0);
        Point3d pt3 = baseLine.To + new Vector3d(0, halfWidth, 0);
        Point3d pt4 = baseLine.From + new Vector3d(0, halfWidth, 0);

        // 创建矩形
        Polyline rectangle = new Polyline(new List<Point3d> { pt1, pt2, pt3, pt4, pt1 });
        return rectangle;
    }
}
# ---------- end c_script ----------
c_script_2 = CSharpScript(
    curvesA=bang.Branch0,
    curvesB=bang.Branch1,
    tolerance=Slider(0.01, range=0..0.01),
    widthA=Slider(73, range=0..1000),
    widthB=Slider(122, range=0..1000),
    distance=Slider(100, range=0..100),
    hole_radius=Slider(11, range=0..100),
    font_size=Slider(20, range=0..100))  # -> out, rectangleA, rectangleB, pointsA, pointsB, holesA, holesB, indicesA, indicesB, indices; inputs curvesA: list of Curve, curvesB: list of Curve, tolerance: Double, widthA: Double, widthB: Double, distance: Double, hole_radius: Double, font_size: Double
# ---------- c_script_2: C# ----------
// Grasshopper Script Instance
#region Usings
using System;
using System.Linq;
using System.Collections;
using System.Collections.Generic;
using System.Drawing;

using Rhino;
using Rhino.Geometry;

using Grasshopper;
using Grasshopper.Kernel;
using Grasshopper.Kernel.Data;
using Grasshopper.Kernel.Types;
#endregion

public class Script_Instance : GH_ScriptInstance
{
    #region Notes
    /* 
      Members:
        RhinoDoc RhinoDocument
        GH_Document GrasshopperDocument
        IGH_Component Component
        int Iteration

      Methods (Virtual & overridable):
        Print(string text)
        Print(string format, params object[] args)
        Reflect(object obj)
        Reflect(object obj, string method_name)
    */
    #endregion

    private void RunScript(
	List<Curve> curvesA,
	List<Curve> curvesB,
	double tolerance,
	double widthA,
	double widthB,
	double distance,
	double hole_radius,
	double font_size,
	ref object rectangleA,
	ref object rectangleB,
	ref object pointsA,
	ref object pointsB,
	ref object holesA,
	ref object holesB,
	ref object indicesA,
	ref object indicesB,
	ref object indices)
    {
        // 初始化结果
        var rectanglesOnA = new List<Polyline>();
        var rectanglesOnB = new List<Polyline>();
        var pointsOnA = new DataTree<Point3d>();
        var pointsOnB = new DataTree<Point3d>();
        
        var indicesTextA = new List<Curve>();
        var indicesTextB = new List<Curve>();
        var originIndicesText = new List<Curve>();

        var circlesA = new DataTree<Circle>();
        var circlesB = new DataTree<Circle>();

        // 初始化全局交点序号
        int intersectionIndex = 0;

        // 初始化Y轴偏移
        double yOffsetA = -widthA / 2;
        

        for (int i = 0; i < curvesA.Count; i++)
        {
            Curve curveA = curvesA[i];
            double lengthA = curveA.GetLength();

            //标号 -- 曲面
            TextEntity textEntityCurveA = new TextEntity
            {
                Plane = new Plane(curveA.PointAtStart, new Vector3d(0, 0, 1)),
                PlainText = "Crv_A" + i.ToString(),
                TextHeight = font_size,
                Justification = TextJustification.Middle
            };

            Curve[] textCurvesOnCurveA= textEntityCurveA.Explode();
            foreach (Curve crv in textCurvesOnCurveA){
                originIndicesText.Add(crv);
            }

            // 创建拉直的矩形长条（A组）
            Line baseLineA = new Line(new Point3d(0, yOffsetA, 0), new Point3d(lengthA, yOffsetA, 0));
            Polyline rectA = CreateRectangle(baseLineA, widthA);
            rectanglesOnA.Add(rectA);
            GH_Path pathA = new GH_Path(i);

            //标号 -- 平面
            TextEntity textEntityCurvePlaneA = new TextEntity
            {
                Plane = new Plane(new Point3d(-distance, yOffsetA, 0), new Vector3d(0, 0, 1)),
                PlainText = "Crv_A" + i.ToString(),
                TextHeight = font_size,
                Justification = TextJustification.Right
            };

            Curve[] textCurvesOnCurvePlaneA= textEntityCurvePlaneA.Explode();
            foreach (Curve crv in textCurvesOnCurvePlaneA){
                indicesTextA.Add(crv);
            }

            double yOffsetB = widthB / 2 + distance;

            for (int j = 0; j < curvesB.Count; j++)
            {
                Curve curveB = curvesB[j];
                if (i == 0) // 只处理一次矩形B的生成
                {
                    double lengthB = curveB.GetLength();
                    
                    // 在原来曲线上标号
                    TextEntity textEntityCurveB = new TextEntity
                    {
                        Plane = new Plane(curveB.PointAtStart, new Vector3d(0, 0, 1)),
                        PlainText = "Crv_B" + j.ToString(),
                        TextHeight = font_size,
                        Justification = TextJustification.Middle
                    };

                    Curve[] textCurvesOnCurveB = textEntityCurveB.Explode();
                    foreach (Curve crv in textCurvesOnCurveB){
                        originIndicesText.Add(crv);
                    }

                    // 创建拉直的矩形长条（B组）
                    Line baseLineB = new Line(new Point3d(0, yOffsetB, 0), new Point3d(lengthB, yOffsetB, 0));
                    Polyline rectB = CreateRectangle(baseLineB, widthB);
                    rectanglesOnB.Add(rectB);

                    //标号 -- 平面
                    TextEntity textEntityCurvePlaneB = new TextEntity
                    {
                        Plane = new Plane(new Point3d(-distance, yOffsetB, 0), new Vector3d(0, 0, 1)),
                        PlainText = "Crv_B" + j.ToString(),
                        TextHeight = font_size,
                        Justification = TextJustification.Right
                    };

                    Curve[] textCurvesOnCurvePlaneB= textEntityCurvePlaneB.Explode();
                    foreach (Curve crv in textCurvesOnCurvePlaneB){
                        indicesTextB.Add(crv);
                    }
                }

                GH_Path pathB = new GH_Path(j);

                // 求交点
                var intersections = Rhino.Geometry.Intersect.Intersection.CurveCurve(curveA, curveB, tolerance, tolerance);

                if (intersections != null)
                {
                    foreach (var intersection in intersections)
                    {
                        Point3d pt = intersection.PointA;

                        TextEntity textEntityOriginal = new TextEntity
                        {
                            Plane = new Plane(pt + new Vector3d(hole_radius,0,0), new Vector3d(0, 0, 1)),
                            PlainText = intersectionIndex.ToString(),
                            TextHeight = font_size,
                            Justification = TextJustification.Left // 左对齐
                        };

                        Curve[] textCurvesOriginal = textEntityOriginal.Explode();
                        foreach (Curve crv in textCurvesOriginal){
                            originIndicesText.Add(crv);
                        }


                        // 获取在曲线A上的参数和长度
                        double paramA = intersection.ParameterA;
                        Interval domainA = new Interval(curveA.Domain.Min, paramA);
                        double lengthAOnCurve = curveA.GetLength(domainA);

                        // 获取在曲线B上的参数和长度
                        double paramB = intersection.ParameterB;
                        Interval domainB = new Interval(curveB.Domain.Min, paramB);
                        double lengthBOnCurve = curveB.GetLength(domainB);

                        // 在矩形长条上生成点
                        Point3d pointA = new Point3d(lengthAOnCurve, yOffsetA, 0);
                        Circle circleA = new Circle(pointA , hole_radius);
                        Point3d pointB = new Point3d(lengthBOnCurve, yOffsetB, 0);
                        Circle circleB = new Circle(pointB , hole_radius);

                        // 添加点到结果
                        pointsOnA.Add(pointA, pathA);
                        pointsOnB.Add(pointB, pathB);
                        circlesA.Add(circleA, pathA);
                        circlesB.Add(circleB, pathB);


                        // 添加序号为Text
                        TextEntity textEntityA = new TextEntity
                        {
                            Plane = new Plane(pointA + new Vector3d(hole_radius,0,0), new Vector3d(0, 0, 1)),
                            PlainText = intersectionIndex.ToString(),
                            TextHeight = font_size,
                            Justification = TextJustification.Left // 左对齐
                        };

                        TextEntity textEntityB = new TextEntity
                        {
                            Plane = new Plane(pointB + new Vector3d(hole_radius,0,0), new Vector3d(0, 0, 1)),
                            PlainText = intersectionIndex.ToString(),
                            TextHeight = font_size,
                            Justification = TextJustification.Left // 左对齐
                        };

                        Curve[] textCurvesA = textEntityA.Explode();
                        foreach (Curve crv in textCurvesA){
                            indicesTextA.Add(crv);
                        }

                        Curve[] textCurvesB = textEntityB.Explode();
                        foreach (Curve crv in textCurvesB){
                            indicesTextB.Add(crv);
                        }

                        // 更新全局交点序号
                        intersectionIndex++;
                    }
                }
                yOffsetB += distance + widthB;
            }

            yOffsetA -= distance + widthA; // 更新A组下一个矩形的间隔
        }
        

        // 输出结果
        rectangleA = rectanglesOnA;
        rectangleB = rectanglesOnB;
        pointsA = pointsOnA;
        pointsB = pointsOnB;
        indicesA = indicesTextA;
        indicesB = indicesTextB;
        holesA = circlesA;
        holesB = circlesB;
        indices = originIndicesText;

    }

    // 用于生成矩形长条的辅助函数
    private Polyline CreateRectangle(Line baseLine, double width)
    {
        double halfWidth = width / 2.0;

        // 矩形的四个顶点
        Point3d pt1 = baseLine.From + new Vector3d(0, -halfWidth, 0);
        Point3d pt2 = baseLine.To + new Vector3d(0, -halfWidth, 0);
        Point3d pt3 = baseLine.To + new Vector3d(0, halfWidth, 0);
        Point3d pt4 = baseLine.From + new Vector3d(0, halfWidth, 0);

        // 创建矩形
        Polyline rectangle = new Polyline(new List<Point3d> { pt1, pt2, pt3, pt4, pt1 });
        return rectangle;
    }
}
# ---------- end c_script_2 ----------
c_script_3 = CSharpScript(
    curves=flatten(crv_2),
    tolerance=Slider(0.01, range=0..0.01),
    width=Slider(100, range=0..1000),
    distance=Slider(100, range=0..100),
    hole_radius=Slider(20, range=0..100),
    font_size=Slider(40, range=0..100))  # -> out, rectangles, points, holes, indicesOnCurve, indicesOnPlane; inputs curves: list of Curve, tolerance: Double, width: Double, distance: Double, hole_radius: Double, font_size: Double; same code as c_script
