# Grasshopper definition 1116 unroll2.gh (Grasshopper 1.0.7)
# plug-ins: BarkBeetle

number_slider = Slider(123, range=0..1000)
curve = Curve(Tree({0}: [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], {1}: [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]))
extend_curve = ExtendCurve(Curve=curve, Type=0, Start=number_slider, End=number_slider)
curve_2 = Curve([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])
explode_tree = ExplodeTree(Data=extend_curve)  # -> Branch0, Branch1
unroll_strip_consistent_width = UnrollStripConsistentWidth(
    Curves=flatten(extend_curve),
    Tolerance=Slider(0.01, range=0..0.01),
    Width=Slider(198, range=0..1000),
    Distance=Slider(106, range=0..1000),
    HoleRadius=Slider(20, range=0..100),
    FontSize=Slider(40, range=0..100))  # -> Rectangles, Points, Holes, IndicesOnCurve, IndicesOnPlane
unroll_strip_two_width = UnrollStripTwoWidth(
    CurvesA=explode_tree.Branch0,
    CurvesB=explode_tree.Branch1,
    Tolerance=Slider(0.01, range=0..0.01),
    WidthA=Slider(73, range=0..1000),
    WidthB=Slider(122, range=0..1000),
    Distance=Slider(100, range=0..100),
    HoleRadius=Slider(11, range=0..100),
    FontSize=Slider(20, range=0..100))  # -> RectanglesA, RectanglesB, PointsA, PointsB, HolesA, HolesB, LabelsA, LabelsB, OriginalLabels
