# Grasshopper definition 1120_general_workflow.gh (Grasshopper 1.0.7)
# plug-ins: Bifocals, BarkBeetle, Weaverbird, KUKA|prc - parametric robot control

# ----
# Preparation
surface = Surface(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)
brep_edges = BrepEdges(Brep=surface)  # -> Naked, Interior, NonManifold
dispatch = Dispatch(List=brep_edges.Naked, DispatchPattern=[True, False])  # -> ListA, ListB
divide_curve = DivideCurve(Curve=dispatch.ListA, Count=Slider(8, range=0..20), Kinks=False)  # -> Points, Tangents, Parameters
divide_curve_2 = DivideCurve(Curve=dispatch.ListB, Count=Slider(5, range=0..10), Kinks=False)  # -> Points, Tangents, Parameters
explode_tree = ExplodeTree(Data=divide_curve.Points)  # -> Branch0, Branch1
explode_tree_2 = ExplodeTree(Data=divide_curve_2.Points)  # -> Branch0, Branch1
reverse_list = ReverseList(List=explode_tree_2.Branch1)
reverse_list_2 = ReverseList(List=explode_tree.Branch1)
geodesic = Geodesic(Surface=surface, Start=explode_tree_2.Branch0, End=reverse_list)
geodesic_2 = Geodesic(Surface=surface, Start=explode_tree.Branch0, End=reverse_list_2)
construct_point = ConstructPoint(XCoordinate=Slider(0.24, range=0..1), YCoordinate=Slider(0, range=0..1), ZCoordinate=0)
curve_intersection = CurveIntersection(CurvesA=graft(geodesic_2), CurvesB=geodesic, Tolerance=Slider(1, range=0..10))  # -> simplify(IntersectionPoints)
evaluate_surface = EvaluateSurface(Surface=reparameterize(surface), Point=construct_point)  # -> Point, Normal, UDirection, VDirection, Frame

number_slider = Slider(140, range=0..1000)
surface_2 = Surface(surface)
point = Point(curve_intersection)

# ---- group: Flip Matrix
flip_matrix = FlipMatrix(Data=point)
uv_network = UVNetwork(PointsTree=flip_matrix, Surface=surface_2, StripWidth=number_slider, ReferenceOption=0)  # -> UVNetwork, Points, UVCurves, ExtendedSrf

# ----
# Network
panel = Panel("0")
uv_network_2 = UVNetwork(PointsTree=point, Surface=surface_2, StripWidth=number_slider, ReferenceOption=panel)  # -> UVNetwork, Points, UVCurves, ExtendedSrf
brep_strip = BrepStrip(UVNetwork=uv_network_2.UVNetwork, StripExtension=Slider(69, range=0..100))

surface_3 = Surface(flatten(Tree({0}: [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], {1}: [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])))
crv = Curve(flatten([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]))
pt = Point(Tree({0}: [Point(-2042.753662, -657.3797336, 82.74777483), Point(-1543.407779, -810.0486015, 333.1536595), Point(-1006.225241, -927.1185183, 526.1329341), Point(-438.0689605, -1001.446628, 648.9981919), Point(147.9999999, -1026.91694, 691.1409185), Point(734.0689616, -1001.446628, 648.9981917), Point(1302.225244, -927.1185177, 526.1329332), Point(1839.40778, -810.0486011, 333.1536589), Point(2338.753664, -657.3797328, 82.74777374)], {1}: [Point(-2091.492191, -454.5473447, 150.4895582), Point(-1595.182952, -566.9280296, 427.6035345), Point(-1050.755152, -655.866863, 646.6883172), Point(-464.3094202, -713.8380954, 789.4084), Point(147.9999912, -734.0409892, 839.1383622), Point(760.3094206, -713.8380935, 789.4084004), Point(1346.755153, -655.866859, 646.6883176), Point(1891.182953, -566.9280242, 427.6035352), Point(2387.492192, -454.547338, 150.4895588)], {2}: [Point(-2118.7435, -240.5285691, 189.0307984), Point(-1627.549871, -284.3961669, 487.6131838), Point(-1080.610298, -320.0390154, 728.6266529), Point(-482.6523389, -343.790912, 888.7002114), Point(148.0000308, -352.1897922, 945.2195148), Point(778.6524289, -343.7909119, 888.7002109), Point(1376.610384, -320.0390152, 728.626652), Point(1923.549949, -284.3961667, 487.6131828), Point(2414.743564, -240.528573, 189.0307969)], {3}: [Point(-2118.743496, -21.47143166, 189.0307933), Point(-1627.549867, 22.39616688, 487.6131764), Point(-1080.610295, 58.03902614, 728.6266418), Point(-482.6523366, 81.79091345, 888.7002001), Point(148.0000308, 90.18979024, 945.2195033), Point(778.652427, 81.79091334, 888.7001995), Point(1376.61038, 58.03902597, 728.626641), Point(1923.549945, 22.3961666, 487.6131752), Point(2414.743561, -21.47142773, 189.0307918)], {4}: [Point(-2091.492192, 192.5473386, 150.4895602), Point(-1595.182953, 304.9280234, 427.6035371), Point(-1050.755151, 393.866874, 646.6883136), Point(-464.3094196, 451.8380968, 789.4084002), Point(147.9999912, 472.0409892, 839.1383628), Point(760.309421, 451.8380983, 789.408399), Point(1346.755151, 393.8668771, 646.6883119), Point(1891.182953, 304.9280278, 427.6035344), Point(2387.492191, 192.5473444, 150.4895575)], {5}: [Point(-2042.753662, 395.3797336, 82.74777483), Point(-1543.407779, 548.0485991, 333.1536611), Point(-1006.225239, 665.1185319, 526.1329267), Point(-438.0689593, 739.446631, 648.9981907), Point(147.9999999, 764.91694, 691.1409188), Point(734.0689623, 739.4466307, 648.9981903), Point(1302.22524, 665.1185316, 526.1329263), Point(1839.407781, 548.0485984, 333.1536601), Point(2338.753664, 395.3797329, 82.74777376)]))

# ----
# Skeleton Graph
spiral_skeleton_graph = SpiralSkeletonGraph(UVNetwork=uv_network_2.UVNetwork)  # -> SkeletonGraph, SkeletonPoints, MainCurve, BranchCurves, Vectors
snake_skeleton_graph = SnakeSkeletonGraph(UVNetwork=uv_network.UVNetwork)  # -> SkeletonGraph, SkeletonPoints, MainCurve, BranchCurves, Vectors
snake_skeleton_graph_2 = SnakeSkeletonGraph(UVNetwork=uv_network_2.UVNetwork)  # -> SkeletonGraph, SkeletonPoints, MainCurve, BranchCurves, Vectors

number_slider_2 = Slider(30, range=0..100)
number_slider_3 = Slider(10, range=0..10)

number_slider_4 = Slider(14, range=0..100)
snake_infill_pattern = SnakeInfillPattern(
    SkeletonGraph=spiral_skeleton_graph.SkeletonGraph,
    SeamPoint=evaluate_surface.Point,
    PathWidth=number_slider_4,
    Spacing=Slider(2, range=0..10))  # -> ToolpathPattern, Curve
unpack_toolpath_pattern = UnpackToolpathPattern(ToolpathPattern=snake_infill_pattern.ToolpathPattern)  # -> SkeletonGraph, Curve, BundleCurves, Points
point_2 = Point(flatten(unpack_toolpath_pattern.Points))
curve = Curve(unpack_toolpath_pattern.Curve)

# ----
# Pattern
spiral_toolpath_pattern = SpiralToolpathPattern(
    SkeletonGraph=graft([snake_skeleton_graph.SkeletonGraph, snake_skeleton_graph_2.SkeletonGraph]),
    SeamPoint=evaluate_surface.Point,
    PathWidth=number_slider_2)  # -> flatten(ToolpathPattern), Curve
spiral_toolpath_pattern_2 = SpiralToolpathPattern(SkeletonGraph=spiral_skeleton_graph.SkeletonGraph, SeamPoint=evaluate_surface.Point, PathWidth=number_slider_2)  # -> ToolpathPattern, Curve
unpack_toolpath_pattern_2 = UnpackToolpathPattern(ToolpathPattern=spiral_toolpath_pattern_2.ToolpathPattern)  # -> SkeletonGraph, Curve, BundleCurves, Points
stack_toolpath_pattern = StackToolpathPattern(
    TopPattern=snake_infill_pattern.ToolpathPattern,
    TopCount="1",
    MiddlePatternS=spiral_toolpath_pattern.ToolpathPattern,
    BottomPattern=spiral_toolpath_pattern_2.ToolpathPattern,
    BottomCount="1")

snake_zigzag_pattern = SnakeZigZagPattern(
    SkeletonGraph=spiral_skeleton_graph.SkeletonGraph,
    SeamPoint=evaluate_surface.Point,
    PathWidth=number_slider_4,
    Spacing=Slider(30, range=0..100))  # -> ToolpathPattern, Curve

# ----
# Stack Between Surfaces
number_slider_5 = Slider(40, range=0..100)
surface_4 = Surface(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)
reference_point = ReferencePoint(Point(176.542974, -1397.177065, 0))
toolpath_stack_between_surfaces = ToolpathStackBetweenSurfaces(
    StackPatterns=stack_toolpath_pattern,
    LayerHeight=number_slider_5,
    TopSurface=surface_4,
    OrientOption=Toggle(False),
    ReferencePoint=reference_point,
    PlaneRotateAngle=Slider(5, range=0..10))  # -> ToolpathStack, ToolpathCurve, ToolpathFrames

# ----
# Stack Vertical (Offset)
number_slider_6 = Slider(20, range=0..100)
reference_point_2 = ReferencePoint(Point(176.542974, -1397.177065, 0))
toolpath_stack_vertical = ToolpathStackVertical(
    StackPatterns=stack_toolpath_pattern,
    LayerHeight=number_slider_6,
    TotalHeight=Slider(80, range=0..100),
    OrientOption=Toggle(False),
    ReferencePoint=reference_point_2,
    PlaneRotateAngle=Slider(5, range=0..10))  # -> ToolpathStack, ToolpathCurve, ToolpathPlanes; disabled
unpack_toolpath_stack = UnpackToolpathStack(ToolpathStack=toolpath_stack_vertical.ToolpathStack)  # -> ToolpathCurve, ToolpathCurves, ToolpathFrames, SurfaceSeries, SpeedFactors; disabled
number_slider_7 = Slider(0, range=0..3)  # disabled
list_item = ListItem(List=unpack_toolpath_stack.ToolpathCurves, Index=number_slider_7, Wrap=True)  # disabled

curve_2 = Curve(toolpath_stack_vertical.ToolpathCurve)  # disabled
unpack_toolpath_stack_2 = UnpackToolpathStack(ToolpathStack=toolpath_stack_between_surfaces.ToolpathStack)  # -> ToolpathCurve, ToolpathCurves, ToolpathFrames, SurfaceSeries, SpeedFactors; disabled
explode_tree_3 = ExplodeTree(Data=unpack_toolpath_stack_2.SpeedFactors)  # -> Branch0, Branch1, Branch2, Branch3; disabled

# ----
# Visualization
number_slider_8 = Slider(6, range=0..10)  # disabled
button = Button()  # disabled
panel_2 = Panel("0")  # disabled
fillet_toolpath_from_toolpathstack = FilletToolpathFromToolpathStack(
    ToolpathStack=toolpath_stack_between_surfaces.ToolpathStack,
    Radius=number_slider_8,
    Trigger=button,
    SeamLengthFactor=panel_2)  # -> Curve, ToolpathStack; disabled
toolpath_mesh = ToolpathMesh(ToolpathStack=fillet_toolpath_from_toolpathstack.ToolpathStack, Parameter=1)  # disabled
weaverbird_s_catmull_clark_subdivision = WeaverbirdsCatmullClarkSubdivision(MeshCurves=toolpath_mesh, Level=1, SmoothNakedEdges=1)  # disabled
custom_preview = CustomPreview(
    Geometry=weaverbird_s_catmull_clark_subdivision,
    Material={diffuse=RGB(221, 160, 221), emission=RGB(66, 48, 66), shine=0.5, specular=RGB(255, 255, 255), transparency=0})  # disabled

panel_3 = Panel(explode_tree_3.Branch0)  # disabled

# ----
# Visualization
number_slider_9 = Slider(6, range=0..10)  # disabled
button_2 = Button()  # disabled
panel_4 = Panel("0")  # disabled
fillet_toolpath_from_toolpathstack_2 = FilletToolpathFromToolpathStack(ToolpathStack=toolpath_stack_vertical.ToolpathStack, Radius=number_slider_9, Trigger=button_2, SeamLengthFactor=panel_4)  # -> Curve, ToolpathStack; disabled
toolpath_mesh_2 = ToolpathMesh(ToolpathStack=fillet_toolpath_from_toolpathstack_2.ToolpathStack, Parameter=1)  # disabled
weaverbird_s_catmull_clark_subdivision_2 = WeaverbirdsCatmullClarkSubdivision(MeshCurves=toolpath_mesh_2, Level=1, SmoothNakedEdges=1)  # disabled
custom_preview_2 = CustomPreview(
    Geometry=weaverbird_s_catmull_clark_subdivision_2,
    Material={diffuse=RGB(221, 160, 221), emission=RGB(66, 48, 66), shine=0.5, specular=RGB(255, 255, 255), transparency=0})  # disabled

# ----
# Output
panel_5 = Panel("0.25")  # disabled
to_kuka_movement = ToKukaMovement(ToolpathStack=toolpath_stack_vertical.ToolpathStack, VelMax=panel_5)  # -> ToolpathPlanes, SpeedFactors; disabled
linear_movement_kuka_prc = LINearMovementKUKAPrc(
    TargetAsPlane=to_kuka_movement.ToolpathPlanes,
    Speed=to_kuka_movement.SpeedFactors,
    extaxenabled=False,
    interpolation="C_DIS")  # disabled
