# Grasshopper definition 1121_unroll.gh (Grasshopper 1.0.8)
# plug-ins: Pufferfish, BarkBeetle, Bifocals

curve = Curve(Tree({0}: [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], {1}: [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]))
explode_tree = ExplodeTree(Data=curve)  # -> Branch0, Branch1

surface = Surface(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)
brep_edges = BrepEdges(Brep=surface)  # -> Naked, Interior, NonManifold
number_slider = Slider(4, range=0..10)
dispatch = Dispatch(List=brep_edges.Naked, DispatchPattern=[True, False])  # -> ListA, ListB
divide_curve = DivideCurve(Curve=reverse(dispatch.ListB), Count=number_slider, Kinks=False)  # -> Points, Tangents, Parameters
divide_curve_2 = DivideCurve(Curve=dispatch.ListA, Count=Slider(3, range=0..20), Kinks=False)  # -> Points, Tangents, Parameters
divide_curve_3 = DivideCurve(Curve=dispatch.ListB, Count=number_slider, Kinks=False)  # -> Points, Tangents, Parameters
cull_index = CullIndex(List=divide_curve_2.Points, Indices=[-1, 0], Wrap=True)
merge = Merge(Data1=simplify(divide_curve.Points), Data2=simplify(cull_index))
merge_2 = Merge(Data1=simplify(cull_index), Data2=simplify(divide_curve_3.Points))
cull_index_2 = CullIndex(List=merge, Indices="0", Wrap=True)
cull_index_3 = CullIndex(List=merge_2, Indices="-1", Wrap=True)
explode_tree_2 = ExplodeTree(Data=cull_index_2)  # -> Branch0, Branch1
explode_tree_3 = ExplodeTree(Data=cull_index_3)  # -> Branch0, Branch1
reverse_list = ReverseList(List=explode_tree_2.Branch0)
number_slider_2 = Slider(1, range=0..10)
reverse_list_2 = ReverseList(List=explode_tree_3.Branch0)
geodesic = Geodesic(Surface=surface, Start=reverse_list, End=explode_tree_2.Branch1)
geodesic_2 = Geodesic(Surface=surface, Start=reverse_list_2, End=explode_tree_3.Branch1)

curve_2 = Curve(explode_tree.Branch1)
geodesics_in_u = Curve(Tree({0}: [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], {0;0;0}: [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]))
geodesics_in_v = Curve(Tree({0}: [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], {0;0;0}: [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]))
curve_3 = Curve([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])
curve_4 = Curve(flatten([geodesics_in_u, geodesics_in_v]))
rebuild_curve = RebuildCurve(Curve=curve_4, Count=10, Tangents=False)
number_slider_3 = Slider(0.2, range=0..10)
clean_tree = CleanTree(RemoveNulls=True, RemoveInvalid=True, RemoveEmpty=False, Tree=rebuild_curve)
number_slider_4 = Slider(0.4, range=0..10)
surface_2 = Surface(<surface referenced from the Rhino model>)

extend_curve = ExtendCurve(Curve=clean_tree, Type=0, Start=number_slider_3, End=number_slider_3)
surface_3 = Surface(surface_2)
divide_curve_4 = DivideCurve(Curve=extend_curve, Count=10, Kinks=False)  # -> Points, Tangents, Parameters
surface_closest_point = SurfaceClosestPoint(Point=divide_curve_4.Points, Surface=surface_3)  # -> Point, UVPoint, Distance
evaluate_surface = EvaluateSurface(Surface=surface_3, Point=surface_closest_point.UVPoint)  # -> Point, Normal, UDirection, VDirection, Frame
cross_product = CrossProduct(VectorA=divide_curve_4.Tangents, VectorB=evaluate_surface.Normal, Unitize=False)  # -> Vector, Length
amplitude = Amplitude(Vector=cross_product.Vector, Amplitude=number_slider_3)
negative = Negative(Value=amplitude)
move = Move(Geometry=divide_curve_4.Points, Motion=negative)  # -> Geometry, Transform
move_2 = Move(Geometry=divide_curve_4.Points, Motion=amplitude)  # -> Geometry, Transform
line = Line(StartPoint=move_2.Geometry, EndPoint=move.Geometry)
loft = Loft(Curves=line, Options={Adjust=False, Closed=False, LoftEnds=0, LoftSimp=0, LoftType=0, Rebuild=10, Refit=0.01})

curve_5 = Curve([<curve referenced from the Rhino model> x7])

# ----
# replace with double the strip thickness
number_slider_5 = Slider(2, range=0..10)

curve_6 = Curve([<curve referenced from the Rhino model> x7])
geodesics_in_v_2 = Curve(Tree({0}: [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], {0;0;0}: [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]))
geodesics_in_u_2 = Curve(Tree({0}: [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], {0;0;0}: [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]))
srf = Surface(<surface referenced from the Rhino model>)

extend_curve_2 = ExtendCurve(Curve=curve_3, Type=0, Start=number_slider_4, End=number_slider_4)
surface_4 = Surface(surface_2)
divide_curve_5 = DivideCurve(Curve=extend_curve_2, Count=10, Kinks=False)  # -> Points, Tangents, Parameters
surface_closest_point_2 = SurfaceClosestPoint(Point=divide_curve_5.Points, Surface=surface_4)  # -> Point, UVPoint, Distance
evaluate_surface_2 = EvaluateSurface(Surface=surface_4, Point=surface_closest_point_2.UVPoint)  # -> Point, Normal, UDirection, VDirection, Frame
cross_product_2 = CrossProduct(VectorA=divide_curve_5.Tangents, VectorB=evaluate_surface_2.Normal, Unitize=False)  # -> Vector, Length
amplitude_2 = Amplitude(Vector=cross_product_2.Vector, Amplitude=number_slider_4)
negative_2 = Negative(Value=amplitude_2)
move_3 = Move(Geometry=divide_curve_5.Points, Motion=negative_2)  # -> Geometry, Transform
move_4 = Move(Geometry=divide_curve_5.Points, Motion=amplitude_2)  # -> Geometry, Transform
line_2 = Line(StartPoint=move_4.Geometry, EndPoint=move_3.Geometry)
loft_2 = Loft(Curves=line_2, Options={Adjust=False, Closed=False, LoftEnds=0, LoftSimp=0, LoftType=0, Rebuild=10, Refit=0.01})

curve_7 = Curve([<curve referenced from the Rhino model> x64])
surface_5 = Surface(<surface referenced from the Rhino model>)
negative_3 = Negative(Value=number_slider_5)
deconstruct_brep = DeconstructBrep(Brep=surface_5)  # -> Faces, Edges, Vertices
number_slider_6 = Slider(5, range=0..100)
surface_6 = Surface(<surface referenced from the Rhino model>)
offset_curve_from_surface = OffsetCurveFromSurface(Curve=curve_6, Surface=surface_6, Distance=negative_3, BothSides=0, CapType="0")

# ----
# half of the strip width
number_slider_7 = Slider(3, range=0..10)

# ----
# half of the strip width
number_slider_8 = Slider(3, range=0..10)

offset_curve_from_surface_2 = OffsetCurveFromSurface(Curve=curve_5, Surface=surface_6, Distance=negative_3, BothSides=0, CapType="0")
curve_8 = Curve(deconstruct_brep.Edges)
explode = Explode(Curve=curve_8, Recursive=True)  # -> Segments, Vertices
extend_surface = ExtendSurface(Surface=surface_5, UDistance=number_slider_6, VDistance=number_slider_6)
pipe = Pipe(Curve=explode.Segments, Radius=Slider(3, range=0..100), Caps=1)

extend_curve_3 = ExtendCurve(Curve=offset_curve_from_surface_2, Type=0, Start=number_slider_7, End=number_slider_7)
surface_7 = Surface(surface_6)
divide_curve_6 = DivideCurve(Curve=extend_curve_3, Count=10, Kinks=False)  # -> Points, Tangents, Parameters
surface_closest_point_3 = SurfaceClosestPoint(Point=divide_curve_6.Points, Surface=surface_7)  # -> Point, UVPoint, Distance
evaluate_surface_3 = EvaluateSurface(Surface=surface_7, Point=surface_closest_point_3.UVPoint)  # -> Point, Normal, UDirection, VDirection, Frame
cross_product_3 = CrossProduct(VectorA=divide_curve_6.Tangents, VectorB=evaluate_surface_3.Normal, Unitize=False)  # -> Vector, Length
amplitude_3 = Amplitude(Vector=cross_product_3.Vector, Amplitude=number_slider_7)
negative_4 = Negative(Value=amplitude_3)
move_5 = Move(Geometry=divide_curve_6.Points, Motion=negative_4)  # -> Geometry, Transform
move_6 = Move(Geometry=divide_curve_6.Points, Motion=amplitude_3)  # -> Geometry, Transform
line_3 = Line(StartPoint=move_6.Geometry, EndPoint=move_5.Geometry)
loft_3 = Loft(Curves=line_3, Options={Adjust=False, Closed=False, LoftEnds=0, LoftSimp=0, LoftType=0, Rebuild=10, Refit=0.01})

extend_curve_4 = ExtendCurve(Curve=offset_curve_from_surface, Type=0, Start=number_slider_7, End=number_slider_7)
surface_8 = Surface(surface_6)
divide_curve_7 = DivideCurve(Curve=extend_curve_4, Count=10, Kinks=False)  # -> Points, Tangents, Parameters
surface_closest_point_4 = SurfaceClosestPoint(Point=divide_curve_7.Points, Surface=surface_8)  # -> Point, UVPoint, Distance
evaluate_surface_4 = EvaluateSurface(Surface=surface_8, Point=surface_closest_point_4.UVPoint)  # -> Point, Normal, UDirection, VDirection, Frame
cross_product_4 = CrossProduct(VectorA=divide_curve_7.Tangents, VectorB=evaluate_surface_4.Normal, Unitize=False)  # -> Vector, Length
amplitude_4 = Amplitude(Vector=cross_product_4.Vector, Amplitude=number_slider_7)
negative_5 = Negative(Value=amplitude_4)
move_7 = Move(Geometry=divide_curve_7.Points, Motion=negative_5)  # -> Geometry, Transform
move_8 = Move(Geometry=divide_curve_7.Points, Motion=amplitude_4)  # -> Geometry, Transform
line_4 = Line(StartPoint=move_8.Geometry, EndPoint=move_7.Geometry)
loft_4 = Loft(Curves=line_4, Options={Adjust=False, Closed=False, LoftEnds=0, LoftSimp=0, LoftType=0, Rebuild=10, Refit=0.01})

extend_curve_5 = ExtendCurve(Curve=curve_5, Type=0, Start=number_slider_8, End=number_slider_8)
surface_9 = Surface(surface_5)
divide_curve_8 = DivideCurve(Curve=extend_curve_5, Count=10, Kinks=False)  # -> Points, Tangents, Parameters
surface_closest_point_5 = SurfaceClosestPoint(Point=divide_curve_8.Points, Surface=surface_9)  # -> Point, UVPoint, Distance
evaluate_surface_5 = EvaluateSurface(Surface=surface_9, Point=surface_closest_point_5.UVPoint)  # -> Point, Normal, UDirection, VDirection, Frame
cross_product_5 = CrossProduct(VectorA=divide_curve_8.Tangents, VectorB=evaluate_surface_5.Normal, Unitize=False)  # -> Vector, Length
amplitude_5 = Amplitude(Vector=cross_product_5.Vector, Amplitude=number_slider_8)
negative_6 = Negative(Value=amplitude_5)
move_9 = Move(Geometry=divide_curve_8.Points, Motion=negative_6)  # -> Geometry, Transform
move_10 = Move(Geometry=divide_curve_8.Points, Motion=amplitude_5)  # -> Geometry, Transform
line_5 = Line(StartPoint=move_10.Geometry, EndPoint=move_9.Geometry)
loft_5 = Loft(Curves=line_5, Options={Adjust=False, Closed=False, LoftEnds=0, LoftSimp=0, LoftType=0, Rebuild=10, Refit=0.01})

extend_curve_6 = ExtendCurve(Curve=curve_6, Type=0, Start=number_slider_8, End=number_slider_8)
surface_10 = Surface(surface_5)
divide_curve_9 = DivideCurve(Curve=extend_curve_6, Count=10, Kinks=False)  # -> Points, Tangents, Parameters
surface_closest_point_6 = SurfaceClosestPoint(Point=divide_curve_9.Points, Surface=surface_10)  # -> Point, UVPoint, Distance
evaluate_surface_6 = EvaluateSurface(Surface=surface_10, Point=surface_closest_point_6.UVPoint)  # -> Point, Normal, UDirection, VDirection, Frame
cross_product_6 = CrossProduct(VectorA=divide_curve_9.Tangents, VectorB=evaluate_surface_6.Normal, Unitize=False)  # -> Vector, Length
amplitude_6 = Amplitude(Vector=cross_product_6.Vector, Amplitude=number_slider_8)
negative_7 = Negative(Value=amplitude_6)
move_11 = Move(Geometry=divide_curve_9.Points, Motion=negative_7)  # -> Geometry, Transform
move_12 = Move(Geometry=divide_curve_9.Points, Motion=amplitude_6)  # -> Geometry, Transform
line_6 = Line(StartPoint=move_12.Geometry, EndPoint=move_11.Geometry)
loft_6 = Loft(Curves=line_6, Options={Adjust=False, Closed=False, LoftEnds=0, LoftSimp=0, LoftType=0, Rebuild=10, Refit=0.01})

merge_3 = Merge(Data1=flatten(extend_curve), Data2=flatten(extend_curve_2))
number_slider_9 = Slider(0.01, range=0..0.01)
merge_4 = Merge(Data1=flatten(loft), Data2=flatten(loft_2))
unroll_curve_strip = UnrollCurveStrip(
    Surfaces=merge_4,
    Curves=merge_3,
    Tolerance=0.1,
    Distance=Slider(0.05, range=0..0.1),
    HoleRadius=Slider(0.05, range=0..0.1),
    FontSize=Slider(0.1, range=0..0.1))  # -> Strips, Points, Holes, Labels, OriginalLabels

# ----
# strip thickness
number_slider_10 = Slider(1, range=0..1)

# ----
# strip thickness
number_slider_11 = Slider(1, range=0..1)

curve_9 = Curve(unroll_curve_strip.Labels)
curve_10 = Curve(unroll_curve_strip.Holes)
# 1. Calculate strip count from mode size and material width
# 2.
curve_11 = Curve(unroll_curve_strip.OriginalLabels)
curve_12 = Curve(unroll_curve_strip.Strips)
merge_5 = Merge(Data1=flatten(extend_curve_3), Data2=flatten(extend_curve_4))
merge_6 = Merge(Data1=flatten(loft_3), Data2=flatten(loft_4))
negative_8 = Negative(Value=number_slider_10)
merge_7 = Merge(Data1=flatten(loft_5), Data2=flatten(loft_6))
merge_8 = Merge(Data1=flatten(extend_curve_5), Data2=flatten(extend_curve_6))
negative_9 = Negative(Value=number_slider_11)
offset_surface = OffsetSurface(Surface=loft_3, Distance=number_slider_10, BothSides=0, CreateSolid=True)
offset_surface_2 = OffsetSurface(Surface=loft_5, Distance=number_slider_11, BothSides=0, CreateSolid=True)
offset_surface_3 = OffsetSurface(Surface=loft_4, Distance=negative_8, BothSides=0, CreateSolid=True)
offset_surface_4 = OffsetSurface(Surface=loft_6, Distance=negative_9, BothSides=0, CreateSolid=True)
unroll_curve_strip_2 = UnrollCurveStrip(
    Surfaces=merge_6,
    Curves=merge_5,
    Tolerance=0.1,
    Distance=Slider(1, range=0..1),
    HoleRadius=Slider(0.5, range=0..1),
    FontSize=Slider(1, range=0..1))  # -> Strips, Points, Holes, Labels, OriginalLabels
unroll_curve_strip_3 = UnrollCurveStrip(
    Surfaces=merge_7,
    Curves=merge_8,
    Tolerance=0.1,
    Distance=Slider(1, range=0..1),
    HoleRadius=Slider(0.5, range=0..1),
    FontSize=Slider(1, range=0..1))  # -> Strips, Points, Holes, Labels, OriginalLabels
