# Grasshopper definition 1202.gh (Grasshopper 1.0.7)
# plug-ins: Bifocals, BarkBeetle, Weaverbird, KUKA|prc - parametric robot control, Human

# ----
# Preparation
surface = Surface(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)
brep_edges = BrepEdges(Brep=surface)  # -> Naked, Interior, NonManifold
dispatch = Dispatch(List=brep_edges.Naked, DispatchPattern=[True, False])  # -> ListA, ListB
divide_curve = DivideCurve(Curve=dispatch.ListA, Count=Slider(8, range=0..20), Kinks=False)  # -> Points, Tangents, Parameters
divide_curve_2 = DivideCurve(Curve=dispatch.ListB, Count=Slider(5, range=0..10), Kinks=False)  # -> Points, Tangents, Parameters
explode_tree = ExplodeTree(Data=divide_curve.Points)  # -> Branch0, Branch1
explode_tree_2 = ExplodeTree(Data=divide_curve_2.Points)  # -> Branch0, Branch1
reverse_list = ReverseList(List=explode_tree_2.Branch1)
reverse_list_2 = ReverseList(List=explode_tree.Branch1)
geodesic = Geodesic(Surface=surface, Start=explode_tree_2.Branch0, End=reverse_list)
geodesic_2 = Geodesic(Surface=surface, Start=explode_tree.Branch0, End=reverse_list_2)
construct_point = ConstructPoint(XCoordinate=Slider(0.24, range=0..1), YCoordinate=Slider(0, range=0..1), ZCoordinate=0)
curve_intersection = CurveIntersection(CurvesA=graft(geodesic_2), CurvesB=geodesic, Tolerance=Slider(1, range=0..10))  # -> simplify(IntersectionPoints)
evaluate_surface = EvaluateSurface(Surface=reparameterize(surface), Point=construct_point)  # -> Point, Normal, UDirection, VDirection, Frame

range = Range(Domain=Domain(0, 1), Steps=Slider(20, range=0..100))
number_slider = Slider(140, range=0..1000)
surface_2 = Surface(surface)
point = Point(curve_intersection)

# ---- group: Flip Matrix
flip_matrix = FlipMatrix(Data=point)
uv_network = UVNetwork(PointsTree=flip_matrix, Surface=surface_2, StripWidth=number_slider, ReferenceOption=0)  # -> UVNetwork, Points, UVCurves, ExtendedSrf

# ----
# Network
panel = Panel("0")
uv_network_2 = UVNetwork(PointsTree=point, Surface=surface_2, StripWidth=number_slider, ReferenceOption=panel)  # -> UVNetwork, Points, UVCurves, ExtendedSrf
brep_strip = BrepStrip(UVNetwork=uv_network_2.UVNetwork, StripExtension=Slider(69, range=0..100))

surface_3 = Surface(flatten(Tree({0}: [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], {1}: [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])))
crv = Curve(flatten([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]))
curve = Curve(Tree({0}: [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], {1}: [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]))
point_2 = Point(Tree({0}: [Point(-2042.753662, -657.3797341, 82.74777562), Point(-1543.408003, -810.0477269, 333.1540658), Point(-1006.225233, -927.1185591, 526.1329123), Point(-438.0689448, -1001.446772, 648.9981087), Point(147.9999999, -1026.917163, 691.1407839), Point(734.068946, -1001.446771, 648.9981085), Point(1302.225236, -927.1185585, 526.1329114), Point(1839.408004, -810.0477264, 333.1540651), Point(2338.753664, -657.3797333, 82.74777453)], {1}: [Point(-2091.492192, -454.5473392, 150.4895606), Point(-1595.18303, -566.9275684, 427.6036786), Point(-1050.755124, -655.8670773, 646.6882416), Point(-464.3094279, -713.8379912, 789.4084416), Point(147.9999912, -734.0416627, 839.1380889), Point(760.3094284, -713.8379892, 789.408442), Point(1346.755126, -655.8670733, 646.688242), Point(1891.183031, -566.9275629, 427.6036794), Point(2387.492193, -454.5473383, 150.4895596)], {2}: [Point(-2118.7435, -240.528569, 189.0307984), Point(-1627.54983, -284.3968523, 487.6131071), Point(-1080.610275, -320.0395032, 728.6265893), Point(-482.6523402, -343.7908628, 888.7002185), Point(148.0000308, -352.1897579, 945.2195199), Point(778.6524302, -343.7908627, 888.7002181), Point(1376.610361, -320.039503, 728.6265883), Point(1923.549908, -284.3968521, 487.613106), Point(2414.743564, -240.528573, 189.0307969)], {3}: [Point(-2118.743496, -21.47143168, 189.0307932), Point(-1627.549826, 22.39685143, 487.6130997), Point(-1080.610272, 58.03949318, 728.6265809), Point(-482.6523404, 81.79076822, 888.700221), Point(148.0000308, 90.18974966, 945.2195094), Point(778.6524309, 81.79076811, 888.7002205), Point(1376.610358, 58.03949302, 728.6265801), Point(1923.549904, 22.39685116, 487.6130986), Point(2414.743561, -21.47142775, 189.0307918)], {4}: [Point(-2091.492194, 192.5473331, 150.4895626), Point(-1595.183031, 304.9275636, 427.6036808), Point(-1050.755126, 393.8670659, 646.688246), Point(-464.3094335, 451.8379075, 789.408475), Point(147.9999912, 472.0416572, 839.1380916), Point(760.3094349, 451.837909, 789.4084738), Point(1346.755126, 393.867069, 646.6882442), Point(1891.183031, 304.9275681, 427.6036781), Point(2387.492192, 192.5473447, 150.4895583)], {5}: [Point(-2042.753662, 395.3797341, 82.74777562), Point(-1543.408003, 548.0477269, 333.1540663), Point(-1006.225235, 665.1185518, 526.132916), Point(-438.0689517, 739.4467018, 648.9981498), Point(147.9999999, 764.9171582, 691.1407869), Point(734.0689546, 739.4467015, 648.9981493), Point(1302.225236, 665.1185515, 526.1329156), Point(1839.408005, 548.0477262, 333.1540652), Point(2338.753664, 395.3797334, 82.74777455)]))
pt = Point(Tree({0}: [Point(-2042.753662, -657.3797336, 82.74777483), Point(-1543.407779, -810.0486015, 333.1536595), Point(-1006.225241, -927.1185183, 526.1329341), Point(-438.0689605, -1001.446628, 648.9981919), Point(147.9999999, -1026.91694, 691.1409185), Point(734.0689616, -1001.446628, 648.9981917), Point(1302.225244, -927.1185177, 526.1329332), Point(1839.40778, -810.0486011, 333.1536589), Point(2338.753664, -657.3797328, 82.74777374)], {1}: [Point(-2091.492191, -454.5473447, 150.4895582), Point(-1595.182952, -566.9280296, 427.6035345), Point(-1050.755152, -655.866863, 646.6883172), Point(-464.3094202, -713.8380954, 789.4084), Point(147.9999912, -734.0409892, 839.1383622), Point(760.3094206, -713.8380935, 789.4084004), Point(1346.755153, -655.866859, 646.6883176), Point(1891.182953, -566.9280242, 427.6035352), Point(2387.492192, -454.547338, 150.4895588)], {2}: [Point(-2118.7435, -240.5285691, 189.0307984), Point(-1627.549871, -284.3961669, 487.6131838), Point(-1080.610298, -320.0390154, 728.6266529), Point(-482.6523389, -343.790912, 888.7002114), Point(148.0000308, -352.1897922, 945.2195148), Point(778.6524289, -343.7909119, 888.7002109), Point(1376.610384, -320.0390152, 728.626652), Point(1923.549949, -284.3961667, 487.6131828), Point(2414.743564, -240.528573, 189.0307969)], {3}: [Point(-2118.743496, -21.47143166, 189.0307933), Point(-1627.549867, 22.39616688, 487.6131764), Point(-1080.610295, 58.03902614, 728.6266418), Point(-482.6523366, 81.79091345, 888.7002001), Point(148.0000308, 90.18979024, 945.2195033), Point(778.652427, 81.79091334, 888.7001995), Point(1376.61038, 58.03902597, 728.626641), Point(1923.549945, 22.3961666, 487.6131752), Point(2414.743561, -21.47142773, 189.0307918)], {4}: [Point(-2091.492192, 192.5473386, 150.4895602), Point(-1595.182953, 304.9280234, 427.6035371), Point(-1050.755151, 393.866874, 646.6883136), Point(-464.3094196, 451.8380968, 789.4084002), Point(147.9999912, 472.0409892, 839.1383628), Point(760.309421, 451.8380983, 789.408399), Point(1346.755151, 393.8668771, 646.6883119), Point(1891.182953, 304.9280278, 427.6035344), Point(2387.492191, 192.5473444, 150.4895575)], {5}: [Point(-2042.753662, 395.3797336, 82.74777483), Point(-1543.407779, 548.0485991, 333.1536611), Point(-1006.225239, 665.1185319, 526.1329267), Point(-438.0689593, 739.446631, 648.9981907), Point(147.9999999, 764.91694, 691.1409188), Point(734.0689623, 739.4466307, 648.9981903), Point(1302.22524, 665.1185316, 526.1329263), Point(1839.407781, 548.0485984, 333.1536601), Point(2338.753664, 395.3797329, 82.74777376)]))

# ----
# Skeleton Graph
spiral_skeleton_graph = SpiralSkeletonGraph(UVNetwork=uv_network_2.UVNetwork)  # -> SkeletonGraph, SkeletonPoints, MainCurve, BranchCurves, Vectors
snake_skeleton_graph = SnakeSkeletonGraph(UVNetwork=uv_network.UVNetwork)  # -> SkeletonGraph, SkeletonPoints, MainCurve, BranchCurves, Vectors
snake_skeleton_graph_2 = SnakeSkeletonGraph(UVNetwork=uv_network_2.UVNetwork)  # -> SkeletonGraph, SkeletonPoints, MainCurve, BranchCurves, Vectors

evaluate_curve = EvaluateCurve(Curve=reparameterize(spiral_skeleton_graph.MainCurve), Parameter="0.5")  # -> Point, Tangent, Angle
number_slider_2 = Slider(17, range=0..100)

snake_infill_pattern = SnakeInfillPattern(
    SkeletonGraph=spiral_skeleton_graph.SkeletonGraph,
    SeamPoint=evaluate_surface.Point,
    PathWidth=number_slider_2,
    Spacing=Slider(0, range=0..10))  # -> ToolpathPattern, Curve
unpack_toolpath_pattern = UnpackToolpathPattern(ToolpathPattern=snake_infill_pattern.ToolpathPattern)  # -> SkeletonGraph, Curve, BundleCurves, Points
point_3 = Point(flatten(unpack_toolpath_pattern.Points))
curve_2 = Curve(unpack_toolpath_pattern.Curve)

pattern_avoid_obstacles = PatternAvoidObstacles(
    ToolpathPattern=snake_infill_pattern.ToolpathPattern,
    LocationPoints=evaluate_curve.Point,
    XSize=Slider(30, range=0..1000),
    YSize=Slider(40, range=0..100))  # -> OutputToolpathPattern, Curve, BlockCurves, TimCurves
curve_3 = Curve(pattern_avoid_obstacles.BlockCurves)
curve_4 = Curve(pattern_avoid_obstacles.TimCurves)
curve_5 = Curve(pattern_avoid_obstacles.Curve)
curve_intersection_2 = CurveIntersection(CurvesA=snake_infill_pattern.Curve, CurvesB=curve_4, Tolerance=0.01)
project = Project(Geometry=snake_infill_pattern.Curve, Plane=PlaneXY(0, 0, 0))  # -> Geometry, Transform

# ----
# Pattern
spiral_toolpath_pattern = SpiralToolpathPattern(
    SkeletonGraph=graft([snake_skeleton_graph.SkeletonGraph, snake_skeleton_graph_2.SkeletonGraph]),
    SeamPoint=evaluate_surface.Point,
    PathWidth=number_slider_2)  # -> flatten(ToolpathPattern), Curve
spiral_toolpath_pattern_2 = SpiralToolpathPattern(SkeletonGraph=spiral_skeleton_graph.SkeletonGraph, SeamPoint=evaluate_surface.Point, PathWidth=number_slider_2)  # -> ToolpathPattern, Curve
unpack_toolpath_pattern_2 = UnpackToolpathPattern(ToolpathPattern=spiral_toolpath_pattern_2.ToolpathPattern)  # -> SkeletonGraph, Curve, BundleCurves, Points
stack_toolpath_pattern = StackToolpathPattern(
    TopPattern=spiral_toolpath_pattern_2.ToolpathPattern,
    TopCount="1",
    MiddlePatternS=spiral_toolpath_pattern.ToolpathPattern,
    BottomPattern=snake_infill_pattern.ToolpathPattern,
    BottomCount="1")

end_points = EndPoints(Curve=curve_2)  # -> Start, End

gene_pool = GenePool(Decimals=2, Maximum=1, Minimum=0, Value=[0.1998, 0.3522, 0.5924, 0.7264, 0.95])
evaluate_curve_2 = EvaluateCurve(Curve=reparameterize(spiral_skeleton_graph.MainCurve), Parameter=gene_pool)  # -> Point, Tangent, Angle
point_4 = Point(evaluate_curve_2.Point)
number_slider_3 = Slider(39, range=0..100)
number_slider_4 = Slider(19, range=0..100)
surface_closest_point = SurfaceClosestPoint(Point=point_4, Surface=uv_network_2.ExtendedSrf)  # -> Point, UVPoint, Distance
evaluate_surface_2 = EvaluateSurface(Surface=uv_network_2.ExtendedSrf, Point=surface_closest_point.UVPoint)  # -> Point, Normal, UDirection, VDirection, Frame
negative = Negative(Value=number_slider_3)
negative_2 = Negative(Value=number_slider_4)
cross_product = CrossProduct(VectorA=evaluate_curve_2.Tangent, VectorB=evaluate_surface_2.Normal, Unitize=False)  # -> Vector, Length
construct_domain = ConstructDomain(DomainStart=negative_2, DomainEnd=number_slider_4)
construct_domain_2 = ConstructDomain(DomainStart=negative, DomainEnd=number_slider_3)
list_item = ListItem(List=unpack_toolpath_pattern.BundleCurves, Index=0, Wrap=True)
construct_plane = ConstructPlane(Origin=point_4, XAxis=evaluate_curve_2.Tangent, YAxis=cross_product.Vector)
rectangle = Rectangle(Plane=construct_plane, XSize=construct_domain_2, YSize=construct_domain, Radius=0)  # -> Rectangle, Length
offset_curve = OffsetCurve(Curve=rectangle.Rectangle, Distance=Slider(7, range=0..100), Plane=construct_plane, Corners=1)
discontinuity = Discontinuity(Curve=offset_curve, Level=1)  # -> Points, Parameters
curve_intersection_3 = CurveIntersection(CurvesA=offset_curve, CurvesB=list_item, Tolerance=Slider(2, range=0..10))
list_item_2 = ListItem(List=curve_intersection_3, Index=0, Wrap=True)  # -> Item, Item1

panel_2 = Panel(end_points.End)
panel_3 = Panel(end_points.Start)

# ----
# Stack Between Surfaces
number_slider_5 = Slider(40, range=0..100)
surface_4 = Surface(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)
reference_point = ReferencePoint(Point(176.542974, -1397.177065, 0))
toolpath_stack_between_surfaces = ToolpathStackBetweenSurfaces(
    StackPatterns=stack_toolpath_pattern,
    LayerHeight=number_slider_5,
    TopSurface=surface_4,
    OrientOption=Toggle(False),
    ReferencePoint=reference_point,
    PlaneRotateAngle=Slider(5, range=0..10))  # -> ToolpathStack, ToolpathCurve, ToolpathFrames; disabled

# ----
# Stack Vertical (Offset)
number_slider_6 = Slider(20, range=0..100)
reference_point_2 = ReferencePoint(Point(176.542974, -1397.177065, 0))
toolpath_stack_vertical = ToolpathStackVertical(
    StackPatterns=stack_toolpath_pattern,
    LayerHeight=number_slider_6,
    TotalHeight=Slider(80, range=0..100),
    OrientOption=Toggle(False),
    ReferencePoint=reference_point_2,
    PlaneRotateAngle=Slider(5, range=0..10))  # -> ToolpathStack, ToolpathCurve, ToolpathPlanes
unpack_toolpath_stack = UnpackToolpathStack(ToolpathStack=toolpath_stack_vertical.ToolpathStack)  # -> ToolpathCurve, ToolpathCurves, ToolpathFrames, SurfaceSeries, SpeedFactors
number_slider_7 = Slider(0, range=0..3)

plane = Plane(toolpath_stack_vertical.ToolpathPlanes)
unpack_toolpath_stack_2 = UnpackToolpathStack(ToolpathStack=toolpath_stack_between_surfaces.ToolpathStack)  # -> ToolpathCurve, ToolpathCurves, ToolpathFrames, SurfaceSeries, SpeedFactors; disabled
curve_6 = Curve(toolpath_stack_vertical.ToolpathCurve)
curve_7 = Curve(unpack_toolpath_stack.ToolpathCurves)
explode_tree_3 = ExplodeTree(Data=unpack_toolpath_stack_2.SpeedFactors)  # -> Branch0, Branch1, Branch2, Branch3; disabled

# ----
# Visualization
number_slider_8 = Slider(6, range=0..10)  # disabled
button = Button()  # disabled
panel_4 = Panel("0")  # disabled
fillet_toolpath_from_toolpathstack = FilletToolpathFromToolpathStack(
    ToolpathStack=toolpath_stack_between_surfaces.ToolpathStack,
    Radius=number_slider_8,
    Trigger=button,
    SeamLengthFactor=panel_4)  # -> Curve, ToolpathStack; disabled
toolpath_mesh = ToolpathMesh(ToolpathStack=fillet_toolpath_from_toolpathstack.ToolpathStack, Parameter=1)  # disabled
weaverbird_s_catmull_clark_subdivision = WeaverbirdsCatmullClarkSubdivision(MeshCurves=toolpath_mesh, Level=1, SmoothNakedEdges=1)  # disabled
custom_preview = CustomPreview(
    Geometry=weaverbird_s_catmull_clark_subdivision,
    Material={diffuse=RGB(221, 160, 221), emission=RGB(66, 48, 66), shine=0.5, specular=RGB(255, 255, 255), transparency=0})  # disabled

panel_5 = Panel(explode_tree_3.Branch0)  # disabled

# ----
# Visualization
number_slider_9 = Slider(6, range=0..10)  # disabled
button_2 = Button()  # disabled
panel_6 = Panel("0")  # disabled
fillet_toolpath_from_toolpathstack_2 = FilletToolpathFromToolpathStack(ToolpathStack=toolpath_stack_vertical.ToolpathStack, Radius=number_slider_9, Trigger=button_2, SeamLengthFactor=panel_6)  # -> Curve, ToolpathStack; disabled
toolpath_mesh_2 = ToolpathMesh(ToolpathStack=fillet_toolpath_from_toolpathstack_2.ToolpathStack, Parameter=1)  # disabled
weaverbird_s_catmull_clark_subdivision_2 = WeaverbirdsCatmullClarkSubdivision(MeshCurves=toolpath_mesh_2, Level=1, SmoothNakedEdges=1)  # disabled
custom_preview_2 = CustomPreview(
    Geometry=weaverbird_s_catmull_clark_subdivision_2,
    Material={diffuse=RGB(221, 160, 221), emission=RGB(66, 48, 66), shine=0.5, specular=RGB(255, 255, 255), transparency=0})  # disabled

# ----
# Output
panel_7 = Panel("0.25")  # disabled
to_kuka_movement = ToKukaMovement(ToolpathStack=toolpath_stack_vertical.ToolpathStack, VelMax=panel_7)  # -> ToolpathPlanes, SpeedFactors; disabled
linear_movement_kuka_prc = LINearMovementKUKAPrc(
    TargetAsPlane=to_kuka_movement.ToolpathPlanes,
    Speed=to_kuka_movement.SpeedFactors,
    extaxenabled=False,
    interpolation="C_DIS")  # disabled

list_item_3 = ListItem(List=curve_7, Index=0, Wrap=True)  # -> Item1, Item, Item1_2, Item2
curve_8 = Curve(list_item_3.Item1)
curve_9 = Curve([list_item_3.Item, list_item_3.Item1_2, list_item_3.Item2])
discontinuity_2 = Discontinuity(Curve=curve_8, Level=1)  # -> Points, Parameters
curve_closest_point = CurveClosestPoint(Point=discontinuity_2.Points, Curve=graft(curve_7))  # -> Point, Parameter, Distance
flip_matrix_2 = FlipMatrix(Data=curve_closest_point.Point)
polyline = PolyLine(Vertices=flip_matrix_2, Closed=False)
explode = Explode(Curve=polyline, Recursive=True)  # -> simplify(Segments), Vertices
end_points_2 = EndPoints(Curve=explode.Segments)  # -> Start, End
unit_z = UnitZ(Factor=1)
vector_2pt = Vector2Pt(PointA=end_points_2.Start, PointB=end_points_2.End, Unitize=False)  # -> Vector, Length
angle = Angle(VectorA=unit_z, VectorB=vector_2pt.Vector)  # -> Angle, Reflex
flatten_tree = FlattenTree(Tree=explode.Segments, Path="{0}")
flatten_tree_2 = FlattenTree(Tree=angle.Angle, Path="{0}")
sort_list = SortList(Keys=flatten_tree_2, ValuesValuesA=flatten_tree)  # -> Keys, reverse(ValuesValuesA)
panel_8 = Panel(sort_list.Keys)
custom_preview_lineweights = CustomPreviewLineweights(
    Geometry=sort_list.ValuesValuesA,
    Shader={diffuse=RGB(255, 105, 180), emission=RGB(76, 32, 54), shine=0.5, specular=RGB(255, 255, 255), transparency=0},
    Thickness=Slider(20, range=0..100),
    Absolute=False)
