# Grasshopper definition 1202_multilayer.gh (Grasshopper 1.0.7)
# plug-ins: BarkBeetle

number_slider = Slider(100, range=0..100)
curve = Curve(Tree({0}: [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], {1}: [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]))
surface = Surface(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)
extend_curve = ExtendCurve(Curve=curve, Type=0, Start=number_slider, End=number_slider)
explode_tree = ExplodeTree(Data=extend_curve)  # -> Branch0, Branch1
curve_intersection = CurveIntersection(CurvesA=graft(explode_tree.Branch0), CurvesB=explode_tree.Branch1, Tolerance=0.01)  # -> simplify(IntersectionPoints)
curve_closest_point = CurveClosestPoint(Point=curve_intersection, Curve=graft(explode_tree.Branch0))  # -> Point, Parameter, Distance
shift_list = ShiftList(List=curve_closest_point.Parameter, Shift=-1, Wrap=False)
shift_list_2 = ShiftList(List=curve_closest_point.Parameter, Shift=1, Wrap=False)
number_slider_2 = Slider(0.03, range=0..0.1)
subtraction = Subtraction(A=shift_list_2, B=shift_list)
subtraction_2 = Subtraction(A="0.5", B=number_slider_2)
addition = Addition(A="0.5", B=number_slider_2)
multiplication = Multiplication(A=subtraction, B=subtraction_2)
multiplication_2 = Multiplication(A=subtraction, B=addition)
addition_2 = Addition(A=shift_list, B=multiplication_2)
addition_3 = Addition(A=shift_list, B=multiplication)
dispatch = Dispatch(List=addition_3, DispatchPattern=[True, False])  # -> ListA, ListB
dispatch_2 = Dispatch(List=addition_2, DispatchPattern=[True, False])  # -> ListA, ListB
cull_index = CullIndex(List=dispatch_2.ListA, Indices="0", Wrap=True)
cull_index_2 = CullIndex(List=dispatch.ListA, Indices="0", Wrap=True)
cull_index_3 = CullIndex(List=dispatch_2.ListB, Indices="-1", Wrap=True)
cull_index_4 = CullIndex(List=dispatch.ListB, Indices="-1", Wrap=True)
shatter = Shatter(Curve=graft(explode_tree.Branch0), Parameters=[cull_index_4, cull_index_3])
shatter_2 = Shatter(Curve=graft(explode_tree.Branch0), Parameters=[cull_index_2, cull_index])
dispatch_3 = Dispatch(List=shatter_2, DispatchPattern=[True, False])  # -> ListA, ListB
dispatch_4 = Dispatch(List=shatter, DispatchPattern=[True, False])  # -> ListA, ListB
number_slider_3 = Slider(100, range=0..100)
number_slider_4 = Slider(0, range=0..100)
curve_2 = Curve(flatten(dispatch_3.ListA))
curve_3 = Curve(dispatch_4.ListA)
brep_strip = BrepStrip(StripExtension=number_slider_4, Curves=curve_3, Surface=surface, StripWidth=number_slider_3)
brep_strip_2 = BrepStrip(StripExtension=number_slider_4, Curves=curve_2, Surface=surface, StripWidth=number_slider_3)
negative = Negative(Value=Slider(19, range=0..100))
evaluate_curve = EvaluateCurve(Curve=curve_2)  # -> Point, Tangent, Angle
offset_surface = OffsetSurface(Surface=brep_strip, Distance=negative, Retrim=True)
