# Grasshopper definition 1203.gh (Grasshopper 1.0.7)
# plug-ins: Bifocals, BarkBeetle, Weaverbird, KUKA|prc - parametric robot control, Human

# ----
# Preparation
surface = Surface(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)
brep_edges = BrepEdges(Brep=surface)  # -> Naked, Interior, NonManifold
dispatch = Dispatch(List=brep_edges.Naked, DispatchPattern=[True, False])  # -> ListA, ListB
divide_curve = DivideCurve(Curve=dispatch.ListA, Count=Slider(8, range=0..20), Kinks=False)  # -> Points, Tangents, Parameters
divide_curve_2 = DivideCurve(Curve=dispatch.ListB, Count=Slider(5, range=0..10), Kinks=False)  # -> Points, Tangents, Parameters
explode_tree = ExplodeTree(Data=divide_curve.Points)  # -> Branch0, Branch1
explode_tree_2 = ExplodeTree(Data=divide_curve_2.Points)  # -> Branch0, Branch1
reverse_list = ReverseList(List=explode_tree_2.Branch1)
reverse_list_2 = ReverseList(List=explode_tree.Branch1)
geodesic = Geodesic(Surface=surface, Start=explode_tree_2.Branch0, End=reverse_list)
geodesic_2 = Geodesic(Surface=surface, Start=explode_tree.Branch0, End=reverse_list_2)
construct_point = ConstructPoint(XCoordinate=Slider(0.24, range=0..1), YCoordinate=Slider(0, range=0..1), ZCoordinate=0)
curve_intersection = CurveIntersection(CurvesA=graft(geodesic_2), CurvesB=geodesic, Tolerance=Slider(1, range=0..10))  # -> simplify(IntersectionPoints)
evaluate_surface = EvaluateSurface(Surface=reparameterize(surface), Point=construct_point)  # -> Point, Normal, UDirection, VDirection, Frame

number_slider = Slider(140, range=0..1000)
surface_2 = Surface(surface)
point = Point(curve_intersection)

# ---- group: Flip Matrix
flip_matrix = FlipMatrix(Data=point)
uv_network = UVNetwork(PointsTree=flip_matrix, Surface=surface_2, StripWidth=number_slider, ReferenceOption=0)  # -> UVNetwork, Points, UVCurves, ExtendedSrf

# ----
# Network
panel = Panel("0")
uv_network_2 = UVNetwork(PointsTree=point, Surface=surface_2, StripWidth=number_slider, ReferenceOption=panel)  # -> UVNetwork, Points, UVCurves, ExtendedSrf
brep_strip = BrepStrip(UVNetwork=uv_network_2.UVNetwork, StripExtension=Slider(69, range=0..100))

number_slider_2 = Slider(40, range=0..100)
number_slider_3 = Slider(20, range=0..100)
pt = Point(Tree({0}: [Point(-2042.753662, -657.3797336, 82.74777483), Point(-1543.407779, -810.0486015, 333.1536595), Point(-1006.225241, -927.1185183, 526.1329341), Point(-438.0689605, -1001.446628, 648.9981919), Point(147.9999999, -1026.91694, 691.1409185), Point(734.0689616, -1001.446628, 648.9981917), Point(1302.225244, -927.1185177, 526.1329332), Point(1839.40778, -810.0486011, 333.1536589), Point(2338.753664, -657.3797328, 82.74777374)], {1}: [Point(-2091.492191, -454.5473447, 150.4895582), Point(-1595.182952, -566.9280296, 427.6035345), Point(-1050.755152, -655.866863, 646.6883172), Point(-464.3094202, -713.8380954, 789.4084), Point(147.9999912, -734.0409892, 839.1383622), Point(760.3094206, -713.8380935, 789.4084004), Point(1346.755153, -655.866859, 646.6883176), Point(1891.182953, -566.9280242, 427.6035352), Point(2387.492192, -454.547338, 150.4895588)], {2}: [Point(-2118.7435, -240.5285691, 189.0307984), Point(-1627.549871, -284.3961669, 487.6131838), Point(-1080.610298, -320.0390154, 728.6266529), Point(-482.6523389, -343.790912, 888.7002114), Point(148.0000308, -352.1897922, 945.2195148), Point(778.6524289, -343.7909119, 888.7002109), Point(1376.610384, -320.0390152, 728.626652), Point(1923.549949, -284.3961667, 487.6131828), Point(2414.743564, -240.528573, 189.0307969)], {3}: [Point(-2118.743496, -21.47143166, 189.0307933), Point(-1627.549867, 22.39616688, 487.6131764), Point(-1080.610295, 58.03902614, 728.6266418), Point(-482.6523366, 81.79091345, 888.7002001), Point(148.0000308, 90.18979024, 945.2195033), Point(778.652427, 81.79091334, 888.7001995), Point(1376.61038, 58.03902597, 728.626641), Point(1923.549945, 22.3961666, 487.6131752), Point(2414.743561, -21.47142773, 189.0307918)], {4}: [Point(-2091.492192, 192.5473386, 150.4895602), Point(-1595.182953, 304.9280234, 427.6035371), Point(-1050.755151, 393.866874, 646.6883136), Point(-464.3094196, 451.8380968, 789.4084002), Point(147.9999912, 472.0409892, 839.1383628), Point(760.309421, 451.8380983, 789.408399), Point(1346.755151, 393.8668771, 646.6883119), Point(1891.182953, 304.9280278, 427.6035344), Point(2387.492191, 192.5473444, 150.4895575)], {5}: [Point(-2042.753662, 395.3797336, 82.74777483), Point(-1543.407779, 548.0485991, 333.1536611), Point(-1006.225239, 665.1185319, 526.1329267), Point(-438.0689593, 739.446631, 648.9981907), Point(147.9999999, 764.91694, 691.1409188), Point(734.0689623, 739.4466307, 648.9981903), Point(1302.22524, 665.1185316, 526.1329263), Point(1839.407781, 548.0485984, 333.1536601), Point(2338.753664, 395.3797329, 82.74777376)]))
number_slider_4 = Slider(17, range=0..100)

# ----
# Skeleton Graph
spiral_skeleton_graph = SpiralSkeletonGraph(UVNetwork=uv_network_2.UVNetwork)  # -> SkeletonGraph, SkeletonPoints, MainCurve, BranchCurves, Vectors

negative = Negative(Value=number_slider_2)
negative_2 = Negative(Value=number_slider_3)

number_slider_5 = Slider(0, range=0..10)
snake_infill_pattern = SnakeInfillPattern(
    SkeletonGraph=spiral_skeleton_graph.SkeletonGraph,
    SeamPoint=evaluate_surface.Point,
    PathWidth=number_slider_4,
    Spacing=number_slider_5)  # -> ToolpathPattern, Curve
unpack_toolpath_pattern = UnpackToolpathPattern(ToolpathPattern=snake_infill_pattern.ToolpathPattern)  # -> SkeletonGraph, Curve, BundleCurves, Points
point_2 = Point(flatten(unpack_toolpath_pattern.Points))

construct_domain = ConstructDomain(DomainStart=negative, DomainEnd=number_slider_2)
construct_domain_2 = ConstructDomain(DomainStart=negative_2, DomainEnd=number_slider_3)
range = Range(Domain=Domain(0, 1), Steps=Slider(21, range=0..100))
panel_2 = Panel("0.5")
xy_plane = XYPlane(Origin=Point(0, 0, 0))
snake_zigzag_pattern = SnakeZigZagPattern(
    SkeletonGraph=spiral_skeleton_graph.SkeletonGraph,
    SeamPoint=evaluate_surface.Point,
    PathWidth=number_slider_4,
    Spacing=number_slider_5)  # -> ToolpathPattern, Curve
rectangle = Rectangle(Plane=xy_plane, XSize=construct_domain, YSize=construct_domain_2, Radius=0)  # -> Rectangle, Length

# ----
# Pattern
spiral_toolpath_pattern = SpiralToolpathPattern(SeamPoint=evaluate_surface.Point, PathWidth=number_slider_4)  # -> flatten(ToolpathPattern), Curve; disabled
spiral_toolpath_pattern_2 = SpiralToolpathPattern(SkeletonGraph=spiral_skeleton_graph.SkeletonGraph, SeamPoint=evaluate_surface.Point, PathWidth=number_slider_4)  # -> ToolpathPattern, Curve; disabled
panel_3 = Panel("1")  # disabled
unpack_toolpath_pattern_2 = UnpackToolpathPattern(ToolpathPattern=spiral_toolpath_pattern_2.ToolpathPattern)  # -> SkeletonGraph, Curve, BundleCurves, Points; disabled
stack_toolpath_pattern = StackToolpathPattern(
    TopPattern=spiral_toolpath_pattern_2.ToolpathPattern,
    TopCount=panel_3,
    MiddlePatternS=spiral_toolpath_pattern.ToolpathPattern,
    BottomPattern=snake_infill_pattern.ToolpathPattern,
    BottomCount=panel_3)  # disabled

evaluate_curve = EvaluateCurve(Curve=reparameterize(spiral_skeleton_graph.MainCurve), Parameter=range)  # -> Point, Tangent, Angle
circle = Circle(Plane=xy_plane, Radius=number_slider_3)
pattern_avoid_obstacles = PatternAvoidObstacles(
    ToolpathPattern=snake_infill_pattern.ToolpathPattern,
    LocationPoints=evaluate_curve.Point,
    ObstacleCurve=rectangle.Rectangle,
    ReferencePlane=xy_plane)  # -> OutputToolpathPattern, Curve, BlockCurves, TrimCurves, IntersectionPts

# ----
# Stack Between Surfaces
number_slider_6 = Slider(40, range=0..100)  # disabled
number_slider_7 = Slider(5, range=0..10)  # disabled
boolean_toggle = BooleanToggle(False)  # disabled
surface_3 = Surface(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)  # disabled
reference_point = ReferencePoint(Point(176.542974, -1397.177065, 0))  # disabled
toolpath_stack_between_surfaces = ToolpathStackBetweenSurfaces(
    StackPatterns=stack_toolpath_pattern,
    LayerHeight=number_slider_6,
    TopSurface=surface_3,
    OrientOption=boolean_toggle,
    ReferencePoint=reference_point,
    PlaneRotateAngle=number_slider_7)  # -> ToolpathStack, ToolpathCurve, ToolpathFrames; disabled

# ----
# Stack Vertical (Offset)
number_slider_8 = Slider(20, range=0..100)  # disabled
number_slider_9 = Slider(80, range=0..100)  # disabled
number_slider_10 = Slider(5, range=0..10)  # disabled
boolean_toggle_2 = BooleanToggle(False)  # disabled
reference_point_2 = ReferencePoint(Point(176.542974, -1397.177065, 0))  # disabled
toolpath_stack_vertical = ToolpathStackVertical(
    StackPatterns=stack_toolpath_pattern,
    LayerHeight=number_slider_8,
    TotalHeight=number_slider_9,
    OrientOption=boolean_toggle_2,
    ReferencePoint=reference_point_2,
    PlaneRotateAngle=number_slider_10)  # -> ToolpathStack, ToolpathCurve, ToolpathPlanes; disabled
unpack_toolpath_stack = UnpackToolpathStack(ToolpathStack=toolpath_stack_vertical.ToolpathStack)  # -> ToolpathCurve, ToolpathCurves, ToolpathFrames, SurfaceSeries, SpeedFactors; disabled
number_slider_11 = Slider(0, range=0..3)  # disabled

plane = Plane(toolpath_stack_vertical.ToolpathPlanes)  # disabled
unpack_toolpath_stack_2 = UnpackToolpathStack(ToolpathStack=toolpath_stack_between_surfaces.ToolpathStack)  # -> ToolpathCurve, ToolpathCurves, ToolpathFrames, SurfaceSeries, SpeedFactors; disabled
curve = Curve(toolpath_stack_vertical.ToolpathCurve)  # disabled
curve_2 = Curve(unpack_toolpath_stack.ToolpathCurves)  # disabled
explode_tree_3 = ExplodeTree(Data=unpack_toolpath_stack_2.SpeedFactors)  # -> Branch0, Branch1, Branch2, Branch3; disabled

# ----
# Visualization
number_slider_12 = Slider(6, range=0..10)  # disabled
button = Button()  # disabled
panel_4 = Panel("0")  # disabled
fillet_toolpath_from_toolpathstack = FilletToolpathFromToolpathStack(
    ToolpathStack=toolpath_stack_between_surfaces.ToolpathStack,
    Radius=number_slider_12,
    Trigger=button,
    SeamLengthFactor=panel_4)  # -> Curve, ToolpathStack; disabled
toolpath_mesh = ToolpathMesh(ToolpathStack=fillet_toolpath_from_toolpathstack.ToolpathStack, Parameter=1)  # disabled
weaverbird_s_catmull_clark_subdivision = WeaverbirdsCatmullClarkSubdivision(MeshCurves=toolpath_mesh, Level=1, SmoothNakedEdges=1)  # disabled
custom_preview = CustomPreview(
    Geometry=weaverbird_s_catmull_clark_subdivision,
    Material={diffuse=RGB(221, 160, 221), emission=RGB(66, 48, 66), shine=0.5, specular=RGB(255, 255, 255), transparency=0})  # disabled

panel_5 = Panel(explode_tree_3.Branch0)  # disabled

# ----
# Visualization
number_slider_13 = Slider(6, range=0..10)  # disabled
button_2 = Button()  # disabled
panel_6 = Panel("0")  # disabled
fillet_toolpath_from_toolpathstack_2 = FilletToolpathFromToolpathStack(ToolpathStack=toolpath_stack_vertical.ToolpathStack, Radius=number_slider_13, Trigger=button_2, SeamLengthFactor=panel_6)  # -> Curve, ToolpathStack; disabled
toolpath_mesh_2 = ToolpathMesh(ToolpathStack=fillet_toolpath_from_toolpathstack_2.ToolpathStack, Parameter=1)  # disabled
weaverbird_s_catmull_clark_subdivision_2 = WeaverbirdsCatmullClarkSubdivision(MeshCurves=toolpath_mesh_2, Level=1, SmoothNakedEdges=1)  # disabled
custom_preview_2 = CustomPreview(
    Geometry=weaverbird_s_catmull_clark_subdivision_2,
    Material={diffuse=RGB(221, 160, 221), emission=RGB(66, 48, 66), shine=0.5, specular=RGB(255, 255, 255), transparency=0})  # disabled

# ----
# Output
panel_7 = Panel("0.25")  # disabled
to_kuka_movement = ToKukaMovement(ToolpathStack=toolpath_stack_vertical.ToolpathStack, VelMax=panel_7)  # -> ToolpathPlanes, SpeedFactors; disabled
linear_movement_kuka_prc = LINearMovementKUKAPrc(
    TargetAsPlane=to_kuka_movement.ToolpathPlanes,
    Speed=to_kuka_movement.SpeedFactors,
    extaxenabled=False,
    interpolation="C_DIS")  # disabled

list_item = ListItem(List=curve_2, Index=0, Wrap=True)  # -> Item1, Item, Item1_2, Item2
curve_3 = Curve(list_item.Item1)
curve_4 = Curve([list_item.Item, list_item.Item1_2, list_item.Item2])
discontinuity = Discontinuity(Curve=curve_3, Level=1)  # -> Points, Parameters
curve_closest_point = CurveClosestPoint(Point=discontinuity.Points, Curve=graft(curve_2))  # -> Point, Parameter, Distance
flip_matrix_2 = FlipMatrix(Data=curve_closest_point.Point)
polyline = PolyLine(Vertices=flip_matrix_2, Closed=False)
explode = Explode(Curve=polyline, Recursive=True)  # -> simplify(Segments), Vertices
end_points = EndPoints(Curve=explode.Segments)  # -> Start, End
unit_z = UnitZ(Factor=1)
vector_2pt = Vector2Pt(PointA=end_points.Start, PointB=end_points.End, Unitize=False)  # -> Vector, Length
angle = Angle(VectorA=unit_z, VectorB=vector_2pt.Vector)  # -> Angle, Reflex
flatten_tree = FlattenTree(Tree=explode.Segments, Path="{0}")
flatten_tree_2 = FlattenTree(Tree=angle.Angle, Path="{0}")
sort_list = SortList(Keys=flatten_tree_2, ValuesValuesA=flatten_tree)  # -> Keys, reverse(ValuesValuesA)
panel_8 = Panel(sort_list.Keys)
custom_preview_lineweights = CustomPreviewLineweights(
    Geometry=sort_list.ValuesValuesA,
    Shader={diffuse=RGB(255, 105, 180), emission=RGB(76, 32, 54), shine=0.5, specular=RGB(255, 255, 255), transparency=0},
    Thickness=Slider(20, range=0..100),
    Absolute=False)
