# Grasshopper definition 1209_drawing.gh (Grasshopper 1.0.8)
# plug-ins: Human, BarkBeetle, KUKA|prc - parametric robot control, Bifocals, Weaverbird

# ----
# Preparation
surface = Surface(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)
brep_edges = BrepEdges(Brep=surface)  # -> Naked, Interior, NonManifold
dispatch = Dispatch(List=brep_edges.Naked, DispatchPattern=[True, False])  # -> ListA, ListB
divide_curve = DivideCurve(Curve=dispatch.ListA, Count=Slider(8, range=0..20), Kinks=False)  # -> Points, Tangents, Parameters
divide_curve_2 = DivideCurve(Curve=dispatch.ListB, Count=Slider(5, range=0..10), Kinks=False)  # -> Points, Tangents, Parameters
explode_tree = ExplodeTree(Data=divide_curve.Points)  # -> Branch0, Branch1
explode_tree_2 = ExplodeTree(Data=divide_curve_2.Points)  # -> Branch0, Branch1
reverse_list = ReverseList(List=explode_tree_2.Branch1)
reverse_list_2 = ReverseList(List=explode_tree.Branch1)
geodesic = Geodesic(Surface=surface, Start=explode_tree_2.Branch0, End=reverse_list)
geodesic_2 = Geodesic(Surface=surface, Start=explode_tree.Branch0, End=reverse_list_2)
construct_point = ConstructPoint(XCoordinate=Slider(0.24, range=0..1), YCoordinate=Slider(0, range=0..1), ZCoordinate=0)
curve_intersection = CurveIntersection(CurvesA=graft(geodesic_2), CurvesB=geodesic, Tolerance=Slider(1, range=0..10))  # -> simplify(IntersectionPoints)
evaluate_surface = EvaluateSurface(Surface=reparameterize(surface), Point=construct_point)  # -> Point, Normal, UDirection, VDirection, Frame

point = Point(Tree({0}: [Point(-2042.756794, -657.3821901, 82.7516756), Point(-2091.48892, -454.545569, 150.4851977), Point(-2118.731446, -240.5262072, 189.0139047), Point(-2118.731443, -21.47379354, 189.0138996), Point(-2091.488921, 192.5455629, 150.4851997), Point(-2042.756794, 395.3821901, 82.7516756)], {1}: [Point(-1543.406243, -810.0469774, 333.1510721), Point(-1595.179352, -566.9254373, 427.5970853), Point(-1627.545574, -284.3950019, 487.6051561), Point(-1627.54557, 22.39500183, 487.6051487), Point(-1595.179353, 304.925431, 427.5970879), Point(-1543.406243, 548.046975, 333.1510737)], {2}: [Point(-1006.225691, -927.1192286, 526.1340588), Point(-1050.754137, -655.8657863, 646.6856314), Point(-1080.611689, -320.03958, 728.6304632), Point(-1080.611685, 58.03959072, 728.6304521), Point(-1050.754136, 393.8657973, 646.6856278), Point(-1006.225689, 665.1192422, 526.1340514)], {3}: [Point(-438.0701214, -1001.450313, 649.0040051), Point(-464.3096157, -713.8385081, 789.4094325), Point(-482.6549546, -343.7930397, 888.7144541), Point(-482.6549523, 81.79304112, 888.7144428), Point(-464.3096152, 451.8385095, 789.4094326), Point(-438.0701203, 739.4503156, 649.0040038)], {4}: [Point(147.9999999, -1026.91694, 691.1409185), Point(147.9999912, -734.0376223, 839.1299339), Point(148.0000308, -352.1904429, 945.223859), Point(148.0000308, 90.1904409, 945.2238475), Point(147.9999912, 472.0376223, 839.1299345), Point(147.9999999, 764.91694, 691.1409188)], {5}: [Point(734.0701225, -1001.450313, 649.0040049), Point(760.3096162, -713.8385062, 789.4094329), Point(778.6550446, -343.7930396, 888.7144537), Point(778.6550427, 81.79304101, 888.7144423), Point(760.3096165, 451.838511, 789.4094314), Point(734.0701232, 739.4503153, 649.0040034)], {6}: [Point(1302.225693, -927.119228, 526.1340579), Point(1346.754139, -655.8657823, 646.6856318), Point(1376.611775, -320.0395798, 728.6304623), Point(1376.611771, 58.03959055, 728.6304514), Point(1346.754136, 393.8658004, 646.6856261), Point(1302.22569, 665.1192419, 526.134051)], {7}: [Point(1839.406244, -810.0469769, 333.1510715), Point(1891.179353, -566.9254318, 427.597086), Point(1923.545652, -284.3950016, 487.6051551), Point(1923.545648, 22.39500156, 487.6051475), Point(1891.179353, 304.9254354, 427.5970852), Point(1839.406245, 548.0469742, 333.1510726)], {8}: [Point(2338.756796, -657.3821894, 82.75167451), Point(2387.488921, -454.5455623, 150.4851982), Point(2414.731511, -240.5262111, 189.0139032), Point(2414.731508, -21.47378962, 189.0138981), Point(2387.48892, 192.5455687, 150.4851969), Point(2338.756796, 395.3821894, 82.75167451)]))
surface_2 = Surface(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)
uv_network = UVNetwork(PointsTree=point, Surface=surface_2, StripWidth=Slider(140, range=0..1000), ReferenceOption="0")  # -> UVNetwork, Points, UVCurves, ExtendedSrf
point_2 = Point(curve_intersection)
surface_3 = Surface(surface)

# ----
# Network
panel = Panel("0")
uv_network_2 = UVNetwork(PointsTree=point_2, Surface=surface_3, StripWidth=Slider(140, range=0..1000), ReferenceOption=panel)  # -> UVNetwork, Points, UVCurves, ExtendedSrf
brep_strip = BrepStrip(UVNetwork=uv_network_2.UVNetwork, StripExtension=Slider(69, range=0..100))

explode_tree_3 = ExplodeTree(Data=brep_strip)  # -> Branch0, Branch1
move = Move(Geometry=explode_tree_3.Branch0, Motion=Vector(0, 0, 10))  # -> Geometry, Transform
number_slider = Slider(17, range=0..100)

# ----
# Skeleton Graph
spiral_skeleton_graph = SpiralSkeletonGraph(UVNetwork=uv_network_2.UVNetwork)  # -> SkeletonGraph, SkeletonPoints, MainCurve, BranchCurves, Vectors

surface_twist_angle_per_length = SurfaceTwistAnglePerLength(
    Surfaces=flatten([move.Geometry, explode_tree_3.Branch1]),
    Curves=flatten(uv_network_2.UVCurves),
    Density=Slider(3, range=0..10),
    OutputUnit=0)  # -> Meshes, LegendColors, LegendTags
surface_curvature = SurfaceCurvature(Surfaces=flatten([explode_tree_3.Branch1, move.Geometry]), Density=1, Type=0, OutputUnit=0)  # -> Meshes, LegendColors, LegendTags

snake_infill_pattern = SnakeInfillPattern(
    SkeletonGraph=spiral_skeleton_graph.SkeletonGraph,
    SeamPoint=evaluate_surface.Point,
    PathWidth=number_slider,
    Spacing=Slider(3, range=0..10))  # -> ToolpathPattern, Curve
unpack_toolpath_pattern = UnpackToolpathPattern(ToolpathPattern=snake_infill_pattern.ToolpathPattern)  # -> SkeletonGraph, Curve, BundleCurves, Points
point_3 = Point(flatten(unpack_toolpath_pattern.Points))

number_slider_2 = Slider(10, range=0..10)

number_slider_3 = Slider(40, range=0..100)
number_slider_4 = Slider(20, range=0..100)
negative = Negative(Value=number_slider_3)
negative_2 = Negative(Value=number_slider_4)
construct_domain = ConstructDomain(DomainStart=negative, DomainEnd=number_slider_3)
construct_domain_2 = ConstructDomain(DomainStart=negative_2, DomainEnd=number_slider_4)
xy_plane = XYPlane(Origin=Point(0, 0, 0))
range = Range(Domain=Domain(0, 1), Steps=Slider(21, range=0..100))
rectangle = Rectangle(Plane=xy_plane, XSize=construct_domain, YSize=construct_domain_2, Radius=0)  # -> Rectangle, Length
circle = Circle(Plane=xy_plane, Radius=Slider(25, range=0..100))
evaluate_curve = EvaluateCurve(Curve=reparameterize(spiral_skeleton_graph.MainCurve), Parameter=range)  # -> Point, Tangent, Angle
pattern_avoid_obstacles = PatternAvoidObstacles(
    ToolpathPattern=snake_infill_pattern.ToolpathPattern,
    LocationPoints=evaluate_curve.Point,
    ObstacleCurve=rectangle.Rectangle,
    ReferencePlane=xy_plane)  # -> OutputToolpathPattern, Curve, BlockCurves, TrimCurves, IntersectionPts; disabled

legend = Legend(Colour=surface_twist_angle_per_length.LegendColors, Tags=surface_twist_angle_per_length.LegendTags, LegendType=1)
snake_zigzag_pattern = SnakeZigZagPattern(
    SkeletonGraph=spiral_skeleton_graph.SkeletonGraph,
    SeamPoint=evaluate_surface.Point,
    PathWidth=number_slider,
    Spacing=Slider(6, range=0..100))  # -> ToolpathPattern, Curve

# ----
# Pattern
spiral_toolpath_pattern = SpiralToolpathPattern(SkeletonGraph=graft(spiral_skeleton_graph.SkeletonGraph), SeamPoint=evaluate_surface.Point, PathWidth=number_slider)  # -> flatten(ToolpathPattern), Curve
spiral_toolpath_pattern_2 = SpiralToolpathPattern(SkeletonGraph=spiral_skeleton_graph.SkeletonGraph, SeamPoint=evaluate_surface.Point, PathWidth=number_slider)  # -> ToolpathPattern, Curve
unpack_toolpath_pattern_2 = UnpackToolpathPattern(ToolpathPattern=spiral_toolpath_pattern_2.ToolpathPattern)  # -> SkeletonGraph, Curve, BundleCurves, Points
stack_toolpath_pattern = StackToolpathPattern(
    TopPattern=spiral_toolpath_pattern_2.ToolpathPattern,
    TopCount="1",
    MiddlePatternS=spiral_toolpath_pattern.ToolpathPattern,
    BottomPattern=spiral_toolpath_pattern_2.ToolpathPattern,
    BottomCount="1")

# ----
# Stack Between Surfaces
number_slider_5 = Slider(40, range=0..100)  # disabled
number_slider_6 = Slider(5, range=0..10)  # disabled
boolean_toggle = BooleanToggle(False)  # disabled
surface_4 = Surface(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)  # disabled
reference_point = ReferencePoint(Point(176.542974, -1397.177065, 0))  # disabled
toolpath_stack_between_surfaces = ToolpathStackBetweenSurfaces(
    StackPatterns=stack_toolpath_pattern,
    LayerHeight=number_slider_5,
    TopSurface=surface_4,
    OrientOption=boolean_toggle,
    ReferencePoint=reference_point,
    PlaneRotateAngle=number_slider_6)  # -> ToolpathStack, ToolpathCurve, ToolpathFrames; disabled

# ----
# Stack Vertical (Offset)
number_slider_7 = Slider(20, range=0..100)
reference_point_2 = ReferencePoint(Point(176.542974, -1397.177065, 0))
toolpath_stack_vertical = ToolpathStackVertical(
    StackPatterns=stack_toolpath_pattern,
    LayerHeight=number_slider_7,
    TotalHeight=Slider(80, range=0..100),
    OrientOption=Toggle(False),
    ReferencePoint=reference_point_2,
    PlaneRotateAngle=Slider(5, range=0..10))  # -> ToolpathStack, ToolpathCurve, ToolpathPlanes
unpack_toolpath_stack = UnpackToolpathStack(ToolpathStack=toolpath_stack_vertical.ToolpathStack)  # -> ToolpathCurve, ToolpathCurves, ToolpathFrames, SurfaceSeries, SpeedFactors

evaluate_overhang = EvaluateOverhang(ToolpathStack=toolpath_stack_vertical.ToolpathStack, DisplayThickness=Slider(10, range=0..10))  # -> LegendColors, LegendTags, Curves
rectangle_2 = Rectangle({Plane=PlaneXY(293.0879148, 1321.97293, 0), Size=Domain2(u=-55.94871564..55.94871564, v=-367.1634464..367.1634464)})
plane = Plane(toolpath_stack_vertical.ToolpathPlanes)  # disabled
unpack_toolpath_stack_2 = UnpackToolpathStack(ToolpathStack=toolpath_stack_between_surfaces.ToolpathStack)  # -> ToolpathCurve, ToolpathCurves, ToolpathFrames, SurfaceSeries, SpeedFactors; disabled
curve = Curve(unpack_toolpath_stack.ToolpathCurves)
explode_tree_4 = ExplodeTree(Data=unpack_toolpath_stack_2.SpeedFactors)  # -> Branch0, Branch1, Branch2, Branch3; disabled
custom_preview_lineweights = CustomPreviewLineweights(Geometry=curve, Shader=ColourSwatch(SwatchColor=RGB(186, 186, 186)), Absolute=False)

# ----
# Visualization
number_slider_8 = Slider(6, range=0..10)  # disabled
button = Button()  # disabled
panel_2 = Panel("0")  # disabled
fillet_toolpath_from_toolpathstack = FilletToolpathFromToolpathStack(
    ToolpathStack=toolpath_stack_between_surfaces.ToolpathStack,
    Radius=number_slider_8,
    Trigger=button,
    SeamLengthFactor=panel_2)  # -> Curve, ToolpathStack; disabled
toolpath_mesh = ToolpathMesh(ToolpathStack=fillet_toolpath_from_toolpathstack.ToolpathStack, Parameter=1)  # disabled
weaverbird_s_catmull_clark_subdivision = WeaverbirdsCatmullClarkSubdivision(MeshCurves=toolpath_mesh, Level=1, SmoothNakedEdges=1)  # disabled
custom_preview = CustomPreview(
    Geometry=weaverbird_s_catmull_clark_subdivision,
    Material={diffuse=RGB(221, 160, 221), emission=RGB(66, 48, 66), shine=0.5, specular=RGB(255, 255, 255), transparency=0})  # disabled

panel_3 = Panel(explode_tree_4.Branch0)  # disabled

# ----
# Visualization
number_slider_9 = Slider(6, range=0..10)  # disabled
button_2 = Button()  # disabled
panel_4 = Panel("0")  # disabled
fillet_toolpath_from_toolpathstack_2 = FilletToolpathFromToolpathStack(ToolpathStack=toolpath_stack_vertical.ToolpathStack, Radius=number_slider_9, Trigger=button_2, SeamLengthFactor=panel_4)  # -> Curve, ToolpathStack; disabled
toolpath_mesh_2 = ToolpathMesh(ToolpathStack=fillet_toolpath_from_toolpathstack_2.ToolpathStack, Parameter=1)  # disabled
weaverbird_s_catmull_clark_subdivision_2 = WeaverbirdsCatmullClarkSubdivision(MeshCurves=toolpath_mesh_2, Level=1, SmoothNakedEdges=1)  # disabled
custom_preview_2 = CustomPreview(
    Geometry=weaverbird_s_catmull_clark_subdivision_2,
    Material={diffuse=RGB(221, 160, 221), emission=RGB(66, 48, 66), shine=0.5, specular=RGB(255, 255, 255), transparency=0})  # disabled

# ----
# Output
panel_5 = Panel("0.25")  # disabled
to_kuka_movement = ToKukaMovement(ToolpathStack=toolpath_stack_vertical.ToolpathStack, VelMax=panel_5)  # -> ToolpathPlanes, SpeedFactors; disabled
linear_movement_kuka_prc = LINearMovementKUKAPrc(
    TargetAsPlane=to_kuka_movement.ToolpathPlanes,
    Speed=to_kuka_movement.SpeedFactors,
    extaxenabled=False,
    interpolation="C_DIS")  # disabled

number_slider_10 = Slider(10, range=0..100)  # disabled
evaluate_overhang_2 = EvaluateOverhang(ToolpathStack=toolpath_stack_vertical.ToolpathStack, DisplayThickness=number_slider_10)  # -> LegendColors, LegendTags, Curves; disabled
degrees = Degrees(Radians=evaluate_overhang_2.LegendTags)  # disabled
legend_2 = Legend(Colour=evaluate_overhang_2.LegendColors, Tags=degrees, LegendType=1)  # disabled
