# Grasshopper definition 1222.gh (Grasshopper 1.0.8)
# plug-ins: BarkBeetle, Bifocals

# ----
# Preparation
surface = Surface(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)
brep_edges = BrepEdges(Brep=surface)  # -> Naked, Interior, NonManifold
dispatch = Dispatch(List=brep_edges.Naked, DispatchPattern=[True, False])  # -> ListA, ListB
divide_curve = DivideCurve(Curve=dispatch.ListA, Count=Slider(8, range=0..20), Kinks=False)  # -> Points, Tangents, Parameters
divide_curve_2 = DivideCurve(Curve=dispatch.ListB, Count=Slider(5, range=0..10), Kinks=False)  # -> Points, Tangents, Parameters
explode_tree = ExplodeTree(Data=divide_curve.Points)  # -> Branch0, Branch1
explode_tree_2 = ExplodeTree(Data=divide_curve_2.Points)  # -> Branch0, Branch1
reverse_list = ReverseList(List=explode_tree_2.Branch1)
reverse_list_2 = ReverseList(List=explode_tree.Branch1)
geodesic = Geodesic(Surface=surface, Start=explode_tree_2.Branch0, End=reverse_list)
geodesic_2 = Geodesic(Surface=surface, Start=explode_tree.Branch0, End=reverse_list_2)
construct_point = ConstructPoint(XCoordinate=Slider(0, range=0..1), YCoordinate=Slider(0, range=0..1), ZCoordinate=0)
curve_intersection = CurveIntersection(CurvesA=graft(geodesic_2), CurvesB=geodesic, Tolerance=Slider(1, range=0..10))  # -> simplify(IntersectionPoints)
evaluate_surface = EvaluateSurface(Surface=reparameterize(surface), Point=construct_point)  # -> Point, Normal, UDirection, VDirection, Frame

point = Point(Tree({0}: [Point(-2042.756794, -657.3821901, 82.7516756), Point(-2091.48892, -454.545569, 150.4851977), Point(-2118.731446, -240.5262072, 189.0139047), Point(-2118.731443, -21.47379354, 189.0138996), Point(-2091.488921, 192.5455629, 150.4851997), Point(-2042.756794, 395.3821901, 82.7516756)], {1}: [Point(-1543.406243, -810.0469774, 333.1510721), Point(-1595.179352, -566.9254373, 427.5970853), Point(-1627.545574, -284.3950019, 487.6051561), Point(-1627.54557, 22.39500183, 487.6051487), Point(-1595.179353, 304.925431, 427.5970879), Point(-1543.406243, 548.046975, 333.1510737)], {2}: [Point(-1006.225691, -927.1192286, 526.1340588), Point(-1050.754137, -655.8657863, 646.6856314), Point(-1080.611689, -320.03958, 728.6304632), Point(-1080.611685, 58.03959072, 728.6304521), Point(-1050.754136, 393.8657973, 646.6856278), Point(-1006.225689, 665.1192422, 526.1340514)], {3}: [Point(-438.0701214, -1001.450313, 649.0040051), Point(-464.3096157, -713.8385081, 789.4094325), Point(-482.6549546, -343.7930397, 888.7144541), Point(-482.6549523, 81.79304112, 888.7144428), Point(-464.3096152, 451.8385095, 789.4094326), Point(-438.0701203, 739.4503156, 649.0040038)], {4}: [Point(147.9999999, -1026.91694, 691.1409185), Point(147.9999912, -734.0376223, 839.1299339), Point(148.0000308, -352.1904429, 945.223859), Point(148.0000308, 90.1904409, 945.2238475), Point(147.9999912, 472.0376223, 839.1299345), Point(147.9999999, 764.91694, 691.1409188)], {5}: [Point(734.0701225, -1001.450313, 649.0040049), Point(760.3096162, -713.8385062, 789.4094329), Point(778.6550446, -343.7930396, 888.7144537), Point(778.6550427, 81.79304101, 888.7144423), Point(760.3096165, 451.838511, 789.4094314), Point(734.0701232, 739.4503153, 649.0040034)], {6}: [Point(1302.225693, -927.119228, 526.1340579), Point(1346.754139, -655.8657823, 646.6856318), Point(1376.611775, -320.0395798, 728.6304623), Point(1376.611771, 58.03959055, 728.6304514), Point(1346.754136, 393.8658004, 646.6856261), Point(1302.22569, 665.1192419, 526.134051)], {7}: [Point(1839.406244, -810.0469769, 333.1510715), Point(1891.179353, -566.9254318, 427.597086), Point(1923.545652, -284.3950016, 487.6051551), Point(1923.545648, 22.39500156, 487.6051475), Point(1891.179353, 304.9254354, 427.5970852), Point(1839.406245, 548.0469742, 333.1510726)], {8}: [Point(2338.756796, -657.3821894, 82.75167451), Point(2387.488921, -454.5455623, 150.4851982), Point(2414.731511, -240.5262111, 189.0139032), Point(2414.731508, -21.47378962, 189.0138981), Point(2387.48892, 192.5455687, 150.4851969), Point(2338.756796, 395.3821894, 82.75167451)]))
surface_2 = Surface(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)
number_slider = Slider(140, range=0..1000)
uv_network = UVNetwork(PointsTree=point, Surface=surface_2, StripWidth=Slider(140, range=0..1000), ReferenceOption="0")  # -> UVNetwork, Points, UVCurves, ExtendedSrf
point_2 = Point(curve_intersection)
surface_3 = Surface(surface)

# ---- group: Flip Matrix
flip_matrix = FlipMatrix(Data=point_2)
uv_network_2 = UVNetwork(PointsTree=flip_matrix, Surface=surface_3, StripWidth=number_slider, ReferenceOption=0)  # -> UVNetwork, Points, UVCurves, ExtendedSrf

# ----
# Network
panel = Panel("0")
uv_network_3 = UVNetwork(PointsTree=point_2, Surface=surface_3, StripWidth=number_slider, ReferenceOption=panel)  # -> UVNetwork, Points, UVCurves, ExtendedSrf
brep_strip = BrepStrip(UVNetwork=uv_network_3.UVNetwork, StripExtension=Slider(69, range=0..100))

explode_tree_3 = ExplodeTree(Data=brep_strip)  # -> Branch0, Branch1
move = Move(Geometry=explode_tree_3.Branch0, Motion=Vector(0, 0, 10))  # -> Geometry, Transform
surface_twist_angle_per_length = SurfaceTwistAnglePerLength(
    Surfaces=flatten([move.Geometry, explode_tree_3.Branch1]),
    Curves=flatten(uv_network_2.UVCurves),
    Density=Slider(3, range=0..10),
    OutputUnit=0)  # -> Meshes, LegendColors, LegendTags
surface_curvature = SurfaceCurvature(Surfaces=flatten([explode_tree_3.Branch1, move.Geometry]), Density=1, Type=0, OutputUnit=0)  # -> Meshes, LegendColors, LegendTags
point_3 = Point(Tree({0}: [Point(-2042.753662, -657.3797336, 82.74777483), Point(-1543.407779, -810.0486015, 333.1536595), Point(-1006.225241, -927.1185183, 526.1329341), Point(-438.0689605, -1001.446628, 648.9981919), Point(147.9999999, -1026.91694, 691.1409185), Point(734.0689616, -1001.446628, 648.9981917), Point(1302.225244, -927.1185177, 526.1329332), Point(1839.40778, -810.0486011, 333.1536589), Point(2338.753664, -657.3797328, 82.74777374)], {1}: [Point(-2091.492191, -454.5473447, 150.4895582), Point(-1595.182952, -566.9280296, 427.6035345), Point(-1050.755152, -655.866863, 646.6883172), Point(-464.3094202, -713.8380954, 789.4084), Point(147.9999912, -734.0409892, 839.1383622), Point(760.3094206, -713.8380935, 789.4084004), Point(1346.755153, -655.866859, 646.6883176), Point(1891.182953, -566.9280242, 427.6035352), Point(2387.492192, -454.547338, 150.4895588)], {2}: [Point(-2118.7435, -240.5285691, 189.0307984), Point(-1627.549871, -284.3961669, 487.6131838), Point(-1080.610298, -320.0390154, 728.6266529), Point(-482.6523389, -343.790912, 888.7002114), Point(148.0000308, -352.1897922, 945.2195148), Point(778.6524289, -343.7909119, 888.7002109), Point(1376.610384, -320.0390152, 728.626652), Point(1923.549949, -284.3961667, 487.6131828), Point(2414.743564, -240.528573, 189.0307969)], {3}: [Point(-2118.743496, -21.47143166, 189.0307933), Point(-1627.549867, 22.39616688, 487.6131764), Point(-1080.610295, 58.03902614, 728.6266418), Point(-482.6523366, 81.79091345, 888.7002001), Point(148.0000308, 90.18979024, 945.2195033), Point(778.652427, 81.79091334, 888.7001995), Point(1376.61038, 58.03902597, 728.626641), Point(1923.549945, 22.3961666, 487.6131752), Point(2414.743561, -21.47142773, 189.0307918)], {4}: [Point(-2091.492192, 192.5473386, 150.4895602), Point(-1595.182953, 304.9280234, 427.6035371), Point(-1050.755151, 393.866874, 646.6883136), Point(-464.3094196, 451.8380968, 789.4084002), Point(147.9999912, 472.0409892, 839.1383628), Point(760.309421, 451.8380983, 789.408399), Point(1346.755151, 393.8668771, 646.6883119), Point(1891.182953, 304.9280278, 427.6035344), Point(2387.492191, 192.5473444, 150.4895575)], {5}: [Point(-2042.753662, 395.3797336, 82.74777483), Point(-1543.407779, 548.0485991, 333.1536611), Point(-1006.225239, 665.1185319, 526.1329267), Point(-438.0689593, 739.446631, 648.9981907), Point(147.9999999, 764.91694, 691.1409188), Point(734.0689623, 739.4466307, 648.9981903), Point(1302.22524, 665.1185316, 526.1329263), Point(1839.407781, 548.0485984, 333.1536601), Point(2338.753664, 395.3797329, 82.74777376)]))

# ----
# Skeleton Graph
spiral_skeleton_graph = SpiralSkeletonGraph(UVNetwork=uv_network_3.UVNetwork)  # -> SkeletonGraph, SkeletonPoints, MainCurve, BranchCurves, Vectors

legend = Legend(Colour=surface_twist_angle_per_length.LegendColors, Tags=surface_twist_angle_per_length.LegendTags, LegendType=1)
spiral_skeleton_graph_2 = SpiralSkeletonGraph(UVNetwork=uv_network_3.UVNetwork)  # -> SkeletonGraph, SkeletonPoints, MainCurve, BranchCurves, Vectors
number_slider_2 = Slider(17, range=0..100)

snake_infill_pattern = SnakeInfillPattern(
    SkeletonGraph=spiral_skeleton_graph.SkeletonGraph,
    SeamPoint=evaluate_surface.Point,
    PathWidth=number_slider_2,
    Spacing=Slider(0, range=0..10))  # -> ToolpathPattern, Curve
unpack_toolpath_pattern = UnpackToolpathPattern(ToolpathPattern=snake_infill_pattern.ToolpathPattern)  # -> SkeletonGraph, Curve, BundleCurves, Points
point_4 = Point(flatten(unpack_toolpath_pattern.Points))

# ----
# Pattern
spiral_toolpath_pattern = SpiralToolpathPattern(SkeletonGraph=graft(spiral_skeleton_graph.SkeletonGraph), SeamPoint=evaluate_surface.Point, PathWidth=number_slider_2)  # -> flatten(ToolpathPattern), Curve
spiral_toolpath_pattern_2 = SpiralToolpathPattern(SkeletonGraph=spiral_skeleton_graph.SkeletonGraph, SeamPoint=evaluate_surface.Point, PathWidth=number_slider_2)  # -> ToolpathPattern, Curve
unpack_toolpath_pattern_2 = UnpackToolpathPattern(ToolpathPattern=spiral_toolpath_pattern_2.ToolpathPattern)  # -> SkeletonGraph, Curve, BundleCurves, Points
stack_toolpath_pattern = StackToolpathPattern(
    TopPattern=spiral_toolpath_pattern_2.ToolpathPattern,
    TopCount="1",
    MiddlePatternS=spiral_toolpath_pattern.ToolpathPattern,
    BottomPattern=spiral_toolpath_pattern_2.ToolpathPattern,
    BottomCount="1")

number_slider_3 = Slider(1000, range=0..1000)
snake_zigzag_pattern = SnakeZigZagPattern(
    SkeletonGraph=spiral_skeleton_graph.SkeletonGraph,
    SeamPoint=evaluate_surface.Point,
    PathWidth=number_slider_2,
    Spacing=0)  # -> ToolpathPattern, Curve
unit_x = UnitX(Factor=number_slider_3)
reference_point = ReferencePoint(Point(176.542974, -1397.177065, 0))
line_sdl = LineSDL(Start=reference_point, Direction=unit_x, Length=number_slider_3)
curve = Curve(line_sdl)
boolean_toggle = BooleanToggle(False)
number_slider_4 = Slider(5, range=0..10)

# ----
# Stack Between Surfaces
number_slider_5 = Slider(40, range=0..100)
surface_4 = Surface(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)
toolpath_stack_between_surfaces = ToolpathStackBetweenSurfaces(
    StackPatterns=stack_toolpath_pattern,
    LayerHeight=number_slider_5,
    TopSurface=surface_4,
    ReferenceGeometry=curve,
    OrientOption=False,
    PlaneRotateAngle=0)  # -> ToolpathStack, ToolpathCurve, ToolpathFrames

edge_skeleton_graph = EdgeSkeletonGraph(UVNetwork=uv_network_3.UVNetwork, EdgeOption=Slider(2, range=0..10))  # -> SkeletonGraph, SkeletonPoints, MainCurve, Vectors
toolpath_stack_vertical = ToolpathStackVertical(
    StackPatterns=stack_toolpath_pattern,
    LayerHeight=Slider(30, range=0..100),
    TotalHeight=Slider(169, range=0..1000),
    OrientOption=False,
    PlaneRotateAngle=0)  # -> ToolpathStack, ToolpathCurve, ToolpathPlanes
toolpath_stack_offset = ToolpathStackOffset(
    StackPatterns=stack_toolpath_pattern,
    LayerHeight=Slider(30, range=0..100),
    TotalHeight=Slider(100, range=0..100),
    OrientOption=False,
    PlaneRotateAngle=0)  # -> ToolpathStack, ToolpathCurve, ToolpathPlanes
end_points = EndPoints(Curve=edge_skeleton_graph.MainCurve)  # -> Start, End
spiral_toolpath_pattern_3 = SpiralToolpathPattern(SkeletonGraph=edge_skeleton_graph.SkeletonGraph, SeamPoint=end_points.Start, PathWidth=number_slider_2)  # -> ToolpathPattern, Curve
number_slider_6 = Slider(14, range=0..100)
number_slider_7 = Slider(63, range=0..100)
to_kuka_movement = ToKukaMovement(
    ToolpathStack=toolpath_stack_between_surfaces.ToolpathStack,
    MinSpeed=Slider(20, range=0..100),
    MaxSpeed=Slider(50, range=0..100),
    Rounding=2)  # -> ToolpathPlanes, RobotSpeed
stack_on_top = StackOnTop(
    ToolpathPattern=spiral_toolpath_pattern_3.ToolpathPattern,
    LayerHeight=Slider(39, range=0..100),
    TotalHeight=Slider(61, range=0..100))  # -> ToolpathStack, ToolpathCurve, ToolpathPlanes, MappedToolpathPattern
stack_on_top_2 = StackOnTop(
    ToolpathPattern=spiral_toolpath_pattern_3.ToolpathPattern,
    LayerHeight=Slider(25, range=0..100),
    TotalHeight=Slider(61, range=0..100))  # -> ToolpathStack, ToolpathCurve, ToolpathPlanes, MappedToolpathPattern
unpack_toolpath_pattern_3 = UnpackToolpathPattern(ToolpathPattern=spiral_toolpath_pattern_3.ToolpathPattern)  # -> SkeletonGraph, Curve, BundleCurves, Points
curve_2 = Curve(unpack_toolpath_pattern_3.Curve)
unpack_toolpath_pattern_4 = UnpackToolpathPattern(ToolpathPattern=stack_on_top_2.MappedToolpathPattern)  # -> SkeletonGraph, Curve, BundleCurves, Points
curve_3 = Curve(unpack_toolpath_pattern_4.Curve)
list_item = ListItem(List=unpack_toolpath_pattern_4.BundleCurves, Index=0, Wrap=True)  # -> Item, Item1, Item2
