# Grasshopper definition illustration.gh (Grasshopper 1.0.7)
# plug-ins: Bifocals, BarkBeetle, Weaverbird, Pufferfish, KUKA|prc - parametric robot control, Human

surface = Surface(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)
# Orthogonal Strips
brep_edges = BrepEdges(Brep=surface)  # -> Naked, Interior, NonManifold
# Can deal with UV Surfaces (UV structured points)
number_slider = Slider(10, range=0..20)
dispatch = Dispatch(List=brep_edges.Naked, DispatchPattern=[True, False])  # -> ListA, ListB
divide_curve = DivideCurve(Curve=dispatch.ListA, Count=number_slider, Kinks=False)  # -> Points, Tangents, Parameters
divide_curve_2 = DivideCurve(Curve=dispatch.ListB, Count=Slider(5, range=0..10), Kinks=False)  # -> Points, Tangents, Parameters
explode_tree = ExplodeTree(Data=divide_curve.Points)  # -> Branch0, Branch1
explode_tree_2 = ExplodeTree(Data=divide_curve_2.Points)  # -> Branch0, Branch1
reverse_list = ReverseList(List=explode_tree_2.Branch1)
reverse_list_2 = ReverseList(List=explode_tree.Branch1)
geodesic = Geodesic(Surface=surface, Start=explode_tree_2.Branch0, End=reverse_list)
geodesic_2 = Geodesic(Surface=surface, Start=explode_tree.Branch0, End=reverse_list_2)
construct_point = ConstructPoint(XCoordinate=Slider(1, range=0..1), YCoordinate=Slider(0, range=0..1), ZCoordinate=0)
curve_intersection = CurveIntersection(CurvesA=graft(geodesic_2), CurvesB=geodesic, Tolerance=Slider(1, range=0..10))  # -> simplify(IntersectionPoints)
evaluate_surface = EvaluateSurface(Surface=reparameterize(surface), Point=construct_point)  # -> Point, Normal, UDirection, VDirection, Frame

surface_2 = Surface(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)
# Orthogonal Strips
brep_edges_2 = BrepEdges(Brep=surface_2)  # -> Naked, Interior, NonManifold
# Can deal with UV Surfaces (UV structured points)
number_slider_2 = Slider(9, range=0..20)
dispatch_2 = Dispatch(List=brep_edges_2.Naked, DispatchPattern=[True, False])  # -> ListA, ListB
divide_curve_3 = DivideCurve(Curve=dispatch_2.ListA, Count=number_slider_2, Kinks=False)  # -> Points, Tangents, Parameters
divide_curve_4 = DivideCurve(Curve=dispatch_2.ListB, Count=Slider(5, range=0..10), Kinks=False)  # -> Points, Tangents, Parameters
explode_tree_3 = ExplodeTree(Data=divide_curve_3.Points)  # -> Branch0, Branch1
explode_tree_4 = ExplodeTree(Data=divide_curve_4.Points)  # -> Branch0, Branch1
reverse_list_3 = ReverseList(List=explode_tree_4.Branch1)
reverse_list_4 = ReverseList(List=explode_tree_3.Branch1)
geodesic_3 = Geodesic(Surface=surface_2, Start=explode_tree_4.Branch0, End=reverse_list_3)
geodesic_4 = Geodesic(Surface=surface_2, Start=explode_tree_3.Branch0, End=reverse_list_4)
construct_point_2 = ConstructPoint(XCoordinate=Slider(1, range=0..1), YCoordinate=Slider(0, range=0..1), ZCoordinate=0)
curve_intersection_2 = CurveIntersection(CurvesA=graft(geodesic_4), CurvesB=geodesic_3, Tolerance=Slider(1, range=0..10))  # -> simplify(IntersectionPoints)
evaluate_surface_2 = EvaluateSurface(Surface=reparameterize(surface_2), Point=construct_point_2)  # -> Point, Normal, UDirection, VDirection, Frame

number_slider_3 = Slider(170, range=0..1000)
number_slider_4 = Slider(200, range=0..1000)
surface_3 = Surface(surface)
point = Point(curve_intersection)
surface_4 = Surface(surface_2)
point_2 = Point(curve_intersection_2)
panel = Panel("3")
flip_matrix = FlipMatrix(Data=point)
flip_matrix_2 = FlipMatrix(Data=point_2)
uv_network_on_surface = UVNetworkOnSurface(Surface=surface_3, PointsTree=point, StripWidth=number_slider_3)  # -> UVNetwork, Points, UVCurves, ExtendedSrf
curve = Curve(uv_network_on_surface.UVCurves)
uv_network_on_surface_2 = UVNetworkOnSurface(Surface=surface_3, PointsTree=flip_matrix, StripWidth=number_slider_3)  # -> UVNetwork, Points, UVCurves, ExtendedSrf
uv_network_on_surface_3 = UVNetworkOnSurface(Surface=surface_4, PointsTree=point_2, StripWidth=number_slider_4)  # -> UVNetwork, Points, UVCurves, ExtendedSrf
curve_2 = Curve(uv_network_on_surface_3.UVCurves)
uv_network_on_surface_4 = UVNetworkOnSurface(Surface=surface_4, PointsTree=flip_matrix_2, StripWidth=number_slider_4)  # -> UVNetwork, Points, UVCurves, ExtendedSrf
point_3 = Point(uv_network_on_surface.Points)
point_4 = Point(uv_network_on_surface_3.Points)
colour_swatch = ColourSwatch(SwatchColor=RGB(17, 74, 217))
number_slider_5 = Slider(35, range=0..100)
snake_skeleton_graph = SnakeSkeletonGraph(UVNetwork=uv_network_on_surface.UVNetwork)  # -> SkeletonGraph, SkeletonPoints, MainCurve, BranchCurves, Vectors
spiral_skeleton_graph = SpiralSkeletonGraph(UVNetwork=uv_network_on_surface.UVNetwork)  # -> SkeletonGraph, SkeletonPoints, MainCurve, BranchCurves, Vectors
snake_skeleton_graph_2 = SnakeSkeletonGraph(UVNetwork=uv_network_on_surface_2.UVNetwork)  # -> SkeletonGraph, SkeletonPoints, MainCurve, BranchCurves, Vectors
brep_strip = BrepStrip(UVNetwork=uv_network_on_surface.UVNetwork, StripExtension=Slider(69, range=0..100), StripWidth=number_slider_3)
colour_swatch_2 = ColourSwatch(SwatchColor=RGB(255, 255, 255))
snake_skeleton_graph_3 = SnakeSkeletonGraph(UVNetwork=uv_network_on_surface_3.UVNetwork)  # -> SkeletonGraph, SkeletonPoints, MainCurve, BranchCurves, Vectors
spiral_skeleton_graph_2 = SpiralSkeletonGraph(UVNetwork=uv_network_on_surface_3.UVNetwork)  # -> SkeletonGraph, SkeletonPoints, MainCurve, BranchCurves, Vectors
unit_z = UnitZ(Factor=-1)
snake_skeleton_graph_4 = SnakeSkeletonGraph(UVNetwork=uv_network_on_surface_4.UVNetwork)  # -> SkeletonGraph, SkeletonPoints, MainCurve, BranchCurves, Vectors
brep_strip_2 = BrepStrip(UVNetwork=uv_network_on_surface_3.UVNetwork, StripExtension=Slider(69, range=0..100), StripWidth=number_slider_4)
colour_swatch_3 = ColourSwatch(SwatchColor=RGB(255, 255, 255))
unit_z_2 = UnitZ(Factor=-1)
merge = Merge(Data1=point_3, Data2=snake_skeleton_graph_2.MainCurve)
negative = Negative(Value=Slider(10, range=0..100))
point_5 = Point(Point(2422.147863, 507.9148132, 0))
negative_2 = Negative(Value=Slider(10, range=0..100))
move = Move(Geometry=brep_strip, Motion=unit_z)  # -> Geometry, Transform
explode_tree_5 = ExplodeTree(Data=move.Geometry)  # -> Branch0, Branch1
point_6 = Point(Point(2422.147863, 507.9148132, 0))
custom_preview_lineweights = CustomPreviewLineweights(Geometry=merge, Shader=ColourSwatch(SwatchColor=RGB(17, 120, 217)), Thickness="3", Absolute=False)
spiral_toolpath_pattern = SpiralToolpathPattern(SkeletonGraph=spiral_skeleton_graph.SkeletonGraph, SeamPoint=point_5, PathWidth=number_slider_5)  # -> ToolpathPattern, Curve
spiral_toolpath_pattern_2 = SpiralToolpathPattern(
    SkeletonGraph=graft([snake_skeleton_graph_2.SkeletonGraph, snake_skeleton_graph.SkeletonGraph]),
    SeamPoint=point_5,
    PathWidth=number_slider_5)  # -> flatten(ToolpathPattern), Curve
move_2 = Move(Geometry=brep_strip_2, Motion=unit_z_2)  # -> Geometry, Transform
shatter = Shatter(Curve=reparameterize(spiral_skeleton_graph_2.MainCurve), Parameters=Slider(1, range=0..1))
unit_z_3 = UnitZ(Factor=negative)
explode_tree_6 = ExplodeTree(Data=move_2.Geometry)  # -> Branch0, Branch1
spiral_toolpath_pattern_3 = SpiralToolpathPattern(
    SkeletonGraph=graft([snake_skeleton_graph_4.SkeletonGraph, snake_skeleton_graph_3.SkeletonGraph]),
    SeamPoint=point_6,
    PathWidth=Slider(30, range=0..100))  # -> flatten(ToolpathPattern), Curve
move_3 = Move(Geometry=explode_tree_5.Branch0, Motion=unit_z_3)  # -> Geometry, Transform
unit_z_4 = UnitZ(Factor=negative_2)
move_4 = Move(Geometry=explode_tree_6.Branch0, Motion=unit_z_4)  # -> Geometry, Transform
unpack_toolpath_pattern = UnpackToolpathPattern(ToolpathPattern=spiral_toolpath_pattern.ToolpathPattern)  # -> SkeletonGraph, Curve, BundleCurves, Points
merge_2 = Merge(Data1=spiral_toolpath_pattern.ToolpathPattern, Data2=spiral_toolpath_pattern_2.ToolpathPattern)
list_item = ListItem(List=shatter, Index=0, Wrap=True)
list_item_2 = ListItem(List=spiral_toolpath_pattern_2.ToolpathPattern, Index=0, Wrap=True)
offset_surface = OffsetSurface(Surface=[explode_tree_5.Branch1, move_3.Geometry], Distance=negative, BothSides=0, CreateSolid=True)
colour_swatch_4 = ColourSwatch(SwatchColor=RGB(0, 0, 0))
stack_toolpath_pattern = StackToolpathPattern(MainPattern=merge_2, BottomPattern=spiral_toolpath_pattern.ToolpathPattern, BottomCount=0, TopCount=0)
offset_surface_2 = OffsetSurface(Surface=[explode_tree_6.Branch1, move_4.Geometry], Distance=negative_2, BothSides=0, CreateSolid=True)
colour_swatch_5 = ColourSwatch(SwatchColor=RGB(0, 0, 0))
stack_toolpath_pattern_2 = StackToolpathPattern(MainPattern=spiral_toolpath_pattern_3.ToolpathPattern, BottomCount=0, TopCount=0)
stack_toolpath_pattern_3 = StackToolpathPattern(MainPattern=merge_2, BottomPattern=spiral_toolpath_pattern.ToolpathPattern, BottomCount=0, TopCount=0)
create_material = CreateMaterial(
    Diffuse=ColourSwatch(SwatchColor=RGB(234, 184, 134)),
    Specular=colour_swatch_4,
    Emission=colour_swatch_4,
    Transparency="0",
    Shine="0")
custom_preview_lineweights_2 = CustomPreviewLineweights(
    Geometry=unpack_toolpath_pattern.Curve,
    Shader=ColourSwatch(SwatchColor=RGB(217, 17, 187)),
    Thickness="3",
    Absolute=False)
create_material_2 = CreateMaterial(
    Diffuse=ColourSwatch(SwatchColor=RGB(255, 255, 255)),
    Specular=colour_swatch_5,
    Emission=colour_swatch_5,
    Transparency="0",
    Shine="0")
number_slider_6 = Slider(0, range=0..10)
point_7 = Point(Point(316.0038151, -96.85492855, 0))
negative_3 = Negative(Value=Slider(0, range=0..100))
number_slider_7 = Slider(0, range=0..10)
custom_preview = CustomPreview(Geometry=offset_surface, Material=create_material)
point_8 = Point(Point(316.0038151, -96.85492855, 0))
negative_4 = Negative(Value=Slider(0, range=0..100))
custom_preview_2 = CustomPreview(Geometry=offset_surface_2, Material=create_material_2)  # disabled
toolpath_stack_vertical = ToolpathStackVertical(
    StackPatterns=stack_toolpath_pattern,
    LayerHeight=Slider(20, range=0..100),
    TotalHeight=Slider(60, range=0..100),
    OrientOption=Toggle(False),
    ReferencePoint=point_7,
    PlaneRotateAngle=negative_3)  # -> ToolpathStack, ToolpathCurve, ToolpathFrames
toolpath_stack_vertical_2 = ToolpathStackVertical(
    StackPatterns=stack_toolpath_pattern_2,
    LayerHeight=Slider(20, range=0..100),
    TotalHeight=Slider(40, range=0..100),
    OrientOption=Toggle(False),
    ReferencePoint=point_8,
    PlaneRotateAngle=negative_4)  # -> ToolpathStack, ToolpathCurve, ToolpathFrames
number_slider_8 = Slider(1, range=0..1)
fillet_toolpath_from_toolpathstack = FilletToolpathFromToolpathStack(
    ToolpathStack=toolpath_stack_vertical.ToolpathStack,
    Radius=Slider(1, range=0..10),
    Trigger=Button(),
    SeamLengthFactor="0")  # -> Curve, ToolpathStack
fillet_toolpath_from_toolpathstack_2 = FilletToolpathFromToolpathStack(
    ToolpathStack=toolpath_stack_vertical_2.ToolpathStack,
    Radius=Slider(1, range=0..10),
    Trigger=Button(),
    SeamLengthFactor="0")  # -> Curve, ToolpathStack

to_kuka_movement = ToKukaMovement(ToolpathStack=toolpath_stack_vertical.ToolpathStack, VelMax="0.25")  # -> ToolpathFrames, SpeedFactors
plane = Plane(flatten(to_kuka_movement.ToolpathFrames))
quantec_kr210_r3300k_ultra_robot = QuantecKR210R3300KUltraRobot(infiniterot=False)
deconstruct_plane = DeconstructPlane(Plane=plane)  # -> Origin, expr("-x", XAxis), YAxis, expr("-x", ZAxis)
construct_plane = ConstructPlane(Origin=deconstruct_plane.Origin, XAxis=deconstruct_plane.ZAxis, YAxis=deconstruct_plane.YAxis)
kl1500_3_linear_axis_kuka_prc = KL15003LinearAxisKUKAPrc(
    KUKAPrcRobotInput=quantec_kr210_r3300k_ultra_robot,
    PositiveLength=4000,
    NegativeLength=-500,
    PositiveDirection=Vector(1, 0, 0),
    RobotBase=PlaneXY(0, 0, 507))
geo = Geometry([Point(179.294, -42.498, 322.572), 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])
linear_movement_kuka_prc = LINearMovementKUKAPrc(TargetAsPlane=construct_plane, Speed=to_kuka_movement.SpeedFactors, extaxenabled=False, interpolation="C_DIS")
custom_tool = CustomToolForKUKAPrc(
    CustomToolGeometry=geo,
    isExternal=False,
    toolid=7,
    toolvala=-8.94,
    toolvalb=-0.326,
    toolvalc=0,
    toolvalx=179.294,
    toolvaly=-42.498,
    toolvalz=322.572,
    valuesset=True)
kuka_prc_core = KUKAPrcCORE(
    SimulationSlider=number_slider_8,
    KUKAPrcCommands=linear_movement_kuka_prc,
    Tool=custom_tool,
    Robot=kl1500_3_linear_axis_kuka_prc,
    PRC_BaseExpose=False,
    PRC_SaveNameExpose=False,
    PRCsettings="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")  # -> RobotGeometry, AnalysisOutput

toolpath_mesh = ToolpathMesh(ToolpathStack=fillet_toolpath_from_toolpathstack.ToolpathStack, Parameter=number_slider_8)
weaverbird_s_catmull_clark_subdivision = WeaverbirdsCatmullClarkSubdivision(MeshCurves=toolpath_mesh, Level=Slider(2, range=0..10), SmoothNakedEdges=1)
elte_spindle_kuka_prc = ElteSpindleKUKAPrc(ToolLength=100, ToolDiameter=10, ToolNumber=6)
elte_spindle_kuka_prc_2 = ElteSpindleKUKAPrc(ToolLength=100, ToolDiameter=10, ToolNumber=6)
unit_x = UnitX(Factor=1)
unit_x_2 = UnitX(Factor=1)
number_slider_9 = Slider(1, range=0..1)

to_kuka_movement_2 = ToKukaMovement(ToolpathStack=toolpath_stack_vertical_2.ToolpathStack, VelMax="0.25")  # -> ToolpathFrames, SpeedFactors
plane_2 = Plane(flatten(to_kuka_movement_2.ToolpathFrames))
quantec_kr210_r3300k_ultra_robot_2 = QuantecKR210R3300KUltraRobot(infiniterot=False)
deconstruct_plane_2 = DeconstructPlane(Plane=plane_2)  # -> Origin, expr("-x", XAxis), YAxis, expr("-x", ZAxis)
construct_plane_2 = ConstructPlane(Origin=deconstruct_plane_2.Origin, XAxis=deconstruct_plane_2.ZAxis, YAxis=deconstruct_plane_2.YAxis)
kl1500_3_linear_axis_kuka_prc_2 = KL15003LinearAxisKUKAPrc(
    KUKAPrcRobotInput=quantec_kr210_r3300k_ultra_robot_2,
    PositiveLength=4000,
    NegativeLength=-500,
    PositiveDirection=Vector(1, 0, 0),
    RobotBase=PlaneXY(0, 0, 507))
geo_2 = Geometry([Point(179.294, -42.498, 322.572), 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])
linear_movement_kuka_prc_2 = LINearMovementKUKAPrc(TargetAsPlane=construct_plane_2, Speed=to_kuka_movement_2.SpeedFactors, extaxenabled=False, interpolation="C_DIS")
custom_tool_2 = CustomToolForKUKAPrc(
    CustomToolGeometry=geo_2,
    isExternal=False,
    toolid=7,
    toolvala=-8.94,
    toolvalb=-0.326,
    toolvalc=0,
    toolvalx=179.294,
    toolvaly=-42.498,
    toolvalz=322.572,
    valuesset=True)
kuka_prc_core_2 = KUKAPrcCORE(
    SimulationSlider=number_slider_9,
    KUKAPrcCommands=linear_movement_kuka_prc_2,
    Tool=custom_tool_2,
    Robot=kl1500_3_linear_axis_kuka_prc_2,
    PRC_BaseExpose=False,
    PRC_SaveNameExpose=False,
    PRCsettings="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")  # -> RobotGeometry, AnalysisOutput

colour_swatch_6 = ColourSwatch(SwatchColor=RGB(181, 181, 181))
number_slider_10 = Slider(0, range=0..0.5)
create_material_3 = CreateMaterial(
    Diffuse=colour_swatch_6,
    Specular=colour_swatch_6,
    Emission=ColourSwatch(SwatchColor=RGB(0, 0, 0)),
    Transparency=0,
    Shine=0)
custom_preview_3 = CustomPreview(Geometry=weaverbird_s_catmull_clark_subdivision, Material=create_material_3)
unpack_toolpath_stack = UnpackToolpathStack(ToolpathStack=fillet_toolpath_from_toolpathstack_2.ToolpathStack)  # -> ToolpathCurve, ToolpathCurves, ToolpathFrames, SurfaceSeries, SpeedFactors
point_9 = Point(flatten(unpack_toolpath_stack.ToolpathFrames))
explode_tree_7 = ExplodeTree(Data=kuka_prc_core_2.RobotGeometry)  # -> Branch0, Branch1, Branch2
curve_3 = Curve(unpack_toolpath_stack.ToolpathCurve)
mesh = Mesh(explode_tree_7.Branch0)
list_item_3 = ListItem(List=explode_tree_7.Branch2, Index=0, Wrap=True)
curve_closest_point = CurveClosestPoint(Point=point_9, Curve=reparameterize(curve_3))  # -> Point, Parameter, Distance
custom_preview_4 = CustomPreview(Geometry=mesh, Material=explode_tree_7.Branch1)
end_points = EndPoints(Curve=list_item_3)  # -> Start, End
curve_closest_point_2 = CurveClosestPoint(Point=end_points.Start, Curve=reparameterize(curve_3))  # -> Point, Parameter, Distance
item_index = ItemIndex(List=curve_closest_point.Parameter, Item=curve_closest_point.Parameter)
subtraction = Subtraction(A=curve_closest_point_2.Parameter, B=curve_closest_point.Parameter)
absolute = Absolute(Value=subtraction)
smaller_than = SmallerThan(FirstNumber=curve_closest_point_2.Distance, SecondNumber="1")  # -> SmallerThan, OrEqualTo
list_length = ListLength(List=curve_closest_point.Parameter)
sort_list = SortList(Keys=absolute, ValuesA=item_index)  # -> Keys, ValuesA
larger_than = LargerThan(FirstNumber=number_slider_9, SecondNumber="0.5")  # -> LargerThan, OrEqualTo
list_item_4 = ListItem(List=sort_list.ValuesA, Index=0, Wrap=True)
division = Division(A=list_item_4, B=list_length)
stream_filter = StreamFilter(Gate=smaller_than.SmallerThan, Stream0=larger_than.LargerThan, Stream1=division)
toolpath_mesh_2 = ToolpathMesh(ToolpathStack=fillet_toolpath_from_toolpathstack_2.ToolpathStack, Parameter=stream_filter)
weaverbird_s_catmull_clark_subdivision_2 = WeaverbirdsCatmullClarkSubdivision(MeshCurves=toolpath_mesh_2, Level=Slider(2, range=0..10), SmoothNakedEdges=1)
colour_swatch_7 = ColourSwatch(SwatchColor=RGB(0, 0, 0))
create_material_4 = CreateMaterial(
    Diffuse=ColourSwatch(SwatchColor=RGB(214, 214, 214)),
    Specular=colour_swatch_7,
    Emission=colour_swatch_7,
    Transparency=0,
    Shine=0)
custom_preview_5 = CustomPreview(Geometry=weaverbird_s_catmull_clark_subdivision_2, Material=create_material_4)
